# Grasshopper definition Universal NYC.gh (Grasshopper 1.0.7)
# plug-ins: DeCodingSpaces, Human, TT Toolbox, Shortest Walk in Gh

# ---- group: Heating Required / January
domain_sunrise_sunset = Domain(Domain(7.358, 16.8814))
crv_sun_path = Curve(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)

# ---- group: Heating Required / February
domain_sunrise_sunset_2 = Domain(Domain(6.8088, 17.5118))
crv_sun_path_2 = Curve(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)

# ---- group: Heating Required / December
domain_sunrise_sunset_3 = Domain(Domain(7.366, 16.4306))
crv_sun_path_3 = Curve(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)

# ---- group: Heating Required / October
domain_sunrise_sunset_4 = Domain(Domain(6.2875, 17.0649))
crv_sun_path_4 = Curve(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)

# ---- group: Heating Required / April
domain_sunrise_sunset_5 = Domain(Domain(5.2389, 18.5842))
crv_sun_path_5 = Curve(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)

# ---- group: Heating Required / November
domain_sunrise_sunset_6 = Domain(Domain(6.9011, 16.4908))
crv_sun_path_6 = Curve(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)

# ---- group: Heating Required / March
domain_march = Domain(Domain(6.068, 18.0386))
crv_march = Curve(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)

# ----
cluster = Cluster(
    crv_sunpath=crv_sun_path_6,
    domain_sunrise_sunset=domain_sunrise_sunset_6,
    crv_sunpath_7=crv_sun_path_4,
    domain_sunrise_sunset_7=domain_sunrise_sunset_4,
    crv_sunpath_2=crv_sun_path_5,
    domain_sunrise_sunset_2=domain_sunrise_sunset_5,
    crv_sunpath_3=crv_sun_path_5,
    domain_sunrise_sunset_3=domain_sunrise_sunset_5,
    crv_sunpath_5=crv_march,
    domain_sunrise_sunset_5=domain_march,
    crv_sunpath_4=crv_sun_path,
    domain_sunrise_sunset_4=domain_sunrise_sunset,
    crv_sunpath_6=crv_sun_path_2,
    domain_sunrise_sunset_6=domain_sunrise_sunset_2,
    crv_sunpath_8=crv_sun_path_3,
    domain_sunrise_sunset_8=domain_sunrise_sunset_3)
podium_markethall_height = Slider(40, range=0..100)
markethall_corridor = Slider(20, range=0..100)
floor_to_floor_height = Slider(11, range=0..100)
number_slider = Slider(3, range=0..10)
crv_mega_block = Curve(<curve referenced from the Rhino model>)
parcel_width = Slider(40, range=40..200)
street_option = Slider(0, range=0..2)

crv_streets_3 = Curve([<curve referenced from the Rhino model> x3])
crv_streets_1 = Curve([<curve referenced from the Rhino model> x6])
crv_streets_2 = Curve([<curve referenced from the Rhino model> x10])

number_slider_2 = Slider(10, range=0..10)
crv_public_space = Curve([<curve referenced from the Rhino model> x8])  # disabled
int_market_hall_parcel_width = Integer(Slider(40, range=0..100))
explode = Explode(Curve=crv_mega_block, Recursive=True)  # -> Segments, Vertices
bridge_width = Slider(20, range=0..100)
floor_to_floor_height_2 = Number(floor_to_floor_height)
int_street_option = Integer(street_option)
mesh_context = Mesh(<mesh referenced from the Rhino model>)
pt_midpoints_of_nodes = Point([<point referenced from the Rhino model> x24])
floor_to_floor_height_3 = Number(floor_to_floor_height_2)
crv_car = Curve()
crv_bike = Curve()
crv_bike_2 = Curve()
crv_streets_1_2 = Curve(flatten([crv_streets_1, explode.Segments]))
pt_selected = Point(<point referenced from the Rhino model>)

# ----
# Inputs
# GLOBALS
inputs_panel = Panel("")
# XIM Standards
# Notes: Panels can (but do not have to) be 50% saturation to avoid overwhelming in text
data = Data(True)

# ---- group: Heating Required / January
domain_sunrise_sunset_7 = Domain(Domain(7.358, 16.8814))
crv_sun_path_7 = Curve(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)

# ---- group: Heating Required / February
domain_sunrise_sunset_8 = Domain(Domain(6.8088, 17.5118))
crv_sun_path_8 = Curve(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)

# ---- group: Heating Required / December
domain_sunrise_sunset_9 = Domain(Domain(7.366, 16.4306))
crv_sun_path_9 = Curve(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)

# ---- group: Cooling Required / July
domain_sunrise_sunset_10 = Domain(Domain(4.7717, 19.3044))
crv_sun_path_10 = Curve(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)

# ---- group: Heating Required / October
domain_sunrise_sunset_11 = Domain(Domain(6.2875, 17.0649))
crv_sun_path_11 = Curve(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)

# ---- group: Cooling Required / August
domain_sunrise_sunset_12 = Domain(Domain(5.2562, 18.7136))
crv_sun_path_12 = Curve(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)

# ---- group: Heating Required / April
domain_sunrise_sunset_13 = Domain(Domain(5.2389, 18.5842))
crv_sun_path_13 = Curve(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)

# ---- group: Heating Required / November
domain_sunrise_sunset_14 = Domain(Domain(6.9011, 16.4908))
crv_sun_path_14 = Curve(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)

# ---- group: Heating Required / March
domain_march_2 = Domain(Domain(6.068, 18.0386))
crv_march_2 = Curve(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)

# ----
# BLOCKS & PARCELS
crv_mega_block_2 = Curve(crv_mega_block)
# PROCEDURAL MODELS
crv_mega_block_3 = Curve(crv_mega_block_2)
distance_off_of_ground_in_document_units = Panel("5")  # disabled
subdivision_resolution = Panel("30")
path_epw_file_location = FilePath("D:\Dropbox\@Columbia GSAPP\@Fall_2020\X-info Modeling\@Teamwork\1115\USA_NY_New.York-Central.Park.725033_TMY3.epw")  # disabled
geo_building_s_to_test = Geometry(<brep referenced from the Rhino model>)  # disabled
analysis_resolution = Panel("10")  # disabled
int_street_option_2 = Integer(int_street_option)
crv_analysis_area = Curve(<curve referenced from the Rhino model>)  # disabled

crv_streets_3_2 = Curve(crv_streets_3)
crv_streets_1_3 = Curve(crv_streets_1_2)
crv_streets_2_2 = Curve(crv_streets_2)

min_hour_threshold = Panel("1")  # disabled
start_time = Panel("7")  # disabled
end_time = Panel("18")  # disabled
day = Panel("15")  # disabled
month_1_12 = Panel("3")  # disabled

# ----
# Ouputs
data_2 = Data(True)

number_slider_3 = Slider(0, range=0..10)
number_slider_4 = Slider(5, range=0..10)
number_slider_5 = Slider(6, range=0..10)
number_slider_6 = Slider(2, range=0..10)
number_slider_7 = Slider(4, range=0..10)
number_slider_8 = Slider(8, range=0..10)
number_slider_9 = Slider(1, range=0..10)
number_slider_10 = Slider(3, range=0..10)
number_slider_11 = Slider(7, range=0..10)
int_offset = Integer(Slider(20, range=0..100))
number_slider_12 = Slider(0, range=0..8)
number_slider_13 = Slider(100, range=0..100)

len = Length(Curve=crv_streets_3_2)
division = Division(A=len, B="20")
max = Maximum(A=division, B="10")
reb = RebuildCurve(Curve=crv_streets_3_2, Degree="1", Count="10", Tangents=False)

number_slider_14 = Slider(56, range=0..67)

# ----
# Intermediate
data_3 = Data(True)

crv_sunpath = Curve(crv_sun_path_11)
domain_sunrise_sunset_15 = Domain(domain_sunrise_sunset_11)

# ----
# Note
note_panel = Panel("")

dedomain = DeconstructDomain(Domain=domain_sunrise_sunset_15)  # -> Start, End
merge = Merge(Data1=flatten(geo_building_s_to_test))  # disabled
subtraction = Subtraction(A=dedomain.End, B=dedomain.Start)
cluster_2 = Cluster_3(geo_context_obstructions=merge)  # disabled
cluster_3 = Cluster_4(crv_analysis_area=crv_analysis_area, num_analysis_resolution=analysis_resolution)  # disabled
divide = DivideCurve(Curve=crv_sunpath, Count=subtraction, Kinks=False)  # -> Points, Tangents, Parameters
xy = XYPlane(Origin=Point(0, 0, 0))
filter = StreamFilter(Gate=int_street_option_2, Stream0=crv_streets_1_3, Stream1=crv_streets_2_2, Stream2=reb)
num_distance_off_of_ground = Number(distance_off_of_ground_in_document_units)  # disabled
ln = Line(StartPoint=divide.Points, EndPoint=xy)
crv_sun_vectors = Curve(ln)
crv_sun_vector = Curve(crv_sun_vectors)
crv_filter = Curve(filter)
Z = UnitZ(Factor=num_distance_off_of_ground)  # disabled
len_2 = Length(Curve=crv_filter)
division_2 = Division(A=markethall_corridor, B=2)
move = Move(Geometry=cluster_3, Motion=Z)  # -> Geometry, Transform; disabled
larger = LargerThan(FirstNumber=len_2, SecondNumber="1500")  # -> LargerThan, OrEqualTo
cluster_4 = Cluster_5(
    mesh_obstructions=cluster_2,
    num_distance_off_of_ground=num_distance_off_of_ground,
    srf_analysis_surfaces=cluster_3,
    num_start_time=start_time,
    num_end_time=end_time,
    int_days=day,
    int_months=month_1_12,
    path_epw_file_location=path_epw_file_location)  # -> num_is_sun_visible_3, num_number_of_hours_per_day_2; disabled
dispatch = Dispatch(List=crv_filter, DispatchPattern=larger.LargerThan)  # -> ListA, ListB
crv_sun_vectors_2 = Curve(crv_sun_vectors)
crv_sun_vectors_3 = Curve(crv_sun_vectors)
len_3 = Length(Curve=dispatch.ListB)
mesh = Mesh(move.Geometry)  # disabled
larger_2 = LargerThan(FirstNumber=len_3, SecondNumber="1050")  # -> LargerThan, OrEqualTo
floor_to_floor_height_4 = Number(floor_to_floor_height_2)
number_slider_15 = Slider(200, range=0..1000)
floor_to_floor_height_5 = Number(floor_to_floor_height_2)
lng = ListLength(List=crv_sun_vectors_2)
lng_2 = ListLength(List=crv_sun_vectors_3)
dispatch_2 = Dispatch(List=dispatch.ListB, DispatchPattern=larger_2.LargerThan)  # -> ListA, ListB
cluster_5 = Cluster_6(
    num_is_sun_visible=cluster_4.num_is_sun_visible_3,
    num_number_of_hours_per_day=cluster_4.num_number_of_hours_per_day_2,
    num_hour_threshold=min_hour_threshold)  # -> num_in_sun_avg_2, num_average_hours_2, num_average_hours_per_analysis_point_2, num_passing_threshold_4, num_passing_threshold_3; disabled
number_slider_16 = Slider(0, range=0..100)
crv_secondary_streets = Curve(dispatch_2.ListA)
crv_primary_streets = Curve(dispatch.ListA)
crv_tertiary_streets = Curve(dispatch_2.ListB)
crv_mega_block_4 = Curve(crv_mega_block_2)
multiplication = Multiplication(A=floor_to_floor_height_5, B=Slider(100, range=0..100))
average_sun_vector = Vector(Vector(-0.002278690398, 0.5247548885, -0.3666307175))
pt = ConstructPoint(XCoordinate=number_slider_16, YCoordinate=number_slider_16, ZCoordinate=number_slider_16)
lng_3 = ListLength(List=crv_secondary_streets)
lng_4 = ListLength(List=crv_primary_streets)
lng_5 = ListLength(List=crv_tertiary_streets)
explode_2 = Explode(Curve=crv_mega_block_4, Recursive=True)  # -> Segments, Vertices
mesh_2 = Mesh(graft(mesh))  # disabled
sqrt = SquareRoot(Value=Slider(2, range=0..10))
vec2pt = Vector2Pt(PointA=pt, PointB=average_sun_vector, Unitize=False)  # -> Vector, Length
item = ListItem(List=explode_2.Vertices, Index=0, Wrap=True)
dup = DuplicateData(Data="15", Number=lng_5, Order=True)
dup_2 = DuplicateData(Data="30", Number=lng_3, Order=True)
dup_3 = DuplicateData(Data="30", Number=lng_4, Order=True)
division_3 = Division(A=podium_markethall_height, B=3)
multiplication_2 = Multiplication(A=sqrt, B=2)
division_4 = Division(A=multiplication, B=multiplication_2)
devec = DeconstructVector(Vector=vec2pt.Vector)  # -> XComponent, YComponent, ZComponent
X = UnitX(Factor=division_4)
Z_2 = UnitZ(Factor=division_3)
merge_2 = Merge(Data1=dup_3, Data2=dup_2, Data3=dup)
merge_3 = Merge(Data1=crv_primary_streets, Data2=crv_secondary_streets, Data3=crv_tertiary_streets)
division_5 = Division(A=devec.YComponent, B=devec.XComponent)
pdecon = Deconstruct(Point=average_sun_vector)  # -> XComponent, YComponent, ZComponent
amp = Amplitude(Vector=X, Amplitude=division_5)
srf_analysis_panels = Geometry()
num_threshold = Number()
streets_1_width = Panel("""50
30
15
30""")
streets_3_width = Panel("""30
30
30""")
streets_2_width = Panel("""50
40
30
20""")
Y = UnitY(Factor=amp)
num_min_hour_threshold = Number(min_hour_threshold)  # disabled
panel = Panel("0")  # disabled
panel_2 = Panel("1")  # disabled
panel_3 = Panel("0")  # disabled
panel_4 = Panel("10")  # disabled
panel_5 = Panel(srf_analysis_panels)
panel_6 = Panel(num_threshold)
panel_7 = Panel(devec.XComponent)
panel_8 = Panel(devec.YComponent)
geo = Geometry(crv_mega_block_3)
filter_2 = StreamFilter(Gate=int_street_option_2, Stream0=merge_2, Stream1=streets_2_width, Stream2=streets_3_width)
gradient = Gradient(
    LowerLimit=num_min_hour_threshold,
    UpperLimit=panel_4,
    Parameter=cluster_5.num_average_hours_per_analysis_point_2,
    stops=[0: RGB(0, 0, 0), 0.231: RGB(173, 203, 249), 0.5: RGB(254, 244, 84), 0.75: RGB(234, 126, 0), 1: RGB(234, 38, 0)])  # disabled
gradient_2 = Gradient(
    LowerLimit=panel,
    UpperLimit=panel_2,
    Parameter=cluster_5.num_passing_threshold_4,
    stops=[0: RGB(255, 74, 74), 1: RGB(105, 255, 252)])  # disabled
Z_3 = UnitZ(Factor=multiplication)
int_street_width = Integer(filter_2)
crv_filter_2 = Curve(merge_3)
crv_streets = Curve(simplify(graft(crv_filter_2)))
crv_streets_4 = Curve(simplify(flatten(crv_streets)))  # disabled
ext = ExtendCurve(Curve=crv_streets, Type=0, Start="100", End="100")

# ---- group: Create subtraction curves
int_street_width_2 = Integer(simplify(graft(int_street_width)))
neg = Negative(Value=int_street_width_2)
merge_4 = Merge(Data1=int_street_width_2, Data2=neg)
offset = Offset(Curve=ext, Distance=merge_4, Plane=PlaneXY(0, 0, 0), Corners=1)
trim = TrimTree(Tree=offset, Depth=1)
end = EndPoints(Curve=trim)  # -> Start, End
item_2 = ListItem(List=end.End, Index=0, Wrap=True)  # -> Item, Item1
item_3 = ListItem(List=end.Start, Index=0, Wrap=True)  # -> Item, Item1
ln_2 = Line(StartPoint=item_2.Item, EndPoint=item_2.Item1)
ln_3 = Line(StartPoint=item_3.Item, EndPoint=item_3.Item1)
merge_5 = Merge(Data1=trim, Data2=ln_3, Data3=ln_2)
join = JoinCurves(Curves=merge_5, Preserve=False)  # -> flatten(Curves)

# ---- group: Pt: Intersection
crv_mega_block_5 = Curve(crv_mega_block_2)
crv_streets_5 = Curve(ext)
crossref = CrossReference(ListA=flatten(crv_streets_5), ListB=flatten(crv_streets_5), CrossMode=1)  # -> graft(ListA), graft(ListB)
ccx = CurveCurve(CurveA=flatten(crv_streets_5), CurveB=crv_mega_block_5)  # -> Points, ParamsA, ParamsB
ccx_2 = CurveCurve(CurveA=crossref.ListA, CurveB=crossref.ListB)  # -> Points, ParamsA, ParamsB
cullpt = CullDuplicates(Points=ccx_2.Points, Tolerance=0.1, CullMode=3)  # -> Points, Indices, Valence
incurve = PointInCurve(Point=cullpt.Points, Curve=crv_mega_block_5)  # -> Relationship, Point
dispatch_3 = Dispatch(List=cullpt.Points, DispatchPattern=incurve.Relationship)  # -> ListA, ListB
geo_2 = Geometry(flatten([dispatch_3.ListA, ccx.Points]))

# ----
pshift = ShiftPaths(Data=offset, Offset=-1)
panel_9 = Panel(pshift)

runion = RegionUnion(Curves=join)
crv_mega_block_6 = Curve(crv_mega_block_4)
boundary = BoundarySurfaces(Edges=runion)
srfsplit = SurfaceSplit(Surface=boundary, Curves=crv_mega_block_6)
edges = BrepEdges(Brep=srfsplit)  # -> Naked, Interior, NonManifold
join_2 = JoinCurves(Curves=edges.Naked, Preserve=False)
lng_6 = ListLength(List=join_2)  # -> flatten(Length)
sort = SortList(Keys=lng_6, ValuesA=srfsplit)  # -> Keys, ValuesA
item_4 = ListItem(List=sort.ValuesA, Index=1, Wrap=True)

# ---- group: Create Blocks
srfsplit_2 = SurfaceSplit(Surface=crv_mega_block_4, Curves=join)
area = Area(Geometry=srfsplit_2)  # -> Area, Centroid
incurves = PointInCurves(Point=area.Centroid, Curves=join)  # -> Relationship, Index, Point
dispatch_4 = Dispatch(List=srfsplit_2, DispatchPattern=incurves.Relationship)  # -> ListA, ListB
crv_blocks = Curve(dispatch_4.ListB)

# ----
srfsplit_3 = SurfaceSplit(Surface=crv_mega_block_4, Curves=join)
edges_2 = BrepEdges(Brep=graft(srfsplit_3))  # -> Naked, Interior, NonManifold
join_3 = JoinCurves(Curves=edges_2.Naked, Preserve=False)  # -> flatten(Curves)
geo_3 = Geometry(join_3)
incurve_2 = PointInCurve(Point=graft(geo_2), Curve=geo_3)  # -> Relationship, Point
dispatch_5 = Dispatch(List=geo_3, DispatchPattern=incurve_2.Relationship)  # -> ListA, ListB
node = Geometry(dispatch_5.ListA)

node_2 = Geometry(node)
node_3 = Geometry(node_2)  # disabled
lng_7 = ListLength(List=node_3)
area_2 = Area(Geometry=node_3)  # -> Area, flatten(Centroid); disabled
node_4 = Geometry(node_2)
node_5 = Geometry(flatten(node_4))
preview = CustomPreview(Geometry=node_5, Material=ColourSwatch(SwatchColor=RGB(0, 0, 0)))
join_4 = JoinCurves(Curves=flatten(node_2), Preserve=False)

crv_node = Curve(simplify(graft(node_2)))
int_offset_2 = Integer(Slider(30, range=0..100))
offset_l = OffsetCurveLoose(Curve=crv_node, Distance=int_offset_2)
curvepoint = PointOnCurve(offset_l, parameter=0.543)
incurve_3 = PointInCurve(Point=curvepoint, Curve=crv_node)  # -> Relationship, Point
dispatch_6 = Dispatch(List=crv_node, DispatchPattern=incurve_3.Relationship)  # -> ListA, ListB
flip = FlipCurve(Curve=dispatch_6.ListA)  # -> Curve, Flag
merge_6 = Merge(Data1=dispatch_6.ListB, Data2=flip.Curve)
int_offset_3 = Integer(int_offset_2)
offset_l_2 = OffsetCurveLoose(Curve=merge_6, Distance=int_offset_3)
geo_4 = Geometry(flatten(offset_l_2))

area_3 = Area(Geometry=node_5)  # -> Area, Centroid
item_5 = ListItem(List=node_5, Index=Slider(10, range=0..67), Wrap=True)
area_4 = Area(Geometry=item_5)  # -> Area, Centroid
node_6 = Geometry(node_3)  # disabled
move_2 = Move(Geometry=geo_4, Motion=Vector(0, 0, 10))  # -> Geometry, Transform
geo_streets = Geometry(item_4)
geo_streets_2 = Geometry(geo_streets)
preview_2 = CustomPreview(Geometry=geo_streets_2, Material=ColourSwatch(SwatchColor=RGB(255, 255, 255)))
cluster_6 = Cluster_2(brep_design=geo_streets_2, num_subdivision_resolution=Slider(30, range=0..100))  # -> srf_analysis_panel_2, pt_analysis_points_2, vec_normal_vector_2
srf_analysis_panel = Surface(flatten(cluster_6.srf_analysis_panel_2))
pt_analysis_points = Point(flatten(cluster_6.pt_analysis_points_2))
srf_analysis_panel_2 = Surface(flatten(srf_analysis_panel))
mesh_3 = Mesh(srf_analysis_panel_2)
item_6 = ListItem(List=geo_4, Index=0, Wrap=True)
area_5 = Area(Geometry=item_6)  # -> Area, Centroid
move_3 = Move(Geometry=geo_4, Motion=X)  # -> Geometry, Transform
move_4 = Move(Geometry=move_3.Geometry, Motion=Y)  # -> Geometry, Transform
average_for_analysis_area = Panel(cluster_5.num_in_sun_avg_2)  # disabled
average_hours = Panel(cluster_5.num_average_hours_2)  # disabled
passing_threshold = Panel(cluster_5.num_passing_threshold_3)  # disabled

crv_mega_block_7 = Curve(crv_mega_block_2)
area_6 = Area(Geometry=crv_blocks)  # -> Area, Centroid
lng_8 = ListLength(List=crv_blocks)
division_6 = Division(A=lng_8, B=4)
crv_cp = CurveClosestPoint(Point=area_6.Centroid, Curve=crv_mega_block_7)  # -> Point, Parameter, Distance
round = Round(Number=division_6)  # -> Nearest, Floor, Ceiling
ln_4 = Line(StartPoint=crv_cp.Point, EndPoint=area_6.Centroid)
subtraction_2 = Subtraction(A=round.Ceiling, B=1)
len_4 = Length(Curve=ln_4)
sort_2 = SortList(Keys=len_4, ValuesA=crv_blocks)  # -> Keys, ValuesA
split = SplitList(List=sort_2.ValuesA, Index=subtraction_2)  # -> ListA, ListB

ma = MassAddition(Input=area_6.Area)  # -> Result, PartialResults
division_7 = Division(A=ma.Result, B=lng_8)
division_8 = Division(A=division_7, B=Slider(1, range=0..10))
smaller = SmallerThan(FirstNumber=area_6.Area, SecondNumber=division_8)  # -> SmallerThan, OrEqualTo
dispatch_7 = Dispatch(List=crv_blocks, DispatchPattern=smaller.SmallerThan)  # -> ListA, ListB

swatch = ColourSwatch(SwatchColor=RGBA(255, 255, 255, 79))
swatch_2 = ColourSwatch(SwatchColor=RGB(255, 255, 255))

explode_3 = Explode(Curve=node, Recursive=True)  # -> Segments, Vertices
cullduplines = RemoveDuplicateLines(InputLines=flatten(explode_3.Segments), Tolerance=0.001)  # -> OutputLines, FirstLineIndexes
join_5 = JoinCurves(Curves=cullduplines.OutputLines, Preserve=False)
lng_9 = ListLength(List=join_5)

mcol = MeshColours(Mesh=mesh_2, Colours=gradient_2)  # disabled
mcol_2 = MeshColours(Mesh=mesh_2, Colours=gradient)  # disabled
number_slider_17 = Slider(0.5, range=0..1)
geo_5 = Geometry(simplify(graft(geo_4)))
crv_markethall = Geometry(dispatch_7.ListA)
crv_markethall_2 = Geometry(crv_markethall)

# ---- group: Create Parcels
disc = Discontinuity(Curve=crv_markethall_2, Level=1)  # -> Points, Parameters
int_parcel_width = Integer(int_market_hall_parcel_width)
pline = PolyLine(Vertices=disc.Points, Closed=True)
parcels = Parcels(Polygons=pline, ConnectionDistance=1, StreetOffset=0, PlotWidthThreshold=int_parcel_width, Precision=100)  # -> flatten(Parcels)
xy_2 = XYPlane(Origin=item)
project = Project(Geometry=parcels, Plane=xy_2)  # -> Geometry, Transform
crv_parcels = Curve(project.Geometry)
area_7 = Area(Geometry=crv_parcels)  # -> Area, Centroid
larger_3 = LargerThan(FirstNumber=area_7.Area, SecondNumber=0)  # -> LargerThan, OrEqualTo
dispatch_8 = Dispatch(List=crv_parcels, DispatchPattern=larger_3.OrEqualTo)  # -> ListA, ListB

# ---- group: Markethall network
crv_market = Curve(simplify(graft(pline)))  # disabled
offset_2 = OffsetCurve(Curve=crv_market, Distance=0.1, Plane=PlaneXY(0, 0, 0), Corners=1)  # disabled
curvepoint_2 = PointOnCurve(offset_2, parameter=0.549)  # disabled
incurve_4 = PointInCurve(Point=curvepoint_2, Curve=crv_market)  # -> Relationship, Point; disabled
dispatch_9 = Dispatch(List=crv_market, DispatchPattern=incurve_4.Relationship)  # -> ListA, ListB; disabled
flip_2 = FlipCurve(Curve=dispatch_9.ListB)  # -> Curve, Flag; disabled
merge_7 = Merge(Data1=dispatch_9.ListA, Data2=flip_2.Curve)  # disabled
offset_3 = OffsetCurve(Curve=merge_7, Distance=0.1, Plane=PlaneXY(0, 0, 0), Corners=1)  # disabled
geo_6 = Geometry(offset_3)  # disabled

# ----
explode_4 = Explode(Curve=dispatch_8.ListA, Recursive=True)  # -> flatten(Segments), Vertices; disabled
end_2 = EndPoints(Curve=explode_4.Segments)  # -> Start, End; disabled
geo_7 = Geometry([end_2.Start, end_2.End])  # disabled
cullpt_2 = CullDuplicates(Points=geo_7, Tolerance=0.1, CullMode=3)  # -> Points, Indices, Valence; disabled
geo_8 = Geometry(graft(cullpt_2.Points))  # disabled
incurves_2 = PointInCurves(Point=geo_8, Curves=flatten(geo_6))  # -> Relationship, Index, Point; disabled
dispatch_10 = Dispatch(List=geo_8, DispatchPattern=incurves_2.Relationship)  # -> ListA, ListB; disabled
crv_streets_6 = Curve(simplify(crv_streets_4))  # disabled
geo_9 = Geometry(dispatch_10.ListB)  # disabled
crv_cp_2 = CurveClosestPoint(Point=graft(geo_9), Curve=flatten(crv_streets_6))  # -> Point, Parameter, Distance; disabled
sort_3 = SortList(Keys=crv_cp_2.Distance, ValuesA=crv_cp_2.Point)  # -> Keys, ValuesA; disabled
item_7 = ListItem(List=sort_3.ValuesA, Index=0, Wrap=True)  # disabled

# ----
# PROCEDURAL MODELS
number_slider_18 = Slider(40, range=0..100)
Z_4 = UnitZ(Factor=number_slider_18)
move_5 = Move(Geometry=crv_markethall_2, Motion=Z_4)  # -> Geometry, Transform
extr = Extrude(Base=crv_markethall_2, Direction=Z_4)
cap = CapHoles(Brep=extr)
boundary_2 = BoundarySurfaces(Edges=move_5.Geometry)
edges_3 = BrepEdges(Brep=cap)  # -> Naked, Interior, NonManifold
geo_10 = Geometry(flatten([boundary_2, edges_3.Naked]))

geo_11 = Geometry(dispatch_8.ListA)
area_8 = Area(Geometry=simplify(geo_11))  # -> Area, Centroid
avr = Average(Input=flatten(area_8.Area))
panel_10 = Panel(avr)
division_9 = Division(A=panel_10, B=3)
smaller_2 = SmallerThan(FirstNumber=area_8.Area, SecondNumber=division_9)  # -> SmallerThan, OrEqualTo
dispatch_11 = Dispatch(List=geo_11, DispatchPattern=smaller_2.SmallerThan)  # -> ListA, ListB
podium_block = Geometry(dispatch_11.ListB)
public_open_space = Geometry(dispatch_11.ListA)

ln_5 = Line(StartPoint=geo_9, EndPoint=item_7)  # disabled

geo_12 = Geometry([ln_5, explode_4.Segments])  # disabled
boundary_3 = BoundarySurfaces(Edges=flatten(public_open_space))
public_open_space_2 = Geometry(boundary_3)
crv_markethall_3 = Geometry(crv_markethall_2)
crv_podium = Geometry(dispatch_7.ListB)
crv_podium_2 = Geometry(crv_podium)

num_podium_height = Number(podium_markethall_height)
Z_5 = UnitZ(Factor=num_podium_height)
move_6 = Move(Geometry=crv_podium_2, Motion=Z_5)  # -> Geometry, Transform
extr_2 = Extrude(Base=crv_podium_2, Direction=Z_5)
boundary_4 = BoundarySurfaces(Edges=move_6.Geometry)
cap_2 = CapHoles(Brep=extr_2)

# ---- group: Bridge
division_10 = Division(A=bridge_width, B=2)
area_9 = Area(Geometry=boundary_4)  # -> Area, Centroid
area_10 = Area(Geometry=boundary_4)  # -> Area, Centroid
ln_6 = Line(StartPoint=graft(area_9.Centroid), EndPoint=area_10.Centroid)
len_5 = Length(Curve=ln_6)
sort_4 = SortList(Keys=len_5, ValuesA=ln_6)  # -> Keys, ValuesA
item_8 = ListItem(List=sort_4.ValuesA, Index=1, Wrap=True)
item_9 = ListItem(List=sort_4.ValuesA, Index=2, Wrap=True)
geo_13 = Geometry([item_8, item_9])
neg_2 = Negative(Value=division_10)
offset_4 = OffsetCurve(Curve=geo_13, Distance=neg_2, Plane=PlaneXY(0, 0, 0), Corners=1)
offset_5 = OffsetCurve(Curve=geo_13, Distance=division_10, Plane=PlaneXY(0, 0, 0), Corners=1)
end_3 = EndPoints(Curve=offset_5)  # -> Start, End
end_4 = EndPoints(Curve=offset_4)  # -> Start, End
ln_7 = Line(StartPoint=end_3.Start, EndPoint=end_4.Start)
ln_8 = Line(StartPoint=end_3.End, EndPoint=end_4.End)
geo_14 = Geometry([offset_5, ln_7, ln_8, offset_4])
join_6 = JoinCurves(Curves=geo_14, Preserve=False)
boundary_5 = BoundarySurfaces(Edges=join_6)

# ----
int_offset_4 = Integer(int_offset)
crv_podium_3 = Curve(simplify(graft(move_6.Geometry)))
offset_6 = OffsetCurve(Curve=crv_podium_3, Distance=int_offset_4, Plane=PlaneXY(0, 0, 0), Corners=1)  # -> simplify(Curve)
curvepoint_3 = PointOnCurve(offset_6, parameter=0.543)
incurve_5 = PointInCurve(Point=curvepoint_3, Curve=crv_podium_3)  # -> Relationship, Point
dispatch_12 = Dispatch(List=crv_podium_3, DispatchPattern=incurve_5.Relationship)  # -> ListA, ListB
flip_3 = FlipCurve(Curve=dispatch_12.ListB)  # -> Curve, Flag
merge_8 = Merge(Data1=dispatch_12.ListA, Data2=flip_3.Curve)
int_offset_5 = Integer(int_offset_4)
offset_7 = OffsetCurve(Curve=merge_8, Distance=int_offset_5, Plane=PlaneXY(0, 0, 0), Corners=1)
geo_15 = Geometry(offset_7)

Z_6 = UnitZ(Factor=num_podium_height)
move_7 = Move(Geometry=crv_markethall_3, Motion=Z_6)  # -> Geometry, Transform
boundary_6 = BoundarySurfaces(Edges=move_7.Geometry)
int_podium_height = Integer(num_podium_height)
edges_4 = BrepEdges(Brep=boundary_6)  # -> Naked, Interior, NonManifold
addition = Addition(A=multiplication, B=int_podium_height)
multiplication_3 = Multiplication(A=addition, B=Slider(1.5, range=0..10))
extr_3 = Extrude(Base=geo_15, Direction=Z_3)
Z_7 = UnitZ(Factor=addition)
cap_3 = CapHoles(Brep=extr_3)
move_8 = Move(Geometry=move_4.Geometry, Motion=Z_7)  # -> Geometry, Transform
item_10 = ListItem(List=move_8.Geometry, Index=0, Wrap=True)
area_11 = Area(Geometry=item_10)  # -> Area, Centroid
vec2pt_2 = Vector2Pt(PointA=area_5.Centroid, PointB=area_11.Centroid, Unitize=False)  # -> Vector, Length
move_9 = Move(Geometry=crv_mega_block_3, Motion=vec2pt_2.Vector)  # -> Geometry, Transform
loft = Loft(
    Curves=[move_9.Geometry, geo],
    Options={Adjust=False, Closed=False, LoftEnds=0, LoftSimp=0, LoftType=0, Rebuild=10, Refit=0.01})
area_12 = Area(Geometry=move_8.Geometry)  # -> Area, Centroid
scale = Scale(Geometry=move_8.Geometry, Center=area_12.Centroid, Factor=Slider(8, range=0..10))  # -> simplify(graft(Geometry)), Transform
loft_2 = Loft(
    Curves=[geo_5, scale.Geometry],
    Options={Adjust=False, Closed=False, LoftEnds=0, LoftSimp=0, LoftType=0, Rebuild=10, Refit=0.01})
geo_16 = Geometry(cap_2)
cap_4 = CapHoles(Brep=loft_2)
sdiff = SolidDifference(BrepsA=flatten(cap_3), BrepsB=flatten(cap_4))
bbox = BoundingBox(Content=sdiff, Plane=PlaneXY(0, 0, 0))  # -> Box, Box_2
box = EvaluateBox(Box=bbox.Box, UParameter=number_slider_17, VParameter=number_slider_17, WParameter=Slider(0, range=0..100))  # -> Plane, Point, Include
pdecon_2 = Deconstruct(Point=box.Point)  # -> XComponent, YComponent, ZComponent
sort_5 = SortList(Keys=pdecon_2.ZComponent, ValuesA=pdecon_2.ZComponent)  # -> Keys, ValuesA
item_11 = ListItem(List=sort_5.Keys, Index=0, Wrap=True)
sdiff_2 = SolidDifference(BrepsA=flatten(geo_16), BrepsB=flatten(cap_4))
similar = Similarity(FirstNumber=pdecon_2.ZComponent, SecondNumber=item_11, Threshold=0.1)  # -> Similarity, AbsoluteDifference
geo_17 = Geometry(sdiff)
dispatch_13 = Dispatch(List=geo_17, DispatchPattern=similar.Similarity)  # -> ListA, ListB
dcon = DeleteConsecutive(Set=pdecon_2.ZComponent, Wrap=item_11)  # -> Set, Count
geo_18 = Geometry(dispatch_13.ListA)
volume = Volume(Geometry=geo_18)  # -> Volume, Centroid
number_slider_19 = Slider(0.5, range=0..1)
smaller_3 = SmallerThan(FirstNumber=volume.Volume, SecondNumber=Slider(30000, range=0..100000))  # -> SmallerThan, OrEqualTo
dispatch_14 = Dispatch(List=geo_18, DispatchPattern=smaller_3.SmallerThan)  # -> ListA, ListB
geo_19 = Geometry(dispatch_14.ListB)
bbox_2 = BoundingBox(Content=geo_19, Plane=PlaneXY(0, 0, 0))  # -> Box, Box_2
box_2 = EvaluateBox(Box=bbox_2.Box, UParameter=number_slider_19, VParameter=number_slider_19, WParameter=Slider(0, range=0..100))  # -> Plane, Point, Include
geo_20 = Geometry(geo_19)
contour = Contour(Shape=geo_19, Point=box_2.Point, Direction=Vector(0, 0, 1), Distance=floor_to_floor_height_5)
floor_to_floor_height_6 = Number(floor_to_floor_height_2)
Z_8 = UnitZ(Factor=floor_to_floor_height_6)
geo_21 = Geometry(contour)
geo_22 = Geometry([sdiff_2, geo_20])
extr_4 = Extrude(Base=contour, Direction=Z_8)
geo_23 = Geometry(flatten(contour))
cap_5 = CapHoles(Brep=extr_4)  # -> simplify(Brep)
pshift_2 = ShiftPaths(Data=cap_5, Offset=-1)
geo_24 = Geometry(sdiff_2)

number_slider_20 = Slider(0.5, range=0..1)
geo_25 = Geometry(sdiff_2)
bbox_3 = BoundingBox(Content=geo_25, Plane=PlaneXY(0, 0, 0))  # -> Box, Box_2
box_3 = EvaluateBox(Box=bbox_3.Box, UParameter=number_slider_20, VParameter=number_slider_20, WParameter=Slider(0, range=0..100))  # -> Plane, Point, Include
division_11 = Division(A=podium_markethall_height, B=3)
contour_2 = Contour(Shape=geo_25, Point=box_3.Point, Direction=Vector(0, 0, 1), Distance=division_11)

sunion = SolidUnion(Breps=pshift_2)
geo_26 = Geometry(flatten(contour_2))
Z_9 = UnitZ(Factor=1)
amp_2 = Amplitude(Vector=Z_9, Amplitude=division_11)
extr_5 = Extrude(Base=geo_26, Direction=amp_2)
num_podium_height_2 = Number(num_podium_height)
cap_6 = CapHoles(Brep=extr_5)
sunion_2 = SolidUnion(Breps=cap_6)
geo_27 = Geometry(flatten([sunion, sunion_2]))
geo_tower_podium = Geometry(flatten(geo_27))
brep_design = Brep(geo_tower_podium)
preview_3 = CustomPreview(Geometry=brep_design, Material=ColourSwatch(SwatchColor=RGBA(255, 255, 255, 15)))
sunion_3 = SolidUnion(Breps=brep_design)
brep_design_2 = Brep(sunion_3)
geo_28 = Geometry(sunion_3)
panel_11 = Panel(brep_design_2)
debrep = DeconstructBrep(Brep=geo_28)  # -> Faces, Edges, Vertices
area_13 = Area(Geometry=debrep.Faces)  # -> Area, Centroid
item_12 = ListItem(List=sunion_3, Index=0, Wrap=True)
pdecon_3 = Deconstruct(Point=area_13.Centroid)  # -> XComponent, YComponent, ZComponent
cull_i = CullIndex(List=brep_design_2, Indices=number_slider_12, Wrap=True)
item_13 = ListItem(List=brep_design_2, Index=number_slider_12, Wrap=True)
sort_6 = SortList(Keys=pdecon_3.ZComponent, ValuesA=debrep.Faces)  # -> Keys, ValuesA
brep_design_3 = Brep(brep_design_2)
item_14 = ListItem(List=sort_6.ValuesA, Index=0, Wrap=True)
preview_4 = CustomPreview(Geometry=item_12, Material=ColourSwatch(SwatchColor=RGBA(255, 255, 255, 15)))
sunion_4 = SolidUnion(Breps=brep_design_3)
merge_9 = Merge(Data1=brep_design, Data2=mesh_context)
geo_29 = Geometry(item_14)
cluster_7 = Cluster_7(
    brep_design=sunion_3,
    num_subdivision_resolution=subdivision_resolution,
    num_floor_to_floor_height=floor_to_floor_height_3)  # -> srf_analysis_panel_2, pt_analysis_points_2, vec_normal_vector_2
area_14 = Area(Geometry=geo_29)  # -> Area, Centroid
mesh_4 = Mesh(merge_9)
dist = Distance(PointA=area_3.Centroid, PointB=area_14.Centroid)
item_15 = ListItem(List=sunion_4, Index="0", Wrap=True)
item_16 = ListItem(List=sunion_4, Index="1", Wrap=True)
item_17 = ListItem(List=sunion_4, Index="2", Wrap=True)
item_18 = ListItem(List=sunion_4, Index="3", Wrap=True)
item_19 = ListItem(List=sunion_4, Index="4", Wrap=True)
item_20 = ListItem(List=sunion_4, Index="5", Wrap=True)
item_21 = ListItem(List=sunion_4, Index="6", Wrap=True)
item_22 = ListItem(List=sunion_4, Index="7", Wrap=True)
item_23 = ListItem(List=sunion_4, Index="8", Wrap=True)
mjoin = MeshJoin(Meshes=mesh_4)
sort_7 = SortList(Keys=dist, ValuesA=area_3.Centroid)  # -> Keys, ValuesA
item_24 = ListItem(List=sort_7.ValuesA, Index=0, Wrap=True)  # -> Item, Item1, Item2, Item3
brep_design_4 = Brep(item_18)
brep_design_5 = Brep(item_19)
brep_design_6 = Brep(item_20)
brep_design_7 = Brep(item_23)
brep_design_8 = Brep(item_15)
brep_design_9 = Brep(item_16)
brep_design_10 = Brep(item_17)
brep_design_11 = Brep(item_21)
brep_design_12 = Brep(item_22)
mesh_5 = Mesh(item_12)
geo_30 = Geometry(item_24.Item)
geo_31 = Geometry(item_24.Item1)
geo_32 = Geometry(item_24.Item3)
geo_33 = Geometry(item_24.Item2)
cluster_8 = Cluster_7(
    brep_design=item_12,
    num_subdivision_resolution=Slider(1000, range=0..20000),
    num_floor_to_floor_height=floor_to_floor_height_3)  # -> srf_analysis_panel_2, pt_analysis_points_2, vec_normal_vector_2
merge_10 = Merge(Data1=geo_30, Data2=geo_31, Data3=geo_33, Data4=geo_32)
mjoin_2 = MeshJoin(Meshes=mesh_5)
mesh_6 = Mesh(brep_design_9)
mesh_7 = Mesh(brep_design_10)
mesh_8 = Mesh(brep_design_8)
mesh_9 = Mesh(brep_design_4)
mesh_10 = Mesh(brep_design_5)
mesh_11 = Mesh(brep_design_6)
mesh_12 = Mesh(brep_design_11)
mesh_13 = Mesh(brep_design_12)
mesh_14 = Mesh(brep_design_7)
mshadow = MeshShadow(Mesh=mesh_8, Light=crv_sun_vector, Plane=PlaneXY(0, 0, 0))
mshadow_2 = MeshShadow(Mesh=mesh_6, Light=crv_sun_vector, Plane=PlaneXY(0, 0, 0))
mshadow_3 = MeshShadow(Mesh=mesh_7, Light=crv_sun_vector, Plane=PlaneXY(0, 0, 0))
mshadow_4 = MeshShadow(Mesh=mesh_9, Light=crv_sun_vector, Plane=PlaneXY(0, 0, 0))
mshadow_5 = MeshShadow(Mesh=mesh_10, Light=crv_sun_vector, Plane=PlaneXY(0, 0, 0))
mshadow_6 = MeshShadow(Mesh=mesh_11, Light=crv_sun_vector, Plane=PlaneXY(0, 0, 0))
mshadow_7 = MeshShadow(Mesh=mesh_12, Light=crv_sun_vector, Plane=PlaneXY(0, 0, 0))
mshadow_8 = MeshShadow(Mesh=mesh_13, Light=crv_sun_vector, Plane=PlaneXY(0, 0, 0))
mshadow_9 = MeshShadow(Mesh=mesh_14, Light=crv_sun_vector, Plane=PlaneXY(0, 0, 0))
mesh_obstruction = Geometry(mjoin_2)
pt_analysis_points_2 = Geometry(flatten(cluster_8.pt_analysis_points_2))
srf_analysis_panel_3 = Surface(flatten(cluster_7.srf_analysis_panel_2))
pt_analysis_points_3 = Point(flatten(cluster_7.pt_analysis_points_2))
mesh_obstructions = Mesh(mjoin)
mesh_obstructions_2 = Mesh(mjoin)
graft = GraftTree(Tree=pt_analysis_points_2, IncludeEmptyLists=True, IncludeNullItems=True)
occ = Occlusion(Samples=pt_analysis_points, Obstructions=mesh_obstructions_2, Rays=crv_sun_vectors_2)  # -> Hits, Occlusion
occ_2 = Occlusion(Samples=pt_analysis_points_3, Obstructions=mesh_obstructions, Rays=crv_sun_vectors_3)  # -> Hits, Occlusion
ln_9 = Line(StartPoint=graft, EndPoint=area_4.Centroid)
srf = Surface([mshadow, mshadow_2, mshadow_3, mshadow_4, mshadow_5, mshadow_6, mshadow_7, mshadow_8, mshadow_9])
subtraction_3 = Subtraction(A=lng, B=occ.Hits)
subtraction_4 = Subtraction(A=lng_2, B=occ_2.Hits)
area_15 = Area(Geometry=srf)  # -> Area, Centroid
meshray = MeshRay(Mesh=mesh_obstruction, Point=pt_analysis_points_2, Direction=ln_9)  # -> Point, Hit
previewlw = CustomPreviewLineweights(
    Geometry=ln_9,
    Shader=ColourSwatch(SwatchColor=RGBA(168, 168, 168, 5)),
    Thickness=Slider(0.0001, range=0..0.0001),
    Absolute=False)
ma_2 = MassAddition(Input=meshray.Hit)  # -> Result, PartialResults
panel_12 = Panel(ma_2.Result)
srf_analysis_panel_4 = Surface(flatten(srf_analysis_panel_3))
avr_2 = Average(Input=subtraction_3)
avr_3 = Average(Input=subtraction_4)
gradient_3 = Gradient(
    LowerLimit=Slider(1, range=0..1),
    UpperLimit=Slider(10, range=-1..15),
    Parameter=subtraction_3,
    stops=[0: RGB(0, 0, 0), 0.248: RGB(173, 203, 249), 0.5: RGB(254, 244, 84), 0.747: RGB(255, 165, 0), 1: RGB(255, 69, 0)])
gradient_4 = Gradient(
    LowerLimit=Slider(1, range=0..1),
    UpperLimit=Slider(10, range=-1..15),
    Parameter=subtraction_4,
    stops=[0: RGB(0, 0, 0), 0.248: RGB(173, 203, 249), 0.5: RGB(254, 244, 84), 0.747: RGB(255, 165, 0), 1: RGB(255, 69, 0)])
lng_10 = ListLength(List=flatten(ln_9))
srf_analysis_panels_2 = Geometry(flatten(cluster_8.srf_analysis_panel_2))
subtraction_5 = Subtraction(A=lng_10, B=ma_2.Result)  # -> flatten(Result)
panel_13 = Panel(subtraction_5)
bnd = Bounds(Numbers=panel_13)
mesh_15 = Mesh(srf_analysis_panel_4)
dedomain_2 = DeconstructDomain(Domain=bnd)  # -> Start, End
preview_5 = CustomPreview(Geometry=srf, Material=ColourSwatch(SwatchColor=RGBA(0, 0, 0, 100)))
gradient_5 = Gradient(
    LowerLimit=dedomain_2.Start,
    UpperLimit=dedomain_2.End,
    Parameter=subtraction_5,
    stops=[0: RGB(234, 38, 0), 0.376: RGB(254, 244, 84), 0.75: RGB(173, 203, 249), 1: RGB(75, 107, 169)])
num_score_per_panel = Number(panel_13)
panel_14 = Panel(num_score_per_panel)
previewlw_2 = CustomPreviewLineweights(Geometry=srf_analysis_panels_2, Shader=gradient_5, Absolute=False)
average_daylight_hours = Panel(avr_2)
average_daylight_hours_2 = Panel(avr_3)
preview_6 = CustomPreview(Geometry=mesh_15, Material=gradient_4)
preview_7 = CustomPreview(Geometry=mesh_3, Material=gradient_3)
geo_34 = Geometry(flatten([geo_24, sunion]))
market_public_open_space = Geometry(public_open_space_2)

number_slider_21 = Slider(30, range=0..100)  # disabled
toggle = BooleanToggle(True)  # disabled
xy_3 = XYPlane(Origin=item)  # disabled
panel_15 = Panel("0 to 100")  # disabled
panel_16 = Panel("100")  # disabled
panel_17 = Panel("60")  # disabled

crv_streets_7 = Curve(simplify(crv_streets_4))  # disabled

crv_market_2 = Curve(simplify(graft(podium_block)))
int_offset_6 = Integer(division_2)
int_offset_7 = Integer(int_offset_6)

offset_8 = OffsetCurve(Curve=crv_market_2, Distance=int_offset_6, Plane=PlaneXY(0, 0, 0), Corners=1)

curvepoint_4 = PointOnCurve(offset_8, parameter=0.549)
incurve_6 = PointInCurve(Point=curvepoint_4, Curve=crv_market_2)  # -> Relationship, Point
dispatch_15 = Dispatch(List=crv_market_2, DispatchPattern=incurve_6.Relationship)  # -> ListA, ListB
flip_4 = FlipCurve(Curve=dispatch_15.ListB)  # -> Curve, Flag
merge_11 = Merge(Data1=dispatch_15.ListA, Data2=flip_4.Curve)

offset_9 = OffsetCurve(Curve=merge_11, Distance=int_offset_6, Plane=PlaneXY(0, 0, 0), Corners=1)

geo_35 = Geometry(offset_9)

extr_6 = Extrude(Base=geo_35, Direction=Z_2)
cap_7 = CapHoles(Brep=extr_6)
market_hall = Geometry([boundary_6, cap_7])
market_hall_2 = Geometry(market_hall)

crv_public_space_2 = Curve(flatten([crv_public_space, node_6]))  # disabled
area_16 = Area(Geometry=crv_public_space_2)  # -> Area, Centroid; disabled
walking_speed_ft_min = Panel("84.65")  # disabled
pt_public_space = Point(area_16.Centroid)  # disabled
travel_time = Panel("2")  # disabled
multiplication_4 = Multiplication(A=travel_time, B=walking_speed_ft_min)  # disabled
num_max_travel_distance = Number(multiplication_4)  # disabled
panel_18 = Panel("10")  # disabled
num_max_travel_distance_2 = Number(num_max_travel_distance)  # disabled
the_number_of_public_space = Panel("3")  # disabled
panel_19 = Panel("6 to 1")  # disabled
panel_20 = Panel("10")  # disabled
panel_21 = Panel("0")  # disabled
panel_22 = Panel("6")  # disabled
panel_23 = Panel("1")  # disabled

panel_24 = Panel(".1")  # disabled

# ---- group: Podium block
int_podium_parcel_width = Integer(Slider(40, range=0..100))
crv_podium_4 = Geometry(crv_podium_2)
number_slider_22 = Slider(5000, range=0..10000)
Z_10 = UnitZ(Factor=num_podium_height_2)

# ---- group: Podium network
crv_podium_5 = Curve(simplify(graft(crv_podium_4)))  # disabled
offset_10 = OffsetCurve(Curve=crv_podium_5, Distance=0.1, Plane=PlaneXY(0, 0, 0), Corners=1)  # disabled
curvepoint_5 = PointOnCurve(offset_10, parameter=0.549)  # disabled
incurve_7 = PointInCurve(Point=curvepoint_5, Curve=crv_podium_5)  # -> Relationship, Point; disabled
dispatch_16 = Dispatch(List=crv_podium_5, DispatchPattern=incurve_7.Relationship)  # -> ListA, ListB; disabled
flip_5 = FlipCurve(Curve=dispatch_16.ListB)  # -> Curve, Flag; disabled
merge_12 = Merge(Data1=dispatch_16.ListA, Data2=flip_5.Curve)  # disabled
offset_11 = OffsetCurve(Curve=merge_12, Distance=0.1, Plane=PlaneXY(0, 0, 0), Corners=1)  # disabled
geo_36 = Geometry(offset_11)  # disabled

# ---- group: Podium block
disc_2 = Discontinuity(Curve=crv_podium_4, Level=1)  # -> Points, Parameters
int_parcel_width_2 = Integer(int_podium_parcel_width)
pline_2 = PolyLine(Vertices=disc_2.Points, Closed=True)
parcels_2 = Parcels(Polygons=pline_2, ConnectionDistance=1, StreetOffset=0, PlotWidthThreshold=int_parcel_width_2, Precision=100)
xy_4 = XYPlane(Origin=item)
project_2 = Project(Geometry=parcels_2, Plane=xy_4)  # -> Geometry, Transform

# ----
explode_5 = Explode(Curve=project_2.Geometry, Recursive=True)  # -> flatten(Segments), Vertices; disabled
end_5 = EndPoints(Curve=explode_5.Segments)  # -> Start, End; disabled
geo_37 = Geometry([end_5.Start, end_5.End])  # disabled
cullpt_3 = CullDuplicates(Points=geo_37, Tolerance=0.1, CullMode=3)  # -> Points, Indices, Valence; disabled
geo_38 = Geometry(graft(cullpt_3.Points))  # disabled
incurves_3 = PointInCurves(Point=geo_38, Curves=flatten(geo_36))  # -> Relationship, Index, Point; disabled
dispatch_17 = Dispatch(List=geo_38, DispatchPattern=incurves_3.Relationship)  # -> ListA, ListB; disabled
geo_39 = Geometry(dispatch_17.ListB)  # disabled
crv_cp_3 = CurveClosestPoint(Point=graft(geo_39), Curve=flatten(crv_streets_7))  # -> Point, Parameter, Distance; disabled
sort_8 = SortList(Keys=crv_cp_3.Distance, ValuesA=crv_cp_3.Point)  # -> Keys, ValuesA; disabled
item_25 = ListItem(List=sort_8.ValuesA, Index=0, Wrap=True)  # disabled

pt_corner_points = Geometry([geo_7, geo_37])  # disabled
pt_corner_points_2 = Geometry(pt_corner_points)  # disabled

ln_10 = Line(StartPoint=geo_39, EndPoint=item_25)  # disabled

geo_40 = Geometry([ln_10, explode_5.Segments])  # disabled
network = Geometry([geo_12, crv_streets_4, geo_40])  # disabled

geo_41 = Geometry(project_2.Geometry)
area_17 = Area(Geometry=simplify(geo_41))  # -> Area, Centroid
avr_4 = Average(Input=flatten(area_17.Area))
panel_25 = Panel(avr_4)
division_12 = Division(A=panel_25, B=3)
smaller_4 = SmallerThan(FirstNumber=area_17.Area, SecondNumber=division_12)  # -> SmallerThan, OrEqualTo
dispatch_18 = Dispatch(List=geo_41, DispatchPattern=smaller_4.SmallerThan)  # -> ListA, ListB
podium_block_2 = Geometry(dispatch_18.ListB)
public_open_space_3 = Geometry(dispatch_18.ListA)

# ---- group: Podium block
int_offset_8 = Integer(division_2)
crv_podium_6 = Curve(simplify(graft(podium_block_2)))
offset_12 = OffsetCurve(Curve=crv_podium_6, Distance=int_offset_8, Plane=PlaneXY(0, 0, 0), Corners=1)
curvepoint_6 = PointOnCurve(offset_12, parameter=0.549)
incurve_8 = PointInCurve(Point=curvepoint_6, Curve=crv_podium_6)  # -> Relationship, Point
dispatch_19 = Dispatch(List=crv_podium_6, DispatchPattern=incurve_8.Relationship)  # -> ListA, ListB
int_offset_9 = Integer(int_offset_8)
flip_6 = FlipCurve(Curve=dispatch_19.ListB)  # -> Curve, Flag
merge_13 = Merge(Data1=dispatch_19.ListA, Data2=flip_6.Curve)
offset_13 = OffsetCurve(Curve=merge_13, Distance=int_offset_8, Plane=PlaneXY(0, 0, 0), Corners=1)
geo_42 = Geometry(simplify(offset_13))

# ----
obstacles = Geometry([geo_42, geo_35])
obstacles_2 = Geometry(flatten(obstacles))  # disabled

explode_6 = Explode(Curve=obstacles_2, Recursive=True)  # -> flatten(Segments), Vertices; disabled
isovist = Isovist(
    VantagePointS=pt_corner_points_2,
    ObstacleLines=explode_6.Segments,
    ViewingDirection=Vector(989288.2615, 216460.5795, 58.83007825),
    ViewingRange=number_slider_21,
    ViewingAngle=360,
    Precision=360,
    ShowPolygon=True,
    ShowRadials=False,
    UseGPU=False)  # -> IsovistPolygon, Radials, ObstacleVisibility, IsovistProperties; disabled
project_3 = Project(Geometry=isovist.IsovistPolygon, Plane=xy_3)  # -> Geometry, Transform; disabled
circle = CircleCNR(Center=pt_corner_points_2, Normal=Vector(0, 0, 1), Radius=number_slider_21)  # disabled
geo_43 = Geometry(project_3.Geometry)  # disabled
area_18 = Area(Geometry=circle)  # -> Area, Centroid; disabled
area_19 = Area(Geometry=geo_43)  # -> Area, Centroid; disabled
bnd_2 = Bounds(Numbers=area_19.Area)  # disabled
remap = RemapNumbers(Value=area_19.Area, Source=bnd_2, Target=Domain(0, 1))  # -> Mapped, Clipped; disabled
division_13 = Division(A=area_19.Area, B=area_18.Area)  # disabled
neg_3 = Negative(Value=remap.Mapped)  # disabled
avr_5 = Average(Input=division_13)  # disabled
bnd_3 = Bounds(Numbers=division_13)  # disabled
Z_11 = UnitZ(Factor=neg_3)  # disabled
division_14 = Division(A=Z_11, B=1000)  # disabled
multiplication_5 = Multiplication(A=Z_11, B=5)  # disabled
remap_2 = RemapNumbers(Value=division_13, Source=bnd_3, Target=panel_15)  # -> Mapped, Clipped; disabled
gradient_6 = Gradient(
    LowerLimit=panel_17,
    UpperLimit=panel_16,
    Parameter=remap_2.Mapped,
    stops=[0: RGB(234, 38, 0), 0.25: RGB(234, 126, 0), 0.5: RGB(254, 244, 84), 0.75: RGB(173, 203, 249), 1: RGB(75, 107, 169)])  # disabled
move_10 = Move(Geometry=geo_43, Motion=multiplication_5)  # -> Geometry, Transform; disabled

previewlw_3 = CustomPreviewLineweights(Geometry=move_10.Geometry, Shader=gradient_6, Thickness=remap_2.Mapped, Absolute=False)  # disabled
average_vision_coverage = Panel(avr_5)  # disabled
boundary_7 = BoundarySurfaces(Edges=flatten(public_open_space_3))

pshift_3 = ShiftPaths(Data=geo_42, Offset=-1)
area_20 = Area(Geometry=pshift_3)  # -> Area, Centroid
sort_9 = SortList(Keys=area_20.Area, ValuesA=pshift_3)  # -> Keys, reverse(ValuesA)
lng_11 = ListLength(List=pshift_3)
division_15 = Division(A=lng_11, B=3)
round_2 = Round(Number=division_15)  # -> Nearest, Floor, Ceiling
split_2 = SplitList(List=simplify(sort_9.ValuesA), Index=round_2.Nearest)  # -> ListA, ListB
geo_44 = Geometry(split_2.ListA)

# ---- group: Podium block (continued)
extr_7 = Extrude(Base=geo_42, Direction=Z_10)
cap_8 = CapHoles(Brep=extr_7)

# ----
crv_core = Geometry(geo_44)
podium_public_open_space = Geometry(boundary_7)

edges_5 = BrepEdges(Brep=geo_22)  # -> Naked, Interior, NonManifold
area_21 = Area(Geometry=geo_21)  # -> Area, Centroid
podium = Geometry(sdiff_2)
pshift_4 = ShiftPaths(Data=area_21.Area, Offset=-1)
srf_2 = Surface(node_2)
ma_3 = MassAddition(Input=pshift_4)  # -> Result, PartialResults
preview_8 = CustomPreview(
    Geometry=flatten([market_public_open_space, podium_public_open_space]),
    Material=ColourSwatch(SwatchColor=RGB(162, 0, 255)))
preview_9 = CustomPreview(Geometry=srf_2, Shader=ColourSwatch(SwatchColor=RGB(184, 94, 94)))
preview_10 = CustomPreview(Geometry=edges_5.Naked, Material=ColourSwatch(SwatchColor=RGBA(0, 0, 0, 221)))
gfa = Panel(ma_3.Result)
the_number_of_nodes = Panel(lng_9)
preview_11 = CustomPreview(Geometry=cap_8, Material=ColourSwatch(SwatchColor=RGB(0, 0, 0)))
preview_12 = CustomPreview(Geometry=geo_20, Material=ColourSwatch(SwatchColor=RGBA(255, 255, 255, 195)))
preview_13 = CustomPreview(Geometry=geo_21, Material=ColourSwatch(SwatchColor=RGBA(0, 0, 0, 0)))
preview_14 = CustomPreview(Geometry=boundary_6, Material=ColourSwatch(SwatchColor=RGBA(0, 0, 0, 68)))
preview_15 = CustomPreview(Geometry=boundary_5, Material=ColourSwatch(SwatchColor=RGB(0, 0, 0)))
preview_16 = CustomPreview(Geometry=market_hall_2, Material=ColourSwatch(SwatchColor=RGBA(0, 0, 0, 116)))
preview_17 = CustomPreview(Geometry=podium, Material=ColourSwatch(SwatchColor=RGBA(133, 133, 133, 171)))

crv_core_2 = Geometry(crv_core)  # disabled
network_2 = Geometry(flatten(network))  # disabled
crv_buildings = Curve(flatten(crv_core_2))  # disabled
area_22 = Area(Geometry=crv_buildings)  # -> Area, Centroid; disabled
pt_2 = Point(area_22.Centroid)  # disabled
cir = Circle(Plane=pt_2, Radius=expr("X*1.1", num_max_travel_distance))  # disabled
crv_buildings_2 = Curve(crv_buildings)  # disabled
runion_2 = RegionUnion(Curves=cir)  # disabled
incurve_9 = PointInCurve(Point=pt_public_space, Curve=runion_2)  # -> Relationship, Point; disabled
cull = CullPattern(List=pt_public_space, CullPattern=incurve_9.Relationship)  # disabled
pt_3 = Point(graft(pt_2))  # disabled
ln_11 = Line(StartPoint=pt_3, EndPoint=cull)  # disabled
crv_buildings_3 = Curve(crv_buildings_2)  # disabled
srf_3 = Surface(graft(crv_buildings_3))  # disabled

vb = VBScript(C=network_2)  # -> out, pts; inputs C: list of Curve; disabled
# ---------- vb: VB ----------
    Dim points As New List(Of Point3d)
    If (C Is Nothing) Then Return
    If (C.Count < 2) Then Return
    
    For i As Int32 = 0 To C.Count - 2
      For j As Int32 = i + 1 To C.Count - 1
        Dim x As Intersect.CurveIntersections = Intersect.Intersection.CurveCurve(C(i), C(j), 0.01, 0.05)
        If (x.Count = 0) Then Continue For
        
        For k As Int32 = 0 To x.Count - 1
          Dim xEvent As Intersect.IntersectionEvent = x(k)
          points.Add(0.5 * (xEvent.PointA + xEvent.PointB))
        Next
      Next
    Next
    
    pts = points
# ---------- end vb ----------
geo_45 = Geometry(graft(network_2))  # disabled
crv_cp_4 = CurveClosestPoint(Point=vb.pts, Curve=geo_45)  # -> Point, Parameter, Distance; disabled
smaller_5 = SmallerThan(FirstNumber=crv_cp_4.Distance, SecondNumber=panel_24)  # -> SmallerThan, OrEqualTo; disabled
cull_2 = CullPattern(List=crv_cp_4.Parameter, CullPattern=smaller_5.SmallerThan)  # disabled
shatter = Shatter(Curve=geo_45, Parameters=cull_2)  # disabled
cullduplines_2 = RemoveDuplicateLines(InputLines=flatten(shatter), Tolerance=0.001)  # -> OutputLines, FirstLineIndexes; disabled

network_3 = Geometry(cullduplines_2.OutputLines)  # disabled
crv_network = Curve(network_3)  # disabled
crv_network_2 = Curve(crv_network)  # disabled
scx = SurfaceCurve(Surface=runion_2, Curve=crv_network_2)  # -> flatten(Curves), Points, UVPoints, Normals, Parameters, Tangents; disabled
geo_46 = Geometry(scx.Curves)  # disabled
panel_26 = Panel(scx.Curves)  # disabled
_1_process_geometry = _1ProcessGeometry(Path=scx.Curves, SegmentLength=panel_18)  # -> Object, flatten(Segments), Vectors, Ids; disabled
end_6 = EndPoints(Curve=_1_process_geometry.Segments)  # -> Start, End; disabled
geo_47 = Geometry(_1_process_geometry.Segments)  # disabled
shortwalk = ShortestWalk(Curves=_1_process_geometry.Segments, WantedPath=ln_11)  # -> ShortestWalk, Succession, Direction, Length; disabled
clean = CleanTree(RemoveNulls=True, RemoveInvalid=True, RemoveEmpty=False, Tree=shortwalk.ShortestWalk)  # disabled
smaller_6 = SmallerThan(FirstNumber=shortwalk.Length, SecondNumber=num_max_travel_distance_2)  # -> SmallerThan, OrEqualTo; disabled
cull_3 = CullPattern(List=clean, CullPattern=smaller_6.SmallerThan)  # disabled
cull_4 = CullPattern(List=shortwalk.Length, CullPattern=smaller_6.SmallerThan)  # disabled
bnd_4 = Bounds(Numbers=cull_4)  # disabled
neg_4 = Negative(Value=cull_4)  # disabled
lng_12 = ListLength(List=cull_4)  # disabled
Z_12 = UnitZ(Factor=neg_4)  # disabled
remap_3 = RemapNumbers(Value=cull_4, Source=bnd_4, Target=panel_19)  # -> Mapped, Clipped; disabled
larger_4 = LargerThan(FirstNumber=flatten(lng_12), SecondNumber=the_number_of_public_space)  # -> LargerThan, OrEqualTo; disabled
lng_13 = ListLength(List=flatten(lng_12))  # disabled
avr_6 = Average(Input=flatten(lng_12))  # disabled
gradient_7 = Gradient(
    LowerLimit=panel_21,
    UpperLimit=panel_20,
    Parameter=lng_12,
    stops=[0: RGB(234, 38, 0), 0.25: RGB(234, 126, 0), 0.5: RGB(254, 244, 84), 0.75: RGB(173, 203, 249), 1: RGB(75, 107, 169)])  # disabled
gradient_8 = Gradient(
    LowerLimit=panel_23,
    UpperLimit=panel_22,
    Parameter=remap_3.Mapped,
    stops=[0: RGB(234, 38, 0), 0.25: RGB(234, 126, 0), 0.5: RGB(254, 244, 84), 0.75: RGB(173, 203, 249), 1: RGB(75, 107, 169)])  # disabled
ma_4 = MassAddition(Input=larger_4.LargerThan)  # -> Result, PartialResults; disabled
division_16 = Division(A=ma_4.Result, B=lng_13)  # disabled
panel_27 = Panel(ma_4.Result)  # disabled

division_17 = Division(A=Z_12, B=1000)  # disabled

move_11 = Move(Geometry=cull_3, Motion=division_17)  # -> Geometry, Transform; disabled

# ---- group: Buildings
mcol_3 = MeshColours(Mesh=srf_3, Colours=gradient_7)  # disabled

# ---- group: Route to public area: X minutes distance
previewlw_4 = CustomPreviewLineweights(Geometry=move_11.Geometry, Shader=gradient_8, Thickness=remap_3.Mapped, Absolute=False)  # disabled

# ----
average_the_number_of_public_spaces = Panel(avr_6)  # disabled
of_buildings = Panel(division_16)  # disabled

# ==== cluster Cluster
crv_sunpath = ClusterInput()
domain_sunrise_sunset = ClusterInput()
domain_sunrise_sunset_2 = ClusterInput()
crv_sunpath_2 = ClusterInput()
crv_sunpath_3 = ClusterInput()
domain_sunrise_sunset_3 = ClusterInput()
crv_sunpath_4 = ClusterInput()
domain_sunrise_sunset_4 = ClusterInput()
domain_sunrise_sunset_5 = ClusterInput()
crv_sunpath_5 = ClusterInput()
crv_sunpath_6 = ClusterInput()
domain_sunrise_sunset_6 = ClusterInput()
crv_sunpath_7 = ClusterInput()
domain_sunrise_sunset_7 = ClusterInput()
domain_sunrise_sunset_8 = ClusterInput()
crv_sunpath_8 = ClusterInput()
crv_sunpath_9 = Curve(crv_sunpath)
domain_sunrise_sunset_9 = Domain(domain_sunrise_sunset)
domain_sunrise_sunset_10 = Domain(domain_sunrise_sunset_2)
crv_sunpath_10 = Curve(crv_sunpath_2)
crv_sunpath_11 = Curve(crv_sunpath_3)
domain_sunrise_sunset_11 = Domain(domain_sunrise_sunset_3)
crv_sunpath_12 = Curve(crv_sunpath_4)
domain_sunrise_sunset_12 = Domain(domain_sunrise_sunset_4)
domain_sunrise_sunset_13 = Domain(domain_sunrise_sunset_5)
crv_sunpath_13 = Curve(crv_sunpath_5)
crv_sunpath_14 = Curve(crv_sunpath_6)
domain_sunrise_sunset_14 = Domain(domain_sunrise_sunset_6)
crv_sunpath_15 = Curve(crv_sunpath_7)
domain_sunrise_sunset_15 = Domain(domain_sunrise_sunset_7)
domain_sunrise_sunset_16 = Domain(domain_sunrise_sunset_8)
crv_sunpath_16 = Curve(crv_sunpath_8)
dedomain = DeconstructDomain(Domain=domain_sunrise_sunset_9)  # -> Start, End
dedomain_2 = DeconstructDomain(Domain=domain_sunrise_sunset_10)  # -> Start, End
dedomain_3 = DeconstructDomain(Domain=domain_sunrise_sunset_11)  # -> Start, End
dedomain_4 = DeconstructDomain(Domain=domain_sunrise_sunset_13)  # -> Start, End
dedomain_5 = DeconstructDomain(Domain=domain_sunrise_sunset_12)  # -> Start, End
dedomain_6 = DeconstructDomain(Domain=domain_sunrise_sunset_14)  # -> Start, End
dedomain_7 = DeconstructDomain(Domain=domain_sunrise_sunset_15)  # -> Start, End
dedomain_8 = DeconstructDomain(Domain=domain_sunrise_sunset_16)  # -> Start, End
subtraction = Subtraction(A=dedomain.End, B=dedomain.Start)
subtraction_2 = Subtraction(A=dedomain_2.End, B=dedomain_2.Start)
subtraction_3 = Subtraction(A=dedomain_3.End, B=dedomain_3.Start)
subtraction_4 = Subtraction(A=dedomain_4.End, B=dedomain_4.Start)
subtraction_5 = Subtraction(A=dedomain_5.End, B=dedomain_5.Start)
subtraction_6 = Subtraction(A=dedomain_6.End, B=dedomain_6.Start)
subtraction_7 = Subtraction(A=dedomain_7.End, B=dedomain_7.Start)
subtraction_8 = Subtraction(A=dedomain_8.End, B=dedomain_8.Start)
divide = DivideCurve(Curve=crv_sunpath_9, Count=subtraction, Kinks=False)  # -> Points, Tangents, Parameters
divide_2 = DivideCurve(Curve=crv_sunpath_10, Count=subtraction_2, Kinks=False)  # -> Points, Tangents, Parameters
xy = XYPlane(Origin=Point(0, 0, 0))
xy_2 = XYPlane(Origin=Point(0, 0, 0))
divide_3 = DivideCurve(Curve=crv_sunpath_11, Count=subtraction_3, Kinks=False)  # -> Points, Tangents, Parameters
xy_3 = XYPlane(Origin=Point(0, 0, 0))
divide_4 = DivideCurve(Curve=crv_sunpath_13, Count=subtraction_4, Kinks=False)  # -> Points, Tangents, Parameters
divide_5 = DivideCurve(Curve=crv_sunpath_12, Count=subtraction_5, Kinks=False)  # -> Points, Tangents, Parameters
divide_6 = DivideCurve(Curve=crv_sunpath_14, Count=subtraction_6, Kinks=False)  # -> Points, Tangents, Parameters
xy_4 = XYPlane(Origin=Point(0, 0, 0))
xy_5 = XYPlane(Origin=Point(0, 0, 0))
divide_7 = DivideCurve(Curve=crv_sunpath_15, Count=subtraction_7, Kinks=False)  # -> Points, Tangents, Parameters
xy_6 = XYPlane(Origin=Point(0, 0, 0))
xy_7 = XYPlane(Origin=Point(0, 0, 0))
divide_8 = DivideCurve(Curve=crv_sunpath_16, Count=subtraction_8, Kinks=False)  # -> Points, Tangents, Parameters
xy_8 = XYPlane(Origin=Point(0, 0, 0))
ln = Line(StartPoint=divide.Points, EndPoint=xy)
ln_2 = Line(StartPoint=divide_3.Points, EndPoint=xy_3)
ln_3 = Line(StartPoint=divide_4.Points, EndPoint=xy_4)
ln_4 = Line(StartPoint=divide_5.Points, EndPoint=xy_5)
ln_5 = Line(StartPoint=divide_6.Points, EndPoint=xy_6)
ln_6 = Line(StartPoint=divide_7.Points, EndPoint=xy_7)
ln_7 = Line(StartPoint=divide_8.Points, EndPoint=xy_8)
crv_sun_vectors = Curve(ln_4)
crv_sun_vectors_2 = Curve(ln_5)
crv_sun_vectors_3 = Curve(ln)
crv_sun_vectors_4 = Curve(ln_2)
crv_sun_vectors_5 = Curve(ln_3)
crv_sun_vectors_6 = Curve(ln_6)
crv_sun_vectors_7 = Curve(ln_7)
lng = ListLength(List=[crv_sun_vectors_3, crv_sun_vectors_6, crv_sun_vectors_4, crv_sun_vectors_5, crv_sun_vectors, crv_sun_vectors_2, crv_sun_vectors_7])
devec = DeconstructVector(Vector=crv_sun_vectors_4)  # -> XComponent, YComponent, ZComponent
devec_2 = DeconstructVector(Vector=crv_sun_vectors_3)  # -> XComponent, YComponent, ZComponent
devec_3 = DeconstructVector(Vector=crv_sun_vectors_6)  # -> XComponent, YComponent, ZComponent
devec_4 = DeconstructVector(Vector=crv_sun_vectors_5)  # -> XComponent, YComponent, ZComponent
devec_5 = DeconstructVector(Vector=crv_sun_vectors)  # -> XComponent, YComponent, ZComponent
devec_6 = DeconstructVector(Vector=crv_sun_vectors_2)  # -> XComponent, YComponent, ZComponent
devec_7 = DeconstructVector(Vector=crv_sun_vectors_7)  # -> XComponent, YComponent, ZComponent
ma = MassAddition(Input=[devec_2.YComponent, devec_3.YComponent, devec.YComponent, devec_4.YComponent, devec_5.YComponent, devec_6.YComponent, devec_7.YComponent])  # -> Result, PartialResults
ma_2 = MassAddition(Input=[devec_7.ZComponent, devec_6.ZComponent, devec_5.ZComponent, devec_4.ZComponent, devec.ZComponent, devec_3.ZComponent, devec_2.ZComponent])  # -> Result, PartialResults
ma_3 = MassAddition(Input=[devec_2.XComponent, devec_3.XComponent, devec.XComponent, devec_4.XComponent, devec_5.XComponent, devec_6.XComponent, devec_7.XComponent])  # -> Result, PartialResults
division = Division(A=ma_2.Result, B=lng)
division_2 = Division(A=ma_3.Result, B=lng)
division_3 = Division(A=ma.Result, B=lng)
vec = VectorXYZ(XComponent=division_2, YComponent=division_3, ZComponent=division)  # -> Vector, Length
amp = Amplitude(Vector=vec.Vector, Amplitude=Slider(10000, range=0..10000))
V = ClusterOutput(vec.Vector)
vdis = VectorDisplay(Vector=amp)
move = Move(Geometry="0, 0, 0", Motion=amp)  # -> Geometry, Transform
ln_8 = Line(StartPoint="0, 0, 0", EndPoint=move.Geometry)

# ==== cluster Cluster_2
brep_design = ClusterInput()
num_subdivision_resolution = ClusterInput()
brep_design_2 = Brep(brep_design)
num_subdivision_resolution_2 = Number(num_subdivision_resolution)

# ---- group: Subdivides Surfaces
dim = Dimensions(Surface=brep_design_2)  # -> UDimension, VDimension
division = Division(A=dim.UDimension, B=num_subdivision_resolution_2)
division_2 = Division(A=dim.VDimension, B=num_subdivision_resolution_2)

# ----
panel = Panel(division)
smaller = SmallerThan(FirstNumber=division, SecondNumber=0)  # -> SmallerThan, OrEqualTo
round = Round(Number=panel)  # -> Nearest, Floor, Ceiling
round_2 = Round(Number=division_2)  # -> Nearest, Floor, Ceiling

# ---- group: Subdivides Surfaces (continued)
divide = DivideDomain²(Domain=brep_design_2, UCount=round.Ceiling, VCount=round_2.Ceiling)
subsrf = Isotrim(Surface=brep_design_2, Domain=divide)  # -> simplify(Surface)
evalsrf = EvaluateSurface(Surface=reparameterize(subsrf), Point="{0.5,0.5,0}")  # -> simplify(Point), Normal, UDirection, VDirection, Frame

# ----
panel_2 = Panel(round.Ceiling)
amp = Amplitude(Vector=evalsrf.Normal, Amplitude=1)
area = Area(Geometry=subsrf)  # -> Area, Centroid
vec_normal_vector = Vector(evalsrf.Normal)
srf_analysis_panel = Surface(subsrf)
pt_analysis_points = Point(area.Centroid)
srf_analysis_panel_2 = ClusterOutput(srf_analysis_panel)
vec_normal_vector_2 = ClusterOutput(vec_normal_vector)
pt_analysis_points_2 = ClusterOutput(pt_analysis_points)

# ==== cluster Cluster_3
geo_context_obstructions = ClusterInput()
geo_context_obstructions_2 = Geometry(geo_context_obstructions)
mesh = Mesh(geo_context_obstructions_2)
mjoin = MeshJoin(Meshes=mesh)
mesh_obstructions = Mesh(mjoin)
mesh_obstructions_2 = ClusterOutput(mesh_obstructions)

# ==== cluster Cluster_4
num_analysis_resolution = ClusterInput()
crv_analysis_area = ClusterInput()
num_analysis_resolution_2 = Number(num_analysis_resolution)
crv_analysis_area_2 = Curve(crv_analysis_area)

# ---- group: Surfaces to analyze
srf = Surface(graft(crv_analysis_area_2))

# ----
dim = Dimensions(Surface=srf)  # -> UDimension, VDimension
division = Division(A=dim.UDimension, B=num_analysis_resolution_2)
division_2 = Division(A=dim.VDimension, B=num_analysis_resolution_2)
divide = DivideDomain²(Domain=srf, UCount=division, VCount=division_2)
subsrf = Isotrim(Surface=srf, Domain=divide)  # -> flatten(Surface)
srf_analysis_surfaces = Surface(subsrf)
srf_analysis_surfaces_2 = ClusterOutput(srf_analysis_surfaces)

# ==== cluster Cluster_5
num_start_time = ClusterInput()
num_end_time = ClusterInput()
int_months = ClusterInput()
int_days = ClusterInput()
num_start_time_2 = Number(num_start_time)
num_end_time_2 = Number(num_end_time)
int_months_2 = Integer(graft(int_months))
int_days_2 = Integer(int_days)
path_epw_file_location = ClusterInput()
srf_analysis_surfaces = ClusterInput()
path_epw_file_location_2 = FilePath(path_epw_file_location)
num_distance_off_of_ground = ClusterInput()
mesh_obstructions = ClusterInput()
num_end_time_3 = Number(num_end_time_2)
int_days_3 = Integer(int_days_2)
int_months_3 = Integer(int_months_2)
srf_analysis_surfaces_2 = Surface(srf_analysis_surfaces)
num_distance_off_of_ground_2 = Number(num_distance_off_of_ground)
mesh_obstructions_2 = Mesh(mesh_obstructions)
evalsrf = EvaluateSurface(Surface=reparameterize(srf_analysis_surfaces_2), Point="{0.5,0.5,0}")  # -> Point, Normal, UDirection, VDirection, Frame
lng = ListLength(List=int_months_3)
lng_2 = ListLength(List=int_days_3)

# ---- group: Weather File
importlocation = Ladybug_ImportLocation(epwFile=path_epw_file_location_2)  # -> location; plug-in component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

# ----
ladybug = Ladybug_Ladybug()  # -> out; plug-in component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
pt = Point(evalsrf.Point)
Z = UnitZ(Factor=num_distance_off_of_ground_2)
move = Move(Geometry=pt, Motion=Z)  # -> Geometry, Transform

# ---- group: Hours
num_start_time_3 = Number(num_start_time_2)

# ----
subtraction = Subtraction(A=num_end_time_3, B=num_start_time_3)

# ---- group: Hours (continued)
series = Series(Start=num_start_time_3, Step=1, Count=expr("X+1", subtraction))

# ----
int = Integer(series)
sunpath = Ladybug_SunPath(location=importlocation, hour=int, day=int_days_3, month=int_months_3, timeStep=1, dailyOrAnnualSunPath=True)  # -> out, sunVectors, sunAltitudes, sunAzimuths, port, sunSpheresMesh, sunPathCrvs, compassCrvs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; plug-in component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
lng_3 = ListLength(List=sunpath.sunVectors)
panel = Panel(sunpath.sunPositionsInfo)
occ = Occlusion(Samples=graft(move.Geometry), Obstructions=mesh_obstructions_2, Rays=flatten(sunpath.sunVectors))  # -> Hits, Occlusion
not = GateNot(A=occ.Occlusion)
num_is_sun_visible = Number(not)
num_number_of_hours_per_day = Number(flatten(lng_3))
num_is_sun_visible_2 = Number(simplify(num_is_sun_visible))
num_is_sun_visible_3 = ClusterOutput(num_is_sun_visible_2)
num_number_of_hours_per_day_2 = ClusterOutput(num_number_of_hours_per_day)

# ==== cluster Cluster_6
num_number_of_hours_per_day = ClusterInput()
num_hour_threshold = ClusterInput()
num_is_sun_visible = ClusterInput()
num_number_of_hours_per_day_2 = Number(num_number_of_hours_per_day)
num_hour_threshold_2 = Number(num_hour_threshold)
num_is_sun_visible_2 = Number(num_is_sun_visible)
ma = MassAddition(Input=num_number_of_hours_per_day_2)  # -> Result, PartialResults
shift = ShiftList(List=ma.PartialResults, Shift="-1", Wrap=False)
addition = Addition(A=shift, B="1")
merge = Merge(Data1="0", Data2=flatten(addition))
dom = ConstructDomain(DomainStart=merge, DomainEnd=ma.PartialResults)
subset = SubList(List=num_is_sun_visible_2, Domain=dom, Wrap=True)  # -> List, Index
ma_2 = MassAddition(Input=num_is_sun_visible_2)  # -> Result, PartialResults
lng = ListLength(List=num_is_sun_visible_2)
ma_3 = MassAddition(Input=subset.List)  # -> Result, PartialResults
path_mapper = PathMapper(ma_3.Result, source="{A;B}", target="{A}")
division = Division(A=ma_2.Result, B=lng)
avr = Average(Input=flatten(division))
avr_2 = Average(Input=path_mapper)
avr_3 = Average(Input=flatten(avr_2))
larger = LargerThan(FirstNumber=avr_2, SecondNumber=num_hour_threshold_2)  # -> LargerThan, OrEqualTo
avr_4 = Average(Input=flatten(larger.LargerThan))
num_average_hours_per_analysis_point = Number(avr_2)
num_in_sun_avg = Number(avr)
num_average_hours = Number(avr_3)
num_passing_threshold = Number(larger.LargerThan)
num_passing_threshold_2 = Number(avr_4)
num_in_sun_avg_2 = ClusterOutput(num_in_sun_avg)
num_average_hours_2 = ClusterOutput(num_average_hours)
num_average_hours_per_analysis_point_2 = ClusterOutput(num_average_hours_per_analysis_point)
num_passing_threshold_3 = ClusterOutput(num_passing_threshold_2)
num_passing_threshold_4 = ClusterOutput(num_passing_threshold)

# ==== cluster Cluster_7
brep_design = ClusterInput()
num_subdivision_resolution = ClusterInput()
num_floor_to_floor_height = ClusterInput()
brep_design_2 = Brep(brep_design)

# ---- group: Removes tops and bottoms
sunion = SolidUnion(Breps=brep_design_2)
debrep = DeconstructBrep(Brep=sunion)  # -> Faces, Edges, Vertices
evalsrf = EvaluateSurface(Surface=reparameterize(debrep.Faces), Point="{0.5,0.5,0}")  # -> Point, Normal, UDirection, VDirection, Frame
devec = DeconstructVector(Vector=evalsrf.Normal)  # -> XComponent, YComponent, ZComponent
abs = Absolute(Value=devec.ZComponent)
smaller = SmallerThan(FirstNumber=abs, SecondNumber=Slider(0.95, range=0..1))  # -> SmallerThan, OrEqualTo
cull = CullPattern(List=debrep.Faces, CullPattern=smaller.SmallerThan)

# ----
num_floor_to_floor_height_2 = Number(num_floor_to_floor_height)
num_subdivision_resolution_2 = Number(num_subdivision_resolution)
srf_surfaces_to_subdivide = Surface(graft(cull))
replace = ReplaceItems(Wrap=False)
number_slider = Slider(1, range=0..1)
amp = Amplitude(Amplitude=1)

# ---- group: Subdivides Surfaces
dim = Dimensions(Surface=srf_surfaces_to_subdivide)  # -> UDimension, VDimension
division = Division(A=dim.UDimension, B=num_subdivision_resolution_2)
division_2 = Division(A=dim.VDimension, B=num_subdivision_resolution_2)
panel = Panel("{0.5,0.5,0}")

# ----
panel_2 = Panel(division)
smaller_2 = SmallerThan(FirstNumber=division, SecondNumber=0)  # -> SmallerThan, OrEqualTo
round = Round(Number=panel_2)  # -> Nearest, Floor, Ceiling
round_2 = Round(Number=division_2)  # -> Nearest, Floor, Ceiling

# ---- group: Subdivides Surfaces (continued)
divide = DivideDomain²(Domain=srf_surfaces_to_subdivide, UCount=round.Ceiling, VCount=round_2.Ceiling)
subsrf = Isotrim(Surface=srf_surfaces_to_subdivide, Domain=divide)  # -> simplify(Surface)
evalsrf_2 = EvaluateSurface(Surface=reparameterize(subsrf), Point=panel)  # -> simplify(Point), Normal, UDirection, VDirection, Frame

# ----
panel_3 = Panel(round.Ceiling)
amp_2 = Amplitude(Vector=evalsrf_2.Normal, Amplitude=number_slider)
move = Move(Geometry=evalsrf_2.Point, Motion=amp_2)  # -> simplify(Geometry), Transform
brepinc = PointInBrep(Brep=brep_design_2, Point=graft(move.Geometry), Strict=False)
ma = MassAddition(Input=brepinc)  # -> Result, PartialResults
amp_3 = Amplitude(Vector=evalsrf_2.Normal, Amplitude=Slider(30, range=0..100))
dispatch = Dispatch(List=graft(subsrf), DispatchPattern=ma.Result)  # -> ListA, ListB
move_2 = Move(Geometry=evalsrf_2.Point, Motion=amp_3)  # -> Geometry, Transform
item = ListItem(List=flatten(dispatch.ListB), Index=0, Wrap=True)
geo = Geometry(dispatch.ListB)
ln = Line(StartPoint=evalsrf_2.Point, EndPoint=move_2.Geometry)
flip = Flip(Surface=dispatch.ListA)  # -> Surface, Result
geo_2 = Geometry([flip.Surface, geo])
evalsrf_3 = EvaluateSurface(Surface=reparameterize(geo_2), Point=panel)  # -> Point, Normal, UDirection, VDirection, Frame
amp_4 = Amplitude(Vector=evalsrf_3.Normal, Amplitude=number_slider)
amp_5 = Amplitude(Vector=evalsrf_3.Normal, Amplitude=number_slider)
panel_4 = Panel(flip.Surface)
move_3 = Move(Geometry=evalsrf_3.Point, Motion=amp_5)  # -> Geometry, Transform
move_4 = Move(Geometry=geo_2, Motion=amp_5)  # -> Geometry, Transform
vec_normal_vector = Vector(amp_4)
srf_analysis_panel = Surface(move_4.Geometry)
pt_analysis_points = Point(move_3.Geometry)
srf_analysis_panel_2 = ClusterOutput(srf_analysis_panel)
vec_normal_vector_2 = ClusterOutput(vec_normal_vector)
pt_analysis_points_2 = ClusterOutput(pt_analysis_points)
