# Grasshopper definition Analysis Tool Example.gh (Grasshopper 1.0.7)

# ----
# Inputs
inputs_panel = Panel("")
# XIM Standards
data = Data(True)

view_analysis_distance = Panel("1200")
good_view_threshold = Panel("300")
analysis_resolution = Panel("24")
brep_for_analysis = Brep([<brep referenced from the Rhino model> x12])

# ---- group: Context
geo_context = Geometry([<brep referenced from the Rhino model> x7])

# ----
# Ouputs
data_2 = Data(True)

merge = Merge(Data1=flatten(geo_context), Data2=flatten(brep_for_analysis))

# ----
# Note
# Previews
note_panel = Panel("")

int_view_analysis_distance = Integer(view_analysis_distance)
subdivision = Subdivision(brep_for_analysis=brep_for_analysis, num_analysis_resolution=analysis_resolution)  # -> srf_analysis_surfaces_2, srf_horizontal_surfaces_3
int_good_view_threshold = Integer(good_view_threshold)
mesh = Mesh(merge)
# Actions
# DO NOT CHANGE
mjoin = MeshJoin(Meshes=mesh)
mesh_obstructions = Mesh(mjoin)
cluster = Cluster(
    mesh_obstructions=mesh_obstructions,
    srf_analysis_surfaces=subdivision.srf_analysis_surfaces_2,
    int_good_view_threshold=int_good_view_threshold,
    int_view_analysis_distance=int_view_analysis_distance)  # -> mesh_analysis_2, num_with_a_good_view_2, int_average_view_distance_2
srf_horizontal_surfaces = Surface(subdivision.srf_horizontal_surfaces_3)
panel = Panel(cluster.mesh_analysis_2)
with_a_good_view = Panel(cluster.num_with_a_good_view_2)
average_view_distance = Panel(cluster.int_average_view_distance_2)
mesh_analysis = Mesh(cluster.mesh_analysis_2)
preview = CustomPreview(Geometry=srf_horizontal_surfaces, Material=ColourSwatch(SwatchColor=RGB(255, 255, 255)))

# ==== cluster Subdivision
num_analysis_resolution = ClusterInput()
brep_for_analysis = ClusterInput()
num_analysis_resolution_2 = Number(num_analysis_resolution)
brep_for_analysis_2 = Brep(brep_for_analysis)
sunion = SolidUnion(Breps=flatten(brep_for_analysis_2))
brep_for_analysis_3 = Brep(graft(sunion))
debrep = DeconstructBrep(Brep=brep_for_analysis_3)  # -> Faces, Edges, Vertices
evalsrf = EvaluateSurface(Surface=reparameterize(debrep.Faces), Point="{0.5,0.5,0}")  # -> Point, Normal, UDirection, VDirection, Frame
devec = DeconstructVector(Vector=evalsrf.Normal)  # -> XComponent, YComponent, ZComponent
abs = Absolute(Value=devec.ZComponent)
smaller = SmallerThan(FirstNumber=abs, SecondNumber=".9")  # -> SmallerThan, OrEqualTo
dispatch = Dispatch(List=debrep.Faces, DispatchPattern=smaller.SmallerThan)  # -> ListA, ListB
num_analysis_resolution_3 = Number(num_analysis_resolution_2)
srf_horizontal_surfaces = Surface(dispatch.ListB)
srf = Surface(graft(dispatch.ListA))
dim = Dimensions(Surface=srf)  # -> UDimension, VDimension
division = Division(A=dim.UDimension, B=num_analysis_resolution_3)
division_2 = Division(A=dim.VDimension, B=num_analysis_resolution_3)
divide = DivideDomain²(Domain=srf, UCount=division, VCount=division_2)
subsrf = Isotrim(Surface=srf, Domain=divide)  # -> simplify(Surface)
trim = TrimTree(Tree=subsrf, Depth=1)
srf_analysis_surfaces = Surface(trim)
srf_horizontal_surfaces_2 = Surface(srf_horizontal_surfaces)
srf_horizontal_surfaces_3 = ClusterOutput(srf_horizontal_surfaces_2)
srf_analysis_surfaces_2 = ClusterOutput(srf_analysis_surfaces)

# ==== cluster Cluster
int_view_analysis_distance = ClusterInput()
int_good_view_threshold = ClusterInput()
srf_analysis_surfaces = ClusterInput()
mesh_obstructions = ClusterInput()
int_view_analysis_distance_2 = Integer(int_view_analysis_distance)
int_good_view_threshold_2 = Integer(int_good_view_threshold)
srf_analysis_surfaces_2 = Surface(graft(srf_analysis_surfaces))
mesh_obstructions_2 = Mesh(mesh_obstructions)

# ---- group: Creates View Lines
evalsrf = EvaluateSurface(Surface=reparameterize(srf_analysis_surfaces_2), Point="{0.5,0.5,0.5}")  # -> Point, Normal, UDirection, VDirection, Frame
line = LineSDL(Start=evalsrf.Point, Direction=evalsrf.Normal, Length=1)
xy = XYPlane(Origin=evalsrf.Point)
amp = Amplitude(Vector=evalsrf.Normal, Amplitude=".5")
series = Series(Start="-45", Step="15", Count="7")
rotate = Rotate(Geometry=line, Angle=degrees(series), Plane=xy)  # -> Geometry, Transform
move = Move(Geometry=rotate.Geometry, Motion=amp)  # -> Geometry, Transform

# ----
int_view_analysis_distance_3 = Integer(int_view_analysis_distance_2)
ivray = IsoVistRay(Sample=move.Geometry, Radius=int_view_analysis_distance_3, Obstacles=mesh_obstructions_2)  # -> Point, Distance, Index
min = Minimum(A=ivray.Distance, B=int_view_analysis_distance_3)
avr = Average(Input=min)
int_view_analysis_distance_4 = Integer(int_view_analysis_distance_3)
int_good_view_threshold_3 = Integer(int_good_view_threshold_2)
num_average_distance_to_obstructions = Number(avr)
srf_analysis_surfaces_3 = Surface(srf_analysis_surfaces_2)
larger = LargerThan(FirstNumber=num_average_distance_to_obstructions, SecondNumber=int_good_view_threshold_3)  # -> flatten(LargerThan), OrEqualTo
gradient = Gradient(
    LowerLimit=int_good_view_threshold_3,
    UpperLimit=expr("X*.8", int_view_analysis_distance_4),
    Parameter=num_average_distance_to_obstructions,
    stops=[0: RGB(105, 105, 105), 1: RGB(166, 227, 255)])
avr_2 = Average(Input=flatten(num_average_distance_to_obstructions))
lng = ListLength(List=flatten(num_average_distance_to_obstructions))
ma = MassAddition(Input=larger.LargerThan)  # -> Result, PartialResults
division = Division(A=ma.Result, B=lng)
mcol = MeshColours(Mesh=srf_analysis_surfaces_3, Colours=gradient)
int_average_view_distance = Integer(avr_2)
num_with_a_good_view = Number(division)
mesh_analysis = Mesh(mcol)
mesh_analysis_2 = ClusterOutput(mesh_analysis)
num_with_a_good_view_2 = ClusterOutput(num_with_a_good_view)
int_average_view_distance_2 = ClusterOutput(int_average_view_distance)
