# Grasshopper definition Sustainable Facade.gh (Grasshopper 1.0.6)

# ----
# XIM Standards
# Inputs
data = Data(True)

# ---- group: January
domain_sunrise_sunset = Domain(Domain(7.358, 16.8814))
crv_sun_path = Curve(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)

# ---- group: July
domain_sunrise_sunset_2 = Domain(Domain(4.7717, 19.3044))
crv_sun_path_2 = Curve(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)

# ----
brep_for_context = Brep([<brep referenced from the Rhino model> x18])
geo_context = Mesh([<mesh referenced from the Rhino model> x768])
analysis_resolution = Panel("50")
winter_sunlight_hrs_threshold = Panel("3")
summer_sunlight_hrs_threshold = Panel("6")

# ----
# Ouputs
data_2 = Data(True)

sunion = SolidUnion(Breps=brep_for_context)

# ----
# Note
# Previews
note_panel = Panel("")

mesh = Mesh(brep_for_context)

# ----
# Domain: Sunrise/ Sunset
january = Panel(domain_sunrise_sunset)
july = Panel(domain_sunrise_sunset_2)

merge = Merge(Data1=mesh, Data2=geo_context)
# Actions
# DO NOT CHANGE
subdivision = Subdivision(brep=sunion, num=analysis_resolution)  # -> G, N, G_2
mjoin = MeshJoin(Meshes=merge)
domain = Domain(domain_sunrise_sunset)
domain_2 = Domain(domain_sunrise_sunset_2)
pt = Point(subdivision.G_2)
mesh_2 = Mesh(mjoin)
crv = Curve(crv_sun_path_2)
crv_2 = Curve(crv_sun_path)

sun_light_hrs = SunLightHrs(pt=pt, mesh=mesh_2, crv=crv_2, domain=domain)  # -> crv_4, direct_sun_light_hours_day_each_sample_i_2, I
sun_light_hrs_2 = SunLightHrs(pt=pt, mesh=mesh_2, crv=crv, domain=domain_2)  # -> crv_4, direct_sun_light_hours_day_each_sample_i_2, I

smaller = SmallerThan(FirstNumber=sun_light_hrs_2.direct_sun_light_hours_day_each_sample_i_2, SecondNumber=summer_sunlight_hrs_threshold)  # -> SmallerThan, OrEqualTo
larger = LargerThan(FirstNumber=sun_light_hrs.direct_sun_light_hours_day_each_sample_i_2, SecondNumber=winter_sunlight_hrs_threshold)  # -> LargerThan, OrEqualTo

winter_sun_light_hrs = Number(sun_light_hrs.direct_sun_light_hours_day_each_sample_i_2)
summer_sun_light_hrs = Number(sun_light_hrs_2.direct_sun_light_hours_day_each_sample_i_2)

and = GateAnd(A=larger.OrEqualTo, B=smaller.OrEqualTo)
expression = Expression(x=winter_sun_light_hrs, y=summer_sun_light_hrs, Expression="x-y+10")
ma = MassAddition(Input=and)  # -> Result, PartialResults
lng = ListLength(List=and)
bnd = Bounds(Numbers=expression)
dedomain = DeconstructDomain(Domain=bnd)  # -> Start, End
division = Division(A=ma.Result, B=lng)
srf = Surface(flatten(subdivision.G))
gradient = Gradient(
    LowerLimit=dedomain.Start,
    UpperLimit=dedomain.End,
    Parameter=expression,
    stops=[0: RGB(0, 77, 128), 0.5: RGB(255, 255, 0), 1: RGB(255, 0, 0)])

# ----
# Note
note_panel_2 = Panel(division)

preview = CustomPreview(Geometry=srf, Material=gradient)

# ==== cluster Subdivision
brep = ClusterInput()
num = ClusterInput()

# ---- group: Remove top and bot
brep_2 = Brep(brep)
debrep = DeconstructBrep(Brep=brep_2)  # -> Faces, Edges, Vertices
evalsrf = EvaluateSurface(Surface=reparameterize(debrep.Faces), Point="0.5,0.5,0")  # -> Point, Normal, UDirection, VDirection, Frame
devec = DeconstructVector(Vector=evalsrf.Normal)  # -> XComponent, YComponent, ZComponent
abs = Absolute(Value=devec.ZComponent)
smaller = SmallerThan(FirstNumber=abs, SecondNumber=Slider(0.95, range=0..0.95))  # -> SmallerThan, OrEqualTo
cull = CullPattern(List=debrep.Faces, CullPattern=smaller.SmallerThan)

# ----
num_2 = Number(num)
brep_3 = Brep(brep_2)

# ---- group: Sub divide Srf
srf = Surface(graft(cull))
dim = Dimensions(Surface=srf)  # -> UDimension, VDimension
division = Division(A=dim.VDimension, B=num_2)
division_2 = Division(A=dim.UDimension, B=num_2)

# ----
eval = Evaluate(F="if(x<1,1,x)", x=division_2)
eval_2 = Evaluate(F="if(x<1,1,x)", x=division)
panel = Panel(srf)

# ---- group: Sub divide Srf (continued)
divide = DivideDomain²(Domain=srf, UCount=eval, VCount=eval_2)
subsrf = Isotrim(Surface=srf, Domain=divide)
evalsrf_2 = EvaluateSurface(Surface=reparameterize(subsrf), Point="0.5,0.5,0")  # -> simplify(Point), simplify(Normal), UDirection, VDirection, Frame

# ----
amp = Amplitude(Vector=evalsrf_2.Normal, Amplitude=Slider(1, range=0..1))
move = Move(Geometry=evalsrf_2.Point, Motion=amp)  # -> Geometry, Transform
brepsinc = PointInBreps(Brep=brep_3, Point=move.Geometry, Strict=False)  # -> Inside, Index
dispatch = Dispatch(List=subsrf, DispatchPattern=brepsinc.Inside)  # -> ListA, ListB
flip = Flip(Surface=dispatch.ListA)  # -> Surface, Result
merge = Merge(Data1=flip.Surface, Data2=dispatch.ListB)  # -> simplify(Result)
evalsrf_3 = EvaluateSurface(Surface=reparameterize(merge), Point="0.5,0.5,0")  # -> simplify(Point), simplify(Normal), UDirection, VDirection, Frame
amp_2 = Amplitude(Vector=evalsrf_3.Normal, Amplitude=Slider(0.3, range=0..1))
move_2 = Move(Geometry=merge, Motion=amp_2)  # -> Geometry, Transform
move_3 = Move(Geometry=evalsrf_3.Point, Motion=amp_2)  # -> Geometry, Transform
G = ClusterOutput(move_2.Geometry)
N = ClusterOutput(evalsrf_3.Normal)
G_2 = ClusterOutput(move_3.Geometry)

# ==== cluster SunLightHrs
pt = ClusterInput()
mesh = ClusterInput()
domain = ClusterInput()
crv = ClusterInput()
pt_2 = Point(flatten(pt))
mesh_2 = Mesh(mesh)
domain_2 = Domain(domain)
crv_2 = Curve(crv)
dedomain = DeconstructDomain(Domain=domain_2)  # -> Start, End
subtraction = Subtraction(A=dedomain.End, B=dedomain.Start)
xy = XYPlane(Origin=Point(0, 0, 0))
divide = DivideCurve(Curve=crv_2, Count=subtraction, Kinks=False)  # -> Points, Tangents, Parameters
ln = Line(StartPoint=divide.Points, EndPoint=xy)
crv_3 = Curve(ln)
crv_4 = ClusterOutput(crv_3)
crv_5 = Curve(crv_3)
occ = Occlusion(Samples=pt_2, Obstructions=mesh_2, Rays=crv_5)  # -> Hits, Occlusion
lng = ListLength(List=crv_5)
subtraction_2 = Subtraction(A=lng, B=occ.Hits)
direct_sun_light_hours_day_each_sample_i = Number(subtraction_2)  # "Direct Sun Light Hours / Day Each Sample in that Month"
bnd = Bounds(Numbers=subtraction_2)
I = ClusterOutput(bnd)
direct_sun_light_hours_day_each_sample_i_2 = ClusterOutput(direct_sun_light_hours_day_each_sample_i)  # "Direct Sun Light Hours / Day Each Sample in that Month"
