# Grasshopper definition Distance_to_Green_Space.gh (Grasshopper 1.0.7)

# ----
# XIM Standards
# Inputs
data = Data(True)

brep_buildings = Brep([<brep referenced from the Rhino model> x47])
brep_existing_parks = Brep([<brep referenced from the Rhino model> x32])
brep_new_parks = Brep([<brep referenced from the Rhino model> x13])
brep_bridges = Brep([<brep referenced from the Rhino model> x18])

# ----
# Ouputs
data_2 = Data(True)

cluster = Cluster(
    brep_buildings=brep_buildings,
    F="36",
    brep_existing_parks=brep_existing_parks,
    brep_new_parks=brep_new_parks,
    brep_bridges=brep_bridges)  # -> num_distance_to_green_spaces_2, brep_facade_segments_2
merge = Merge(Data1=brep_existing_parks, Data2=brep_new_parks, Data3=brep_bridges)

# ----
# Note
# Previews
note_panel = Panel("")

brep_all_green = Brep(merge)
sort = SortList(Keys=cluster.num_distance_to_green_spaces_2)  # -> Keys, ValuesA
rev = ReverseList(List=sort.Keys)

num_distance_to_green_spaces = Number(cluster.num_distance_to_green_spaces_2)
geo_facade_segments = Geometry(cluster.brep_facade_segments_2)

item = ListItem(List=rev, Index=0, Wrap=True)
gradient = Gradient(
    LowerLimit="1",
    UpperLimit=item,
    Parameter=cluster.num_distance_to_green_spaces_2,
    stops=[0: RGB(64, 159, 255), 1: RGB(255, 128, 191)])
debrep = DeconstructBrep(Brep=brep_buildings)  # -> Faces, Edges, Vertices

preview = CustomPreview(Geometry=debrep.Faces, Material=ColourSwatch(SwatchColor=RGB(255, 255, 255)))
preview_2 = CustomPreview(Geometry=debrep.Edges, Material=ColourSwatch(SwatchColor=RGB(0, 0, 0)))
preview_3 = CustomPreview(Geometry=cluster.brep_facade_segments_2, Material=gradient)
preview_4 = CustomPreview(Geometry=brep_all_green, Material=ColourSwatch(SwatchColor=RGB(153, 240, 158)))

# ==== cluster Cluster
brep_buildings = ClusterInput()
brep_existing_parks = ClusterInput()
brep_bridges = ClusterInput()
F = ClusterInput()
brep_new_parks = ClusterInput()
brep_existing_parks_2 = Brep(brep_existing_parks)
brep_new_parks_2 = Brep(brep_new_parks)
brep_bridges_2 = Brep(brep_bridges)
brep_buildings_2 = Brep(brep_buildings)
fbd = BrepFacesByDirection(Brep=graft(brep_buildings_2), Tolerance=0.9)  # -> Top, Bottom, Sides
merge = Merge(Data1=brep_existing_parks_2, Data2=brep_new_parks_2)
Z = UnitZ(Factor=F)
srf_bottom_srf = Surface(fbd.Bottom)
area = Area(Geometry=merge)  # -> Area, Centroid
area_2 = Area(Geometry=brep_bridges_2)  # -> Area, Centroid
contour = Contour(Shape=brep_buildings_2, Point=Point(0, 0, 0), Direction=Vector(0, 0, 1), Distance=Z)
crv_floor_crv = Curve(graft(contour))
boundary = BoundarySurfaces(Edges=crv_floor_crv)
area_3 = Area(Geometry=srf_bottom_srf)  # -> Area, Centroid
srf_floor_srf = Surface(boundary)
area_4 = Area(Geometry=srf_floor_srf)  # -> Area, Centroid
pt_building_centroid = Point(area_3.Centroid)
pt_floor_centroid = Point(area_4.Centroid)
pt_green_space_centroid = Point(flatten(area.Centroid))
pt_bridge_centroid = Point(flatten(area_2.Centroid))
Z_2 = UnitZ(Factor=1)
line = LineSDL(Start=graft(pt_floor_centroid), Direction=Z_2, Length="-1000")
ln = Line(StartPoint=pt_building_centroid, EndPoint=pt_green_space_centroid)
ln_2 = Line(StartPoint=pt_floor_centroid, EndPoint=pt_bridge_centroid)
brep_building = Brep([<brep referenced from the Rhino model> x47])
crv_park_to_building = Curve(ln)
crv_floor_to_bridge = Curve(ln_2)
trim = TrimWithBrep(Curve=line, Brep=brep_building)  # -> Inside, Outside
crv_vertical_distance = Curve(trim.Inside)
crv_park_to_building_2 = Curve(crv_park_to_building)
crv_floor_to_bridge_2 = Curve(crv_floor_to_bridge)
crv_floor_crv_2 = Curve(crv_floor_crv)
merge_2 = Merge(Data1=crv_vertical_distance, Data2=crv_park_to_building_2)
crv_network = Curve(merge_2)
crv_floor_crv_3 = Curve(flatten(crv_floor_crv_2))
len = Length(Curve=crv_network)  # -> flatten(Length)
Z_3 = UnitZ(Factor="36")
extr = Extrude(Base=crv_floor_crv_3, Direction=Z_3)
brep_building_2 = Brep(brep_building)
num_distance_to_green_spaces = Number(len)
brep_facade = Brep(extr)
cap = CapHoles(Brep=brep_facade)
trim_2 = TrimSolid(Shape=cap, Cutters=brep_building_2)
brep = Brep(trim_2)
merge_3 = Merge(Data1=brep, Data2=cap)
brep_facade_segments = Brep(merge_3)
num_distance_to_green_spaces_2 = ClusterOutput(num_distance_to_green_spaces)
brep_facade_segments_2 = ClusterOutput(brep_facade_segments)
