# Grasshopper definition 20201220_Walkability Analysis.gh (Grasshopper 1.0.7)
# plug-ins: DeCodingSpaces, Human, Shortest Walk in Gh

# ---- group: Procedu / High:Podium & Nest / Building Bar Location
offseted_edges = Panel("1")

# ---- group: Procedu / High:Podium & Nest / Building Thickness next to Public Space
panel = Panel("40")

# ---- group: Procedu
population_variation = Slider(2, range=0..2)
population_option = Slider(2, range=0..2)
urban_density = Slider(1, range=0..2)
street_option = Slider(2, range=0..2)
int_street_option = Integer(street_option)
population_density = Panel("""6
10
15""")
population_cluster = Panel("""8
6
10""")
population_varation = Panel(""".4
.8
1""")
item = ListItem(List=population_density, Index=population_option, Wrap=True)
item_2 = ListItem(List=population_cluster, Index=population_variation, Wrap=True)
item_3 = ListItem(List=population_varation, Index=population_variation, Wrap=True)
panel_2 = Panel(item)
panel_3 = Panel(item_2)
panel_4 = Panel(item_3)
num_varation = Number(item_3)
int_clusters = Integer(item_2)
num_far = Number(item)
Z = UnitZ(Factor="0.2")

# ---- group: Procedu / Parcel Generation
typical_street_width = Panel("60")
pacel_width = Panel("100")
crv_streets_1 = Curve([<curve referenced from the Rhino model> x11])
crv_streets_2 = Curve([<curve referenced from the Rhino model> x21])
crv_streets_3 = Curve([<curve referenced from the Rhino model> x12])
crv_mega_block = Curve(<curve referenced from the Rhino model>)
int_street_option_2 = Integer(int_street_option)
int_parcel_width = Integer(pacel_width)
crv_mega_block_2 = Curve(crv_mega_block)

crv_streets_1_2 = Curve(crv_streets_1)
crv_streets_2_2 = Curve(crv_streets_2)
crv_streets_3_2 = Curve(crv_streets_3)

# ---- group: Procedu / Defining Clusters
pt_density_attract = Point(Point(988215.8376, 215357.0398, 0))
int_clusters_2 = Integer(int_clusters)

# ---- group: Procedu / Parcel Generation (continued)
filter = StreamFilter(Gate=int_street_option_2, Stream0=crv_streets_1_2, Stream1=crv_streets_2_2, Stream2=crv_streets_3_2)
crv_streets = Curve(simplify(graft(filter)))
ext = ExtendCurve(Curve=crv_streets, Type=0, Start="45", End="45")

# ---- group: Procedu / Parcel Generation / Create subtraction curves
int_street_width = Integer(simplify(graft(typical_street_width)))
neg = Negative(Value=int_street_width)
merge = Merge(Data1=int_street_width, Data2=neg)
offset = Offset(Curve=ext, Distance=merge, Plane=PlaneXY(0, 0, 0), Corners=1)
trim = TrimTree(Tree=offset, Depth=1)
end = EndPoints(Curve=trim)  # -> Start, End
item_4 = ListItem(List=end.End, Index=0, Wrap=True)  # -> Item, Item1
item_5 = ListItem(List=end.Start, Index=0, Wrap=True)  # -> Item, Item1
ln = Line(StartPoint=item_4.Item, EndPoint=item_4.Item1)
ln_2 = Line(StartPoint=item_5.Item, EndPoint=item_5.Item1)
merge_2 = Merge(Data1=trim, Data2=ln_2, Data3=ln)
join = JoinCurves(Curves=merge_2, Preserve=False)  # -> flatten(Curves)

# ---- group: Procedu / Parcel Generation / Create Blocks
srfsplit = SurfaceSplit(Surface=crv_mega_block_2, Curves=join)
area = Area(Geometry=srfsplit)  # -> Area, Centroid
incurves = PointInCurves(Point=area.Centroid, Curves=join)  # -> Relationship, Index, Point
dispatch = Dispatch(List=srfsplit, DispatchPattern=incurves.Relationship)  # -> ListA, ListB
crv_blocks = Curve(dispatch.ListB)

# ---- group: Procedu / Parcel Generation / Parcel
disc = Discontinuity(Curve=crv_blocks, Level=1)  # -> Points, Parameters
int_parcel_width_2 = Integer(int_parcel_width)
pline = PolyLine(Vertices=disc.Points, Closed=True)
parcels = Parcels(Polygons=pline, ConnectionDistance=1, StreetOffset=0, PlotWidthThreshold=int_parcel_width_2, Precision=100)  # -> flatten(Parcels)

# ---- group: Procedu / Parcel Generation (continued)
crv_parcel = Curve(parcels)

# ---- group: Procedu / Height Distribution
subtraction = Subtraction(A="1.2", B=num_varation)
addition = Addition(A="1.2", B=num_varation)
int_clusters_3 = Integer(int_clusters)
dom = ConstructDomain(DomainStart=subtraction, DomainEnd=addition)
num_far_2 = Number(num_far)
range = Range(Domain=dom, Steps=expr("x-1", int_clusters_3))
floor_to_floor_height = Panel("12")

# ---- group: Procedu (continued)
remap = RemapNumbers(Value=range, Source=dom, Target=Domain(0, 1))  # -> Mapped, Clipped
graph = GraphMapper(remap.Mapped, x0=0, x1=1, y0=0, y1=1, container_name="Sine", Equation_px=[0, 0.3501483798], Equation_py=[0, 1])
graph_2 = GraphMapper(
    remap.Mapped,
    x0=0,
    x1=1,
    y0=0,
    y1=1,
    container_name="Bezier",
    cpx=[0, 0.9682580829, 0.4615605474, 1],
    cpy=[0, 0.369566977, 1, 1])
filter_2 = StreamFilter(Gate=urban_density, Stream0=graph_2, Stream1=remap.Mapped, Stream2=graph)
panel_5 = Panel(graph)
panel_6 = Panel(graph_2)
remap_2 = RemapNumbers(Value=filter_2, Source=Domain(0, 1), Target=dom)  # -> Mapped, Clipped
crv_parcel_2 = Curve(crv_parcel)
crv_parcel_3 = Curve(crv_parcel_2)

# ---- group: Procedu / Defining Clusters (continued)
area_2 = Area(Geometry=crv_parcel_3)  # -> Area, Centroid
jitter = Jitter(List=crv_parcel_3, Jitter=1, Seed=2)  # -> Values, Indices
dist = Distance(PointA=area_2.Centroid, PointB=pt_density_attract)
sort = SortList(Keys=dist, ValuesA=crv_parcel_3)  # -> Keys, ValuesA
rev = ReverseList(List=sort.ValuesA)
filter_3 = StreamFilter(Gate=urban_density, Stream0=sort.ValuesA, Stream1=jitter.Values, Stream2=rev)
lng = ListLength(List=crv_parcel_3)
division = Division(A=lng, B=int_clusters_2)
round = Round(Number=division)  # -> Nearest, Floor, Ceiling
partition = PartitionList(List=filter_3, Size=round.Ceiling)  # -> simplify(Chunks)
crv_parcels = Curve(partition)

# ---- group: Procedu / Height Distribution (continued)
rev_2 = ReverseList(List=remap_2.Mapped)
multiplication = Multiplication(A=num_far_2, B=rev_2)
num_far_variation = Number(simplify(graft(multiplication)))
multiplication_2 = Multiplication(A=floor_to_floor_height, B=num_far_variation)

# ---- group: Procedu / Extrusion
crv_parcels_2 = Curve(crv_parcels)
Z_2 = UnitZ(Factor=multiplication_2)
extr = Extrude(Base=crv_parcels_2, Direction=Z_2)
cap = CapHoles(Brep=extr)

# ---- group: Procedu (continued)
brep_all_buildings = Brep(cap)
find_height = FindHeight(B=brep_all_buildings)
num_buidling_height = Number(find_height)

# ---- group: Procedu / 3 Population
brep_all_buildings_2 = Brep(flatten(brep_all_buildings))
brep_all_buildings_3 = Brep(flatten(brep_all_buildings))
brep_all_buildings_4 = Brep(flatten(brep_all_buildings))
larger = LargerThan(FirstNumber=flatten(num_buidling_height), SecondNumber="200")  # -> LargerThan, OrEqualTo
smaller = SmallerThan(FirstNumber=flatten(num_buidling_height), SecondNumber="200")  # -> SmallerThan, OrEqualTo
smaller_2 = SmallerThan(FirstNumber=flatten(num_buidling_height), SecondNumber="120")  # -> SmallerThan, OrEqualTo
cull = CullPattern(List=brep_all_buildings_4, CullPattern=smaller.SmallerThan)
find_height_2 = FindHeight(B=cull)
larger_2 = LargerThan(FirstNumber=flatten(find_height_2), SecondNumber="120")  # -> LargerThan, OrEqualTo
cull_2 = CullPattern(List=cull, CullPattern=larger_2.LargerThan)
cull_3 = CullPattern(List=brep_all_buildings_3, CullPattern=larger.LargerThan)
cull_4 = CullPattern(List=brep_all_buildings_2, CullPattern=smaller_2.SmallerThan)

# ---- group: Procedu (continued)
brep_high = Brep(cull_3)
brep_low = Brep(cull_4)
brep_mid = Brep(cull_2)
brep_mid_2 = Brep(brep_mid)
brep_high_2 = Brep(brep_high)
brep_low_2 = Brep(brep_low)
brep_mid_3 = Brep(brep_mid_2)
brep_mid_4 = Brep(brep_mid_3)

# ---- group: Procedu / High:Podium & Nest / Public Volume Height
find_height_3 = FindHeight(B=brep_high_2)
num_buidling_height_2 = Number(find_height_3)
division_2 = Division(A=num_buidling_height_2, B="12")
num_of_floor = Number(graft(division_2))
division_3 = Division(A=num_of_floor, B="3")
multiplication_3 = Multiplication(A=division_3, B="12")

# ---- group: Procedu / LOW:Circle+Arcade
debrep = DeconstructBrep(Brep=brep_low_2)  # -> Faces, Edges, Vertices
item_6 = ListItem(List=debrep.Faces, Index="1", Wrap=True)
area_3 = Area(Geometry=item_6)  # -> Area, Centroid
larger_3 = LargerThan(FirstNumber=area_3.Area, SecondNumber="28000")  # -> LargerThan, OrEqualTo
dispatch_2 = Dispatch(List=item_6, DispatchPattern=larger_3.LargerThan)  # -> ListA, ListB
srf_circle = Surface(simplify(flatten(dispatch_2.ListA)))
srf_arcade = Surface(dispatch_2.ListB)
edges = BrepEdges(Brep=srf_circle)  # -> Naked, Interior, NonManifold
edges_2 = BrepEdges(Brep=srf_arcade)  # -> Naked, Interior, NonManifold
midpt = CurveMiddle(Curve=edges_2.Naked)
crv_parcel_4 = Curve(edges.Naked)
end_2 = EndPoints(Curve=crv_parcel_4)  # -> Start, End
crv_streets_4 = Curve(flatten(crv_streets))
pull = PullPoint(Point=midpt, Geometry=crv_streets_4, ClosestOnly=True)  # -> ClosestPoint, Distance
sort_2 = SortList(Keys=pull.Distance, ValuesA=edges_2.Naked)  # -> Keys, ValuesA
item_7 = ListItem(List=sort_2.ValuesA, Index=0, Wrap=True)
pull_2 = PullPoint(Point=end_2.Start, Geometry=crv_streets_4, ClosestOnly=True)  # -> ClosestPoint, Distance
street_offset = Panel("8")  # disabled
crv_side_of_arcade = Curve(item_7)
sort_3 = SortList(Keys=pull_2.Distance, ValuesA=end_2.Start)  # -> Keys, ValuesA
offset_2 = OffsetCurve(Curve=crv_side_of_arcade, Distance=street_offset, Plane=PlaneXY(0, 0, 0), Corners=1)  # disabled
item_8 = ListItem(List=sort_3.ValuesA, Index=0, Wrap=True)
item_9 = ListItem(List=sort_3.ValuesA, Index="1", Wrap=True)
arcade_width = Panel("40")
dist_2 = Distance(PointA=item_8, PointB=item_9)
pt_circle_center = Point(item_8)
offset_3 = OffsetCurve(Curve=crv_side_of_arcade, Distance=arcade_width, Plane=PlaneXY(0, 0, 0), Corners=1)
division_4 = Division(A=dist_2, B="2")
cir = Circle(Plane=pt_circle_center, Radius=division_4)
ext_2 = ExtendCurve(Curve=crv_side_of_arcade, Type=0, Start="10", End="10")
ext_3 = ExtendCurve(Curve=offset_3, Type=0, Start="10", End="10")
trim_2 = TrimTree(Tree=ext_3, Depth=1)
srf_circle_public_space = Surface(cir)
end_3 = EndPoints(Curve=ext_2)  # -> Start, End
Z_3 = UnitZ(Factor="550")
end_4 = EndPoints(Curve=trim_2)  # -> Start, End
extr_2 = Extrude(Base=srf_circle_public_space, Direction=Z_3)
ln_3 = Line(StartPoint=end_4.Start, EndPoint=end_3.Start)
ln_4 = Line(StartPoint=end_4.End, EndPoint=end_3.End)
merge_3 = Merge(Data1=trim_2, Data2=ext_2, Data3=ln_3, Data4=ln_4)  # -> flatten(Result)
join_2 = JoinCurves(Curves=merge_3, Preserve=False)  # -> graft(Curves)
srf_arcade_public_space = Surface(join_2)
merge_4 = Merge(Data1=srf_circle_public_space, Data2=srf_arcade_public_space)
Z_4 = UnitZ(Factor="24")
extr_3 = Extrude(Base=srf_arcade_public_space, Direction=Z_4)
srf_low_public_space = Surface(merge_4)
merge_5 = Merge(Data1=extr_2, Data2=extr_3)  # -> flatten(Result)
brep_low_3 = Brep(brep_low_2)
sdiff = SolidDifference(BrepsA=brep_low_3, BrepsB=merge_5)
brep_low_c_a = Brep(sdiff)
edges_3 = BrepEdges(Brep=sdiff)  # -> Naked, Interior, NonManifold
preview = CustomPreview(Geometry=sdiff, Material=ColourSwatch(SwatchColor=RGB(255, 255, 255)))
preview_2 = CustomPreview(Geometry=edges_3.Interior, Material=ColourSwatch(SwatchColor=RGB(0, 0, 0)))

# ---- group: Procedu / High:Podium & Nest
debrep_2 = DeconstructBrep(Brep=brep_high_2)  # -> Faces, Edges, Vertices
brep_high_3 = Brep(brep_high_2)
item_10 = ListItem(List=debrep_2.Faces, Index="1", Wrap=True)
Z_5 = UnitZ(Factor=multiplication_3)
move = Move(Geometry=item_10, Motion=Z_5)  # -> Geometry, Transform
srf_ps_height_level = Surface(move.Geometry)
edges_4 = BrepEdges(Brep=move.Geometry)  # -> Naked, Interior, NonManifold
area_4 = Area(Geometry=move.Geometry)  # -> Area, Centroid
item_11 = ListItem(List=edges_4.Naked, Index=offseted_edges, Wrap=True)
item_12 = ListItem(List=edges_4.Naked, Index=offseted_edges, Wrap=True)
cir_2 = Circle(Plane=area_4.Centroid, Radius="25")
offset_4 = OffsetCurve(Curve=item_11, Distance=panel, Plane=PlaneXY(0, 0, 0), Corners=1)
ext_4 = ExtendCurve(Curve=item_12, Type=0, Start="30", End="30")
ext_5 = ExtendCurve(Curve=offset_4, Type=0, Start="30", End="30")
trim_3 = TrimTree(Tree=ext_5, Depth=1)
end_5 = EndPoints(Curve=trim_3)  # -> Start, End
end_6 = EndPoints(Curve=ext_4)  # -> Start, End
item_13 = ListItem(List=end_5.End, Index=0, Wrap=True)  # -> Item, Item1
item_14 = ListItem(List=end_5.Start, Index=0, Wrap=True)  # -> Item, Item1
item_15 = ListItem(List=end_6.Start, Index=0, Wrap=True)  # -> Item, Item1
item_16 = ListItem(List=end_6.End, Index=0, Wrap=True)  # -> Item, Item1
ln_5 = Line(StartPoint=item_13.Item, EndPoint=item_16.Item)
ln_6 = Line(StartPoint=item_14.Item, EndPoint=item_15.Item)
merge_6 = Merge(Data1=trim_3, Data2=ln_6, Data3=ln_5)
join_3 = JoinCurves(Curves=merge_6, Preserve=False)  # -> flatten(Curves)
srfsplit_2 = SurfaceSplit(Surface=move.Geometry, Curves=join_3)
area_5 = Area(Geometry=srfsplit_2)  # -> Area, Centroid
incurves_2 = PointInCurves(Point=area_5.Centroid, Curves=cir_2)  # -> Relationship, Index, Point
dispatch_3 = Dispatch(List=srfsplit_2, DispatchPattern=incurves_2.Relationship)  # -> ListA, ListB
srf_ps_foundations = Surface(dispatch_3.ListA)
area_6 = Area(Geometry=srf_ps_foundations)  # -> Area, Centroid
srf_ps_height_level_2 = Surface(srf_ps_height_level)
brep_high_4 = Brep(graft(brep_high_3))
larger_4 = LargerThan(FirstNumber=area_6.Area, SecondNumber="15000")  # -> LargerThan, OrEqualTo
num_public_volume_height = Number(multiplication_3)
cull_5 = CullPattern(List=srf_ps_height_level_2, CullPattern=larger_4.OrEqualTo)
cull_6 = CullPattern(List=brep_high_4, CullPattern=larger_4.OrEqualTo)
dispatch_4 = Dispatch(List=srf_ps_foundations, DispatchPattern=larger_4.OrEqualTo)  # -> ListA, ListB
crv_podium_outline = Curve(cull_5)
brep_building = Brep(cull_6)
srf_public_space_nesting = Surface(dispatch_4.ListB)
offset_5 = OffsetCurve(Curve=crv_podium_outline, Distance="30", Plane=PlaneXY(0, 0, 0), Corners=1)
multiplication_4 = Multiplication(A=num_public_volume_height, B="2.01")
trim_4 = TrimTree(Tree=offset_5, Depth=1)
Z_6 = UnitZ(Factor=num_public_volume_height)
Z_7 = UnitZ(Factor=multiplication_4)
extr_4 = Extrude(Base=trim_4, Direction=Z_7)
extr_5 = Extrude(Base=crv_podium_outline, Direction=Z_7)
cap_2 = CapHoles(Brep=extr_5)
cap_3 = CapHoles(Brep=extr_4)
area_7 = Area(Geometry=srf_public_space_nesting)  # -> Area, Centroid
extr_6 = Extrude(Base=srf_public_space_nesting, Direction=Z_6)
sdiff_2 = SolidDifference(BrepsA=cap_2, BrepsB=cap_3)
cap_4 = CapHoles(Brep=extr_6)
brep_ps_subtraction = Brep(sdiff_2)
scale_nu = ScaleNU(Geometry=cap_4, Plane=area_7.Centroid, ScaleX="1.01", ScaleY="1.01", ScaleZ=1)  # -> flatten(Geometry), Transform
debrep_3 = DeconstructBrep(Brep=brep_ps_subtraction)  # -> Faces, Edges, Vertices
item_17 = ListItem(List=debrep_3.Faces, Index="1", Wrap=True)
srf_public_space_on_podium = Surface(item_17)
srf_public_space_on_podium_2 = Surface(srf_public_space_on_podium)
srf_public_space_nesting_2 = Surface(srf_public_space_nesting)
merge_7 = Merge(Data1=brep_ps_subtraction, Data2=scale_nu.Geometry)  # -> flatten(Result)
merge_8 = Merge(Data1=srf_public_space_on_podium_2, Data2=srf_public_space_nesting_2)
srf_public_space = Surface(merge_8)
brep_high_5 = Brep(brep_high_2)
sdiff_3 = SolidDifference(BrepsA=brep_high_5, BrepsB=merge_7)
brep_high_p_n = Brep(sdiff_3)
edges_5 = BrepEdges(Brep=sdiff_3)  # -> Naked, Interior, NonManifold
preview_3 = CustomPreview(Geometry=edges_5.Interior, Material=ColourSwatch(SwatchColor=RGB(0, 0, 0)))
preview_4 = CustomPreview(Geometry=sdiff_3, Material=ColourSwatch(SwatchColor=RGB(255, 255, 255)))

# ---- group: Procedu / MID:Roof
debrep_4 = DeconstructBrep(Brep=brep_mid_3)  # -> Faces, Edges, Vertices
item_18 = ListItem(List=debrep_4.Faces, Index=0, Wrap=True)
edges_6 = BrepEdges(Brep=brep_mid_3)  # -> Naked, Interior, NonManifold
area_8 = Area(Geometry=item_18)  # -> Area, Centroid
preview_5 = CustomPreview(Geometry=edges_6.Interior, Material=ColourSwatch(SwatchColor=RGB(0, 0, 0)))
preview_6 = CustomPreview(Geometry=brep_mid_3, Material=ColourSwatch(SwatchColor=RGB(255, 255, 255)))
preview_7 = CustomPreview(Geometry=item_18, Material=ColourSwatch(SwatchColor=RGB(0, 255, 115)))
panel_7 = Panel(area_8.Area)
srf_roof_park = Surface(item_18)

# ---- group: Procedu (continued)
srf_public_space_2 = Surface(srf_public_space)
srf_roof_park_2 = Surface(srf_roof_park)
brep_high_p_n_2 = Brep(brep_high_p_n)
srf_low_public_space_2 = Surface(srf_low_public_space)
brep_low_c_a_2 = Brep(brep_low_c_a)
merge_9 = Merge(Data1=srf_public_space_2, Data2=srf_roof_park_2, Data3=srf_low_public_space_2)  # -> flatten(Result)
merge_10 = Merge(Data1=brep_high_p_n_2, Data2=brep_mid_4, Data3=brep_low_c_a_2)  # -> flatten(Result)
srf_all_public_space = Surface(merge_9)
brep_all_buildings_5 = Brep(merge_10)
move_2 = Move(Geometry=srf_all_public_space, Motion=Z)  # -> Geometry, Transform
edges_7 = BrepEdges(Brep=brep_all_buildings_5)  # -> Naked, Interior, NonManifold
preview_8 = CustomPreview(Geometry=edges_7.Interior, Material=ColourSwatch(SwatchColor=RGB(0, 0, 0)))
preview_9 = CustomPreview(Geometry=brep_all_buildings_5, Material=ColourSwatch(SwatchColor=RGB(255, 255, 255)))
preview_10 = CustomPreview(Geometry=move_2.Geometry, Material=ColourSwatch(SwatchColor=RGB(68, 150, 77)))

# ---- group: Procedu / Destinations
srf_arcade_public_space_2 = Surface(srf_arcade_public_space)  # disabled

# ---- group: Low_Walk
brep_low_4 = Brep(brep_low_3)  # disabled

# ----
crv_streets_5 = Curve(flatten(crv_streets))  # disabled
srf_arcade_public_space_3 = Surface(srf_arcade_public_space_2)  # disabled
area_9 = Area(Geometry=srf_arcade_public_space_3)  # -> Area, Centroid; disabled
pt_destination_public_space = Point(area_9.Centroid)  # disabled
crv_streets_6 = Curve(crv_streets_5)  # disabled

# ---- group: High_Walk
brep_low_c_a_3 = Brep(brep_low_c_a)  # disabled
debrep_5 = DeconstructBrep(Brep=brep_low_4)  # -> Faces, Edges, Vertices; disabled
brep_high_decon = Brep(debrep_5.Faces)  # disabled
panel_8 = Panel("1")  # disabled
item_19 = ListItem(List=brep_high_decon, Index=0, Wrap=True)  # disabled
item_20 = ListItem(List=brep_high_decon, Index=panel_8, Wrap=True)  # disabled
area_10 = Area(Geometry=flatten(item_20))  # -> Area, Centroid; disabled
area_11 = Area(Geometry=flatten(item_19))  # -> Area, Centroid; disabled
ln_7 = Line(StartPoint=area_11.Centroid, EndPoint=area_10.Centroid)  # disabled
height_discount_2 = HeightDiscount2(G=area_11.Centroid, C=ln_7)  # disabled
pt_bottom_of_bdg = Point(area_10.Centroid)  # disabled
pt_top_of_bdg = Point(area_11.Centroid)  # disabled
panel_9 = Panel("-12")  # disabled
pull_3 = PullPoint(Point=pt_bottom_of_bdg, Geometry=flatten(crv_streets_5), ClosestOnly=True)  # -> ClosestPoint, Distance; disabled
Z_8 = UnitZ(Factor=panel_9)  # disabled
ln_8 = Line(StartPoint=pt_bottom_of_bdg, EndPoint=pull_3.ClosestPoint)  # disabled
ln_9 = Line(StartPoint=height_discount_2, EndPoint=area_10.Centroid)  # disabled
move_3 = Move(Geometry=pt_top_of_bdg, Motion=Z_8)  # -> Geometry, Transform; disabled
crv_verticle_to_street_distance = Curve(ln_8)  # disabled
crv_verticle_height = Curve(ln_9)  # disabled
pt_highest_res = Point(move_3.Geometry)  # disabled
brep_low_5 = Brep(brep_low_c_a_3)  # disabled

# ---- group: Mid_WALK
brep_mid_5 = Brep(brep_mid_3)  # disabled
brep_mid_decon = Brep(debrep_4.Faces)  # disabled
panel_10 = Panel("1")  # disabled
item_21 = ListItem(List=brep_mid_decon, Index=0, Wrap=True)  # disabled
item_22 = ListItem(List=brep_mid_decon, Index=panel_10, Wrap=True)  # disabled
area_12 = Area(Geometry=flatten(item_22))  # -> Area, Centroid; disabled
area_13 = Area(Geometry=flatten(item_21))  # -> Area, Centroid; disabled
ln_10 = Line(StartPoint=area_13.Centroid, EndPoint=area_12.Centroid)  # disabled
height_discount_2_2 = HeightDiscount2(G=area_13.Centroid, C=ln_10)  # disabled
pt_bottom_of_bdg_2 = Point(area_12.Centroid)  # disabled
pt_top_of_bdg_2 = Point(area_13.Centroid)  # disabled
panel_11 = Panel("-12")  # disabled
pull_4 = PullPoint(Point=pt_bottom_of_bdg_2, Geometry=flatten(crv_streets_5), ClosestOnly=True)  # -> ClosestPoint, Distance; disabled
Z_9 = UnitZ(Factor=panel_11)  # disabled
ln_11 = Line(StartPoint=pt_bottom_of_bdg_2, EndPoint=pull_4.ClosestPoint)  # disabled
ln_12 = Line(StartPoint=height_discount_2_2, EndPoint=area_12.Centroid)  # disabled
move_4 = Move(Geometry=pt_top_of_bdg_2, Motion=Z_9)  # -> Geometry, Transform; disabled
crv_verticle_to_street_distance_2 = Curve(ln_11)  # disabled
crv_verticle_height_2 = Curve(ln_12)  # disabled
pt_highest_res_2 = Point(move_4.Geometry)  # disabled

# ---- group: High_Walk
brep_high_p_n_3 = Brep(brep_high_p_n)  # disabled
brep_high_6 = Brep(brep_high_5)  # disabled
debrep_6 = DeconstructBrep(Brep=brep_high_6)  # -> Faces, Edges, Vertices; disabled
brep_high_decon_2 = Brep(debrep_6.Faces)  # disabled
panel_12 = Panel("1")  # disabled
item_23 = ListItem(List=brep_high_decon_2, Index=0, Wrap=True)  # disabled
item_24 = ListItem(List=brep_high_decon_2, Index=panel_12, Wrap=True)  # disabled
area_14 = Area(Geometry=flatten(item_24))  # -> Area, Centroid; disabled
area_15 = Area(Geometry=flatten(item_23))  # -> Area, Centroid; disabled
ln_13 = Line(StartPoint=area_15.Centroid, EndPoint=area_14.Centroid)  # disabled
height_discount_2_3 = HeightDiscount2(G=area_15.Centroid, C=ln_13)  # disabled
pt_bottom_of_bdg_3 = Point(area_14.Centroid)  # disabled
pt_top_of_bdg_3 = Point(area_15.Centroid)  # disabled
panel_13 = Panel("-12")  # disabled
pull_5 = PullPoint(Point=pt_bottom_of_bdg_3, Geometry=flatten(crv_streets_5), ClosestOnly=True)  # -> ClosestPoint, Distance; disabled
Z_10 = UnitZ(Factor=panel_13)  # disabled
ln_14 = Line(StartPoint=pt_bottom_of_bdg_3, EndPoint=pull_5.ClosestPoint)  # disabled
ln_15 = Line(StartPoint=height_discount_2_3, EndPoint=area_14.Centroid)  # disabled
move_5 = Move(Geometry=pt_top_of_bdg_3, Motion=Z_10)  # -> Geometry, Transform; disabled
crv_verticle_to_street_distance_3 = Curve(ln_14)  # disabled
crv_verticle_height_3 = Curve(ln_15)  # disabled
pt_highest_res_3 = Point(move_5.Geometry)  # disabled
brep_high_7 = Brep(brep_high_p_n_3)  # disabled

# ----
merge_11 = Merge(
    Data1=crv_verticle_height_2,
    Data2=crv_verticle_to_street_distance_2,
    Data3=crv_streets_6,
    Data4=crv_verticle_height_3,
    Data5=crv_verticle_to_street_distance_3,
    Data6=crv_verticle_height,
    Data7=crv_verticle_to_street_distance)  # disabled
brep_high_8 = Brep(brep_high_7)  # disabled
brep_mid_6 = Brep(brep_mid_5)  # disabled
brep_low_6 = Brep(brep_low_5)  # disabled
join_4 = JoinCurves(Curves=merge_11, Preserve=False)  # disabled
merge_12 = Merge(Data1=pt_highest_res_2, Data2=pt_highest_res_3, Data3=pt_highest_res)  # disabled
network2segments = NetworkToSegments(NetworkGeometry=join_4, ConvertCurves=True, ConversionAngle=0.2, Split=True)  # disabled
merge_13 = Merge(Data1=brep_mid_6, Data2=brep_high_8, Data3=brep_low_6)  # disabled
crv_network_of_streets = Curve(network2segments)  # disabled
brep_bdg_to_color = Brep(merge_13)  # disabled
pt_bdg_origin = Point(merge_12)  # disabled

# ---- group: Walkability
pt_top_of_bdg_4 = Point(pt_bdg_origin)  # disabled
crv_network = Curve(flatten(crv_network_of_streets))  # disabled
panel_14 = Panel("400")  # disabled
travel_time = Panel("10")  # disabled
brep_bdg_to_color_2 = Brep(brep_bdg_to_color)  # disabled
ft_min = Panel("225")  # disabled
_1_process_geometry = _1ProcessGeometry(Path=crv_network, SegmentLength=panel_14)  # -> Object, flatten(Segments), Vectors, Ids; disabled
pt_destination = Point(flatten(pt_destination_public_space))  # disabled
multiplication_5 = Multiplication(A=travel_time, B=ft_min)  # disabled
pt_orgin = Point(graft(pt_top_of_bdg_4))  # disabled
ln_16 = Line(StartPoint=pt_orgin, EndPoint=pt_destination)  # disabled
num_max_travel_distance = Number(multiplication_5)  # disabled
shortwalk = ShortestWalk(Curves=_1_process_geometry.Segments, WantedPath=ln_16)  # -> ShortestWalk, Succession, Direction, Length; disabled
smaller_3 = SmallerThan(FirstNumber=shortwalk.Length, SecondNumber=num_max_travel_distance)  # -> SmallerThan, OrEqualTo; disabled
clean = CleanTree(RemoveNulls=True, RemoveInvalid=True, RemoveEmpty=False, Tree=shortwalk.ShortestWalk)  # disabled
brep_bdg_to_color_3 = Brep(brep_bdg_to_color_2)  # disabled
cull_7 = CullPattern(List=shortwalk.Length, CullPattern=smaller_3.OrEqualTo)  # disabled
cull_8 = CullPattern(List=clean, CullPattern=smaller_3.OrEqualTo)  # disabled
panel_15 = Panel("2")  # disabled
lng_2 = ListLength(List=cull_7)  # disabled
panel_16 = Panel("78")  # disabled
panel_17 = Panel("20")  # disabled
lng_3 = ListLength(List=flatten(lng_2))  # disabled
avr = Average(Input=flatten(lng_2))  # disabled
bnd = Bounds(Numbers=cull_7)  # disabled
gradient = Gradient(LowerLimit=panel_17, UpperLimit=panel_16, Parameter=flatten(lng_2), stops=[0: RGB(69, 116, 245), 1: RGB(220, 0, 40)])  # disabled
neg_2 = Negative(Value=cull_7)  # disabled
panel_18 = Panel("6 to 1")  # disabled
remap_3 = RemapNumbers(Value=cull_7, Source=bnd, Target=panel_18)  # -> Mapped, Clipped; disabled
Z_11 = UnitZ(Factor=neg_2)  # disabled
move_6 = Move(Geometry=cull_8, Motion=Z_11)  # -> Geometry, Transform; disabled
average_number_of_arcada_accessible = Panel(avr)  # disabled
panel_19 = Panel("1")  # disabled
panel_20 = Panel("6")  # disabled
gradient_2 = Gradient(
    LowerLimit=panel_19,
    UpperLimit=panel_20,
    Parameter=remap_3.Mapped,
    stops=[0.00913: RGB(98, 206, 245), 1: RGB(220, 0, 40)])  # disabled
mesh = Mesh(brep_bdg_to_color_3)  # disabled
preview_11 = CustomPreview(Geometry=mesh, Material=gradient)  # disabled
previewlw = CustomPreviewLineweights(Geometry=move_6.Geometry, Shader=gradient_2, Thickness=remap_3.Mapped, Absolute=False)  # disabled

# ----
lng_4 = ListLength(List=pt_destination)  # disabled
division_5 = Division(A=lng_4, B=panel_15)  # disabled

# ---- group: Walkability (continued)
larger_5 = LargerThan(FirstNumber=flatten(lng_2), SecondNumber=division_5)  # -> LargerThan, OrEqualTo; disabled
ma = MassAddition(Input=larger_5.OrEqualTo)  # -> Result, PartialResults; disabled
division_6 = Division(A=ma.Result, B=lng_3)  # disabled
percentage_of_bd_having_more_than_half = Panel(division_6)  # disabled

# ==== cluster FindHeight
B = ClusterInput()
debrep = DeconstructBrep(Brep=B)  # -> Faces, Edges, Vertices
item = ListItem(List=debrep.Faces, Index=0, Wrap=True)
item_2 = ListItem(List=debrep.Faces, Index="1", Wrap=True)
area = Area(Geometry=item)  # -> Area, Centroid
area_2 = Area(Geometry=item_2)  # -> Area, Centroid
dist = Distance(PointA=area.Centroid, PointB=area_2.Centroid)
D = ClusterOutput(dist)

# ==== cluster HeightDiscount2
C = ClusterInput()
len = Length(Curve=C)
division = Division(A=len, B="2")
neg = Negative(Value=division)
G = ClusterInput()
Z = UnitZ(Factor=neg)
move = Move(Geometry=G, Motion=Z)  # -> Geometry, Transform
G_2 = ClusterOutput(move.Geometry)
