# Grasshopper definition Github_Walkbility_Tool_1124.gh (Grasshopper 1.0.7)
# plug-ins: DeCodingSpaces, Human, Shortest Walk in Gh

crv_public_spaces = Curve()  # disabled
project = Project(Geometry=crv_public_spaces, Plane=PlaneXY(0, 0, 0))  # -> Geometry, Transform; disabled
panel = Panel(".5")  # disabled
Z = UnitZ(Factor=panel)  # disabled

# ---- group: Walkability
crv_building_footprint = Curve(project.Geometry)  # disabled
pt_subway_stations = Point(flatten([<point referenced from the Rhino model> x6]))  # disabled
crv_network = Curve([<curve referenced from the Rhino model> x68])  # disabled
travel_time = Panel("6")  # disabled
ft_min = Panel("250")  # disabled
area = Area(Geometry=crv_building_footprint)  # -> Area, Centroid; disabled
multiplication = Multiplication(A=travel_time, B=ft_min)  # disabled
crv_building_footprint_2 = Curve(crv_public_spaces)  # disabled
num_max_travel_distance = Number(multiplication)  # disabled
crv_network_2 = Curve(crv_network)  # disabled
pt_orgin = Point(area.Centroid)  # disabled
panel_2 = Panel("20")  # disabled
pt_orgin_2 = Point(graft(pt_orgin))  # disabled
_1_process_geometry = _1ProcessGeometry(Path=crv_network_2, SegmentLength=panel_2)  # -> Object, flatten(Segments), Vectors, Ids; disabled
ln = Line(StartPoint=pt_orgin_2, EndPoint=pt_subway_stations)  # disabled
num_max_travel_distance_2 = Number(num_max_travel_distance)  # disabled
shortwalk = ShortestWalk(Curves=_1_process_geometry.Segments, WantedPath=ln)  # -> ShortestWalk, Succession, Direction, Length; disabled
clean = CleanTree(RemoveNulls=True, RemoveInvalid=True, RemoveEmpty=False, Tree=shortwalk.ShortestWalk)  # disabled
smaller = SmallerThan(FirstNumber=shortwalk.Length, SecondNumber=num_max_travel_distance_2)  # -> SmallerThan, OrEqualTo; disabled
cull = CullPattern(List=shortwalk.Length, CullPattern=smaller.OrEqualTo)  # disabled
cull_2 = CullPattern(List=clean, CullPattern=smaller.OrEqualTo)  # disabled
lng = ListLength(List=cull)  # disabled
panel_3 = Panel("3")  # disabled
lng_2 = ListLength(List=flatten(lng))  # disabled
larger = LargerThan(FirstNumber=flatten(lng), SecondNumber=panel_3)  # -> LargerThan, OrEqualTo; disabled
panel_4 = Panel("0")  # disabled
panel_5 = Panel("6")  # disabled
avr = Average(Input=flatten(lng))  # disabled
bnd = Bounds(Numbers=cull)  # disabled
gradient = Gradient(LowerLimit=panel_4, UpperLimit=panel_5, Parameter=lng, stops=[0.00913: RGB(69, 116, 245), 1: RGB(220, 0, 40)])  # disabled
ma = MassAddition(Input=larger.OrEqualTo)  # -> Result, PartialResults; disabled
panel_6 = Panel("6 to 1")  # disabled
neg = Negative(Value=cull)  # disabled
crv_building_footprint_3 = Curve(graft(crv_building_footprint_2))  # disabled
remap = RemapNumbers(Value=cull, Source=bnd, Target=panel_6)  # -> Mapped, Clipped; disabled
division = Division(A=ma.Result, B=lng_2)  # disabled
Z_2 = UnitZ(Factor=neg)  # disabled
move = Move(Geometry=cull_2, Motion=Z_2)  # -> Geometry, Transform; disabled
panel_7 = Panel(avr)  # disabled
percentage_of_bd_having_of_sub = Panel(division)  # disabled
srf = Surface(crv_building_footprint_3)  # disabled
panel_8 = Panel("1")  # disabled
panel_9 = Panel("6")  # disabled
gradient_2 = Gradient(LowerLimit=panel_8, UpperLimit=panel_9, Parameter=remap.Mapped, stops=[0.00913: RGB(98, 206, 245), 1: RGB(220, 0, 40)])  # disabled
previewlw = CustomPreviewLineweights(Geometry=move.Geometry, Shader=gradient_2, Thickness=remap.Mapped, Absolute=False)  # disabled

# ----
move_2 = Move(Geometry=srf, Motion=Z)  # -> Geometry, Transform; disabled

# ---- group: Walkability (continued)
mcol = MeshColours(Mesh=move_2.Geometry, Colours=gradient)  # disabled
