# Grasshopper definition Podium_Tower_Bridge.gh (Grasshopper 1.0.7)

far = Panel("""3
4
5""")
far_option = Slider(2, range=0..2)

# ----
# XIM Standards
# Inputs
data = Data(True)

pt_base_point = Point(<point referenced from the Rhino model>)

# ----
# Ouputs
data_2 = Data(True)

multiplication = Multiplication(A=Slider(3, range=3..10), B="10")
item = ListItem(List=far, Index=far_option, Wrap=True)
int_brige_variarion = Integer(Slider(0, range=0..2))
num_floor_to_have_bridge = Number(multiplication)
num_bridge_width = Number("40")

# ----
# Note
# Previews
note_panel = Panel("")

brep_podium = Brep([<brep referenced from the Rhino model> x29])
base_crv = Curve([<curve referenced from the Rhino model> x29])
crv_bridging = Curve(base_crv)
cluster = Cluster(
    num_far=item,
    pt_attractor=pt_base_point,
    base=crv_bridging,
    num_floor_to_have_bridge=num_floor_to_have_bridge,
    int_brige_variarion=int_brige_variarion,
    num_bridge_width=num_bridge_width)  # -> geo_cap_bridge_2, geo_bridge_building_2, R, geo_13, geo_10, geo_8
geo_bridge_building = Geometry(cluster.geo_bridge_building_2)
srf_bridge = Surface(cluster.R)
merge = Merge(Data1=brep_podium, Data2=geo_bridge_building)
debrep = DeconstructBrep(Brep=merge)  # -> Faces, Edges, Vertices
edges = BrepEdges(Brep=merge)  # -> Naked, Interior, NonManifold

preview = CustomPreview(Geometry=debrep.Faces, Material=ColourSwatch(SwatchColor=RGB(255, 255, 255)))
preview_2 = CustomPreview(Geometry=srf_bridge, Material=ColourSwatch(SwatchColor=RGB(116, 227, 121)))

preview_3 = CustomPreview(Geometry=edges.Interior, Material=ColourSwatch(SwatchColor=RGB(0, 0, 0)))

# ==== cluster Cluster
base = ClusterInput()
far_clusters = Slider(6, range=0..10)

far = Panel("""2
4
6""")
far_option = Slider(2, range=0..2)

num_floor_to_have_bridge = ClusterInput()
item = ListItem(List=far, Index=far_option, Wrap=True)
num_floor_to_have_bridge_2 = Number(num_floor_to_have_bridge)
pt_attractor = ClusterInput()
num_far = ClusterInput()
multiplication = Multiplication(A=num_floor_to_have_bridge_2, B=Slider(5, range=0..10))
Z = UnitZ(Factor=1)
pt_attractor_2 = Point(pt_attractor)
num_far_2 = Number(num_far)
crv_parcels = Curve(base)
area = Area(Geometry=crv_parcels)  # -> Area, Centroid
dist = Distance(PointA=area.Centroid, PointB=pt_attractor_2)
int_clusters = Integer(far_clusters)
sort = SortList(Keys=dist, ValuesA=crv_parcels)  # -> Keys, ValuesA
lng = ListLength(List=sort.ValuesA)
far_variation = Slider(0.5, range=0..1.5)
division = Division(A=lng, B=int_clusters)
round = Round(Number=division)  # -> Nearest, Floor, Ceiling
int_brige_variarion = ClusterInput()
partition = PartitionList(List=sort.ValuesA, Size=round.Ceiling)  # -> simplify(Chunks)
crv_parcels_2 = Curve(partition)
subtraction = Subtraction(A="1", B=far_variation)
addition = Addition(A="1", B=far_variation)
int_clusters_2 = Integer(int_clusters)
dom = ConstructDomain(DomainStart=subtraction, DomainEnd=addition)
num_far_3 = Number(num_far_2)
range = Range(Domain=dom, Steps=expr("x-1", int_clusters_2))
multiplication_2 = Multiplication(A=num_far_3, B=range)

num_far_variation = Number(simplify(multiplication_2))
crv_parcels_3 = Curve(crv_parcels_2)

num_far_variation_2 = Number(simplify(num_far_variation))
floor_to_floor_height = Panel("10")
crv_parcels_4 = Curve(crv_parcels_3)
multiplication_3 = Multiplication(A=floor_to_floor_height, B=num_far_variation_2)
Z_2 = UnitZ(Factor=multiplication_3)
extr = Extrude(Base=crv_parcels_4, Direction=Z_2)
cap = CapHoles(Brep=extr)
brep = Brep(cap)
edges = BrepEdges(Brep=brep)  # -> Naked, Interior, NonManifold
preview = CustomPreview(Geometry=brep, Material=ColourSwatch(SwatchColor=RGB(255, 255, 255)))
preview_2 = CustomPreview(Geometry=edges.Interior, Material=ColourSwatch(SwatchColor=RGB(0, 0, 0)))

multiplication_4 = Multiplication(A=multiplication_3, B=Slider(10, range=0..10))
unit_z = UnitZ(Factor=multiplication_4)
extrude = Extrude(Base=base, Direction=unit_z)
move = Move(Geometry=base, Motion=unit_z)  # -> Geometry, Transform
boundary = BoundarySurfaces(Edges=move.Geometry)
cap_holes = CapHoles(Brep=graft(extrude))
geo_cap_bridge = Geometry(boundary)
geo_cap_bridge_2 = ClusterOutput(geo_cap_bridge)
geo_bridge_building = Geometry(cap_holes)
geo_bridge_building_2 = ClusterOutput(geo_bridge_building)
contour = Contour(Shape=geo_bridge_building, Point=Point(0, 0, 0), Direction=Z, Distance=multiplication)
crv = Curve(flatten(contour))
curvepoint = PointOnCurve(crv, parameter=1)
pt = Point(curvepoint)
pdecon = Deconstruct(Point=pt)  # -> XComponent, YComponent, ZComponent
area_2 = Area(Geometry=contour)  # -> Area, Centroid
crv_2 = Curve(flatten(crv))
crv_3 = Curve(flatten(crv))
equals = Equality(FirstNumber=pdecon.ZComponent, SecondNumber="750")  # -> Equality, Inequality
equals_2 = Equality(FirstNumber=pdecon.ZComponent, SecondNumber="600")  # -> Equality, Inequality
equals_3 = Equality(FirstNumber=pdecon.ZComponent, SecondNumber="300")  # -> Equality, Inequality
dispatch = Dispatch(List=crv_3, DispatchPattern=equals_3.Equality)  # -> ListA, ListB
dispatch_2 = Dispatch(List=crv, DispatchPattern=equals.Equality)  # -> ListA, ListB
dispatch_3 = Dispatch(List=crv_2, DispatchPattern=equals_2.Equality)  # -> ListA, ListB
geo = Geometry(flatten(dispatch.ListA))
geo_2 = Geometry(dispatch_2.ListA)
geo_3 = Geometry(dispatch_3.ListA)
area_3 = Area(Geometry=geo_2)  # -> Area, Centroid
area_4 = Area(Geometry=geo)  # -> Area, Centroid
area_5 = Area(Geometry=geo_3)  # -> Area, Centroid
sort_pt = SortPoints(Points=area_3.Centroid)  # -> Points, Indices
sort_pt_2 = SortPoints(Points=area_4.Centroid)  # -> flatten(Points), Indices
sort_pt_3 = SortPoints(Points=area_5.Centroid)  # -> Points, Indices

pt_2 = Point(sort_pt.Points)
ln = Line(StartPoint=graft(pt_2), EndPoint=simplify(pt_2))
len = Length(Curve=ln)
smaller = SmallerThan(FirstNumber=len, SecondNumber=Slider(603, range=0..1000))  # -> SmallerThan, OrEqualTo
dispatch_4 = Dispatch(List=ln, DispatchPattern=smaller.SmallerThan)  # -> ListA, ListB
crv_4 = Curve(dispatch_4.ListB)
len_2 = Length(Curve=crv_4)
smaller_2 = SmallerThan(FirstNumber=len_2, SecondNumber=Slider(627, range=0..1000))  # -> SmallerThan, OrEqualTo
dispatch_5 = Dispatch(List=crv_4, DispatchPattern=smaller_2.SmallerThan)  # -> ListA, ListB
crv_5 = Curve(dispatch_5.ListA)

pt_3 = Point(sort_pt_3.Points)
ln_2 = Line(StartPoint=graft(pt_3), EndPoint=simplify(pt_3))
len_3 = Length(Curve=ln_2)
smaller_3 = SmallerThan(FirstNumber=len_3, SecondNumber=Slider(360, range=0..1000))  # -> SmallerThan, OrEqualTo
dispatch_6 = Dispatch(List=ln_2, DispatchPattern=smaller_3.SmallerThan)  # -> ListA, ListB
crv_6 = Curve(dispatch_6.ListB)
len_4 = Length(Curve=crv_6)
smaller_4 = SmallerThan(FirstNumber=len_4, SecondNumber=Slider(400, range=0..1000))  # -> SmallerThan, OrEqualTo
dispatch_7 = Dispatch(List=crv_6, DispatchPattern=smaller_4.SmallerThan)  # -> ListA, ListB
crv_7 = Curve(dispatch_7.ListA)

pt_4 = Point(sort_pt_2.Points)
ln_3 = Line(StartPoint=graft(pt_4), EndPoint=simplify(pt_4))
len_5 = Length(Curve=ln_3)
smaller_5 = SmallerThan(FirstNumber=len_5, SecondNumber=Slider(480, range=0..1000))  # -> SmallerThan, OrEqualTo
dispatch_8 = Dispatch(List=ln_3, DispatchPattern=smaller_5.SmallerThan)  # -> ListA, ListB
crv_8 = Curve(dispatch_8.ListB)
len_6 = Length(Curve=crv_8)
smaller_6 = SmallerThan(FirstNumber=len_6, SecondNumber=Slider(500, range=0..1000))  # -> SmallerThan, OrEqualTo
dispatch_9 = Dispatch(List=crv_8, DispatchPattern=smaller_6.SmallerThan)  # -> ListA, ListB
crv_9 = Curve(dispatch_9.ListA)

crv_10 = Curve(flatten(crv_7))
curvepoint_2 = PointOnCurve(crv_10, parameter=0.5)
pt_5 = Point(curvepoint_2)
pdecon_2 = Deconstruct(Point=pt_5)  # -> XComponent, YComponent, ZComponent
larger = LargerThan(FirstNumber=pdecon_2.ZComponent, SecondNumber="150")  # -> LargerThan, OrEqualTo
dispatch_10 = Dispatch(List=crv_10, DispatchPattern=larger.LargerThan)  # -> ListA, ListB
geo_4 = Geometry(dispatch_10.ListA)

num_bridge_width = ClusterInput()

crv_11 = Curve(flatten(crv_5))
curvepoint_3 = PointOnCurve(crv_11, parameter=0.5)
pt_6 = Point(curvepoint_3)
pdecon_3 = Deconstruct(Point=pt_6)  # -> XComponent, YComponent, ZComponent
larger_2 = LargerThan(FirstNumber=pdecon_3.ZComponent, SecondNumber="150")  # -> LargerThan, OrEqualTo
dispatch_11 = Dispatch(List=crv_11, DispatchPattern=larger_2.LargerThan)  # -> ListA, ListB
geo_5 = Geometry(dispatch_11.ListA)

num_bridge_height = Number("300")
division_2 = Division(A=num_bridge_height, B=150)
sqrt = SquareRoot(Value=division_2)

geo_6 = Geometry(graft(crv_9))
num_bridge_width_2 = Number(num_bridge_width)
division_3 = Division(A=num_bridge_width_2, B=sqrt)
offset = OffsetCurve(Curve=geo_6, Distance=division_3, Plane=PlaneXY(0, 0, 0), Corners=1)
offset_2 = OffsetCurve(Curve=geo_6, Distance=expr("-x", division_3), Plane=PlaneXY(0, 0, 0), Corners=1)
rulesrf = RuledSurface(CurveA=offset_2, CurveB=offset)
geo_7 = Geometry(rulesrf)
panel = Panel(geo_7)
geo_8 = ClusterOutput(geo_6)

len_7 = Length(Curve=geo_6)
num_bridge_height_2 = Number("750")

num_bridge_height_3 = Number("600")
division_4 = Division(A=num_bridge_height_3, B=150)
sqrt_2 = SquareRoot(Value=division_4)
geo_9 = Geometry(graft(geo_4))
num_bridge_width_3 = Number(num_bridge_width)
division_5 = Division(A=num_bridge_width_3, B=sqrt_2)
geo_10 = ClusterOutput(geo_9)
offset_3 = OffsetCurve(Curve=geo_9, Distance=division_5, Plane=PlaneXY(0, 0, 0), Corners=1)
offset_4 = OffsetCurve(Curve=geo_9, Distance=expr("-x", division_5), Plane=PlaneXY(0, 0, 0), Corners=1)
rulesrf_2 = RuledSurface(CurveA=offset_4, CurveB=offset_3)
geo_11 = Geometry(rulesrf_2)

panel_2 = Panel(offset_2)
division_6 = Division(A=num_bridge_height_2, B=150)
sqrt_3 = SquareRoot(Value=division_6)

geo_12 = Geometry(graft(geo_5))
num_bridge_width_4 = Number(num_bridge_width)
division_7 = Division(A=num_bridge_width_4, B=sqrt_3)
geo_13 = ClusterOutput(geo_12)
offset_5 = OffsetCurve(Curve=geo_12, Distance=division_7, Plane=PlaneXY(0, 0, 0), Corners=1)
offset_6 = OffsetCurve(Curve=geo_12, Distance=expr("-x", division_7), Plane=PlaneXY(0, 0, 0), Corners=1)
rulesrf_3 = RuledSurface(CurveA=offset_6, CurveB=offset_5)
geo_14 = Geometry(rulesrf_3)
viewer = ParamViewer(geo_14)

brep_2 = ClusterInput()
brep_3 = Brep(flatten([geo_bridge_building, brep_2]))
geo_15 = Geometry([geo_7, geo_14, geo_11])
trim = TrimSolid(Shape=geo_15, Cutters=brep_3)
R = ClusterOutput(trim)
