# Grasshopper definition ROW_HOUSE.gh (Grasshopper 1.0.7)

crv_parcels = Curve([<curve referenced from the Rhino model> x78])
crv_streets = Curve([<curve referenced from the Rhino model> x64])
curvepoint = PointOnCurve(crv_parcels, parameter=0)
scale = Scale(Geometry=crv_parcels, Center=curvepoint, Factor=".7")  # -> Geometry, Transform
merge = Merge()
crv_building_footprint = Curve(graft(scale.Geometry))
crv_parcels_2 = Curve(graft(crv_parcels))
explode = Explode(Curve=crv_building_footprint, Recursive=True)  # -> Segments, Vertices
explode_2 = Explode(Curve=crv_parcels_2, Recursive=True)  # -> Segments, Vertices
pcen = PolygonCenter(Polyline=explode_2.Segments)  # -> CenterV, CenterE, CenterA
pcen_2 = PolygonCenter(Polyline=explode.Segments)  # -> CenterV, CenterE, CenterA
pull = PullPoint(Point=pcen.CenterV, Geometry=crv_streets, ClosestOnly=True)  # -> ClosestPoint, Distance
sort = SortList(Keys=pull.Distance, ValuesA=pcen_2.CenterV)  # -> Keys, ValuesA
sort_2 = SortList(Keys=pull.Distance, ValuesA=pcen.CenterV)  # -> Keys, ValuesA
item = ListItem(List=sort_2.ValuesA, Index=0, Wrap=True)
item_2 = ListItem(List=sort.ValuesA, Index=0, Wrap=True)
crv_building_footprint_2 = Curve(graft(crv_building_footprint))
ln = Line(StartPoint=item_2, EndPoint=item)
move = Move(Geometry=crv_building_footprint_2, Motion=ln)  # -> Geometry, Transform
Z = UnitZ(Factor="80")
extr = Extrude(Base=move.Geometry, Direction=Z)
cap = CapHoles(Brep=extr)
merge_2 = Merge(Data1=cap, Data2=extr)
brep = Brep(merge_2)
