# Grasshopper definition Universal NYC.gh (Grasshopper 1.0.7)
# plug-ins: Human

# ----
# Inputs
inputs_panel = Panel("")
# XIM Standards
# Notes: Panels can (but do not have to) be 50% saturation to avoid overwhelming in text
data = Data(True)

podium_markethall_height = Slider(40, range=0..100)
node_offset = Slider(30, range=0..100)
far_option = Slider(2, range=0..4)
street_option = Slider(1, range=0..3)

# ----
# Ouputs
data_2 = Data(True)

# ----
# Intermediate
data_3 = Data(True)

# ----
# Note
note_panel = Panel("")

cluster = Cluster_6(
    int_street_option=street_option,
    int_offset=node_offset,
    A=far_option,
    A_2=podium_markethall_height,
    A_3=podium_markethall_height,
    num_podium_height=podium_markethall_height)  # -> i, crv_streets, L, geo_streets, crv_core, podium_public_open_space, A_4, market_public_open_space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
view_range = ViewRange(C=cluster.G, obstacles=[cluster.geo_2, cluster.node_crv_big_2], O=cluster.i)  # -> C_2, R, am, G; disabled
average_vision_coverage = Panel(view_range.am)  # disabled
previewlw = CustomPreviewLineweights(Geometry=view_range.G, Shader=view_range.C_2, Thickness=view_range.R, Absolute=False)  # disabled

open_space_area = Panel([cluster.L, cluster.A_4])
the_number_of_nodes = Panel(cluster.L)
srf = Surface(cluster.node)
gfa = Panel(cluster.R)
preview = CustomPreview(
    Geometry=flatten([cluster.podium_public_open_space, cluster.market_public_open_space]),
    Material=ColourSwatch(SwatchColor=RGB(0, 255, 38)))
preview_2 = CustomPreview(Geometry=cluster.geo_4, Material=ColourSwatch(SwatchColor=RGBA(0, 0, 0, 0)))
preview_3 = CustomPreview(Geometry=srf, Shader=ColourSwatch(SwatchColor=RGB(184, 94, 94)))
preview_4 = CustomPreview(Geometry=cluster.podium, Material=ColourSwatch(SwatchColor=RGBA(133, 133, 133, 171)))
preview_5 = CustomPreview(Geometry=cluster.S, Material=ColourSwatch(SwatchColor=RGBA(0, 0, 0, 68)))
preview_6 = CustomPreview(Geometry=cluster.tower, Material=ColourSwatch(SwatchColor=RGBA(255, 255, 255, 195)))
preview_7 = CustomPreview(Geometry=cluster.market_hall, Material=ColourSwatch(SwatchColor=RGBA(0, 0, 0, 116)))
preview_8 = CustomPreview(Geometry=cluster.S_2, Material=ColourSwatch(SwatchColor=RGB(0, 0, 0)))
preview_9 = CustomPreview(Geometry=cluster.en, Material=ColourSwatch(SwatchColor=RGBA(0, 0, 0, 221)))
preview_10 = CustomPreview(Geometry=cluster.B, Material=ColourSwatch(SwatchColor=RGB(0, 0, 0)))

# ==== cluster Cluster_6
num_podium_height = ClusterInput()
int_street_option = ClusterInput()
int_offset = ClusterInput()
A = ClusterInput()
A_2 = ClusterInput()
A_3 = ClusterInput()
int_market_hall_parcel_width = Slider(40, range=0..100)
bridge_width = Slider(20, range=0..100)
markethall_corridor = Slider(20, range=0..100)
floor_to_floor_height = Slider(11, range=0..100)
crv_public_space = Curve([<curve referenced from the Rhino model> x3])
mesh_context = Mesh(<mesh referenced from the Rhino model>)
crv_mega_block = Curve(<curve referenced from the Rhino model>)

crv1_bike = Curve([<curve referenced from the Rhino model> x4])
crv4_bike = Curve([<curve referenced from the Rhino model> x4])
crv3_bike = Curve([<curve referenced from the Rhino model> x4])
crv1_car = Curve([<curve referenced from the Rhino model> x2])
crv2_bike = Curve([<curve referenced from the Rhino model> x5])
crv4_car = Curve()
crv3_car = Curve(<curve referenced from the Rhino model>)
crv2_car = Curve(<curve referenced from the Rhino model>)

floor_to_floor_height_2 = Number(floor_to_floor_height)
num_podium_height_2 = Number(num_podium_height)
multiplication = Multiplication(A=A, B=Slider(3, range=0..10))
cluster = Cluster_5(
    int_street_option=int_street_option,
    C=crv_mega_block,
    crv_streets_1=[crv1_car, crv1_bike],
    crv_streets_2=[crv2_car, crv2_bike],
    crv_streets_3=[crv3_car, crv3_bike],
    crv_streets_4=[crv4_car, crv4_bike],
    N="10",
    B="10")  # -> int_street_width_2, crv_filter_3
cluster_2 = Cluster_4(
    crv_mega_block=crv_mega_block,
    crv_streets=cluster.crv_filter_3,
    int_street_width=cluster.int_street_width_2,
    F_2=num_podium_height_2,
    num_podium_height=num_podium_height_2,
    int_podium_height=num_podium_height_2,
    floor_to_floor_height=floor_to_floor_height_2,
    int_offset=int_offset,
    floor_to_floor_height_2=floor_to_floor_height_2,
    A_3=A_2,
    int_far=multiplication,
    A=markethall_corridor,
    A_2=A_3,
    F=num_podium_height_2,
    int_market_hall_parcel_width=int_market_hall_parcel_width,
    A_4=bridge_width)  # -> i, crv_streets_2, L, geo_streets, B, crv_core, podium_public_open_space, A_6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
geo = Geometry(cluster_2.market_hall)
i = ClusterOutput(cluster_2.i)
crv_streets = ClusterOutput(cluster_2.crv_streets_2)
L = ClusterOutput(cluster_2.L)
geo_streets = ClusterOutput(cluster_2.geo_streets)
crv_core = ClusterOutput(cluster_2.crv_core)
podium_public_open_space = ClusterOutput(cluster_2.podium_public_open_space)
A_4 = ClusterOutput(cluster_2.A_6)
market_public_open_space = ClusterOutput(cluster_2.market_public_open_space)
crv_podium = ClusterOutput(cluster_2.crv_podium)
G = ClusterOutput(cluster_2.G)
geo_2 = ClusterOutput(cluster_2.crv_podium_parcels_deleted)
B = ClusterOutput(cluster_2.B)
node = ClusterOutput(cluster_2.node)
podium = ClusterOutput(cluster_2.podium)
geo_3 = ClusterOutput(cluster_2.geo_4)
en = ClusterOutput(cluster_2.en)
R = ClusterOutput(cluster_2.R)
geo_4 = ClusterOutput(cluster_2.geo_2)
floor_to_floor_height_3 = ClusterOutput(floor_to_floor_height_2)
market_hall = ClusterOutput(cluster_2.market_hall)
geo_5 = ClusterOutput(cluster_2.geo_3)
pl = ClusterOutput(cluster_2.pl)
A_5 = ClusterOutput(cluster_2.A_5)
S = ClusterOutput(cluster_2.S_2)
crv_public_space_2 = ClusterOutput(crv_public_space)
mesh_context_2 = ClusterOutput(mesh_context)
S_2 = ClusterOutput(cluster_2.S)
tower = ClusterOutput(cluster_2.tower)
node_crv_big = Geometry(cluster_2.node_crv)
node_crv_big_2 = ClusterOutput(node_crv_big)

# ==== cluster ViewRange
obstacles = ClusterInput()
O = ClusterInput()
C = ClusterInput()
obstacles_2 = Geometry(obstacles)
explode = Explode(Curve=C, Recursive=True)  # -> flatten(Segments), Vertices
obstacles_3 = Geometry(flatten(obstacles_2))
end = EndPoints(Curve=explode.Segments)  # -> Start, End
geo = Geometry([end.Start, end.End])
pt_corner_points = Geometry(geo)

number_slider = Slider(30, range=0..100)
explode_2 = Explode(Curve=obstacles_3, Recursive=True)  # -> flatten(Segments), Vertices
toggle = BooleanToggle(True)
isovist = Isovist(
    VantagePointS=pt_corner_points,
    ObstacleLines=explode_2.Segments,
    ViewingDirection=Vector(989288.2615, 216460.5795, 58.83007825),
    ViewingRange=number_slider,
    ViewingAngle=360,
    Precision=360,
    ShowPolygon=True,
    ShowRadials=False,
    UseGPU=False)  # -> IsovistPolygon, Radials, ObstacleVisibility, IsovistProperties
xy = XYPlane(Origin=O)
project = Project(Geometry=isovist.IsovistPolygon, Plane=xy)  # -> Geometry, Transform
circle = CircleCNR(Center=pt_corner_points, Normal=Vector(0, 0, 1), Radius=number_slider)
geo_2 = Geometry(project.Geometry)
area = Area(Geometry=circle)  # -> Area, Centroid
area_2 = Area(Geometry=geo_2)  # -> Area, Centroid
bnd = Bounds(Numbers=area_2.Area)
remap = RemapNumbers(Value=area_2.Area, Source=bnd, Target=Domain(0, 1))  # -> Mapped, Clipped
division = Division(A=area_2.Area, B=area.Area)
neg = Negative(Value=remap.Mapped)
avr = Average(Input=division)
bnd_2 = Bounds(Numbers=division)
Z = UnitZ(Factor=neg)
division_2 = Division(A=Z, B=1000)
multiplication = Multiplication(A=Z, B=5)
remap_2 = RemapNumbers(Value=division, Source=bnd_2, Target="0 to 100")  # -> Mapped, Clipped
gradient = Gradient(
    LowerLimit="60",
    UpperLimit="100",
    Parameter=remap_2.Mapped,
    stops=[0: RGB(234, 38, 0), 0.25: RGB(234, 126, 0), 0.5: RGB(254, 244, 84), 0.75: RGB(173, 203, 249), 1: RGB(75, 107, 169)])
move = Move(Geometry=geo_2, Motion=multiplication)  # -> Geometry, Transform

C_2 = ClusterOutput(gradient)
R = ClusterOutput(remap_2.Mapped)
am = ClusterOutput(avr)
G = ClusterOutput(move.Geometry)

# ==== cluster Cluster_4
A = ClusterInput()
A_2 = ClusterInput()
F = ClusterInput()
int_market_hall_parcel_width = ClusterInput()
F_2 = ClusterInput()
num_podium_height = ClusterInput()
int_podium_height = ClusterInput()
floor_to_floor_height = ClusterInput()
int_offset = ClusterInput()
floor_to_floor_height_2 = ClusterInput()
A_3 = ClusterInput()
int_far = ClusterInput()
A_4 = ClusterInput()
crv_mega_block = ClusterInput()
crv_streets = ClusterInput()
int_street_width = ClusterInput()
cluster = Cluster(crv_mega_block=crv_mega_block, crv_streets=crv_streets, int_street_width=int_street_width)  # -> i, crv_mega_block_3, crv_markethall_2, crv_podium_2, crv_streets_3, node_2, L, geo_streets_2
cluster_2 = Cluster_2(
    crv_markethall=cluster.crv_markethall_2,
    O=cluster.i,
    int_market_hall_parcel_width=int_market_hall_parcel_width,
    A_2=A,
    A_3=A_2,
    F=F)  # -> public_open_space_3, pl, A, market_hall_2, R, S
cluster_3 = Cluster_3(
    crv_podium=cluster.crv_podium_2,
    F=F_2,
    market_public_open_space=cluster_2.public_open_space_3,
    node=cluster.node_2,
    O=cluster.i,
    int_offset_7=cluster_2.R,
    num_podium_height=num_podium_height,
    int_offset_2=int_offset,
    int_podium_height=int_podium_height,
    floor_to_floor_height_3=floor_to_floor_height,
    crv_markethall=cluster.crv_markethall_2,
    crv_mega_block=cluster.crv_mega_block_3,
    floor_to_floor_height=floor_to_floor_height_2,
    A=A_3,
    int_far=int_far)  # -> S, podium_public_open_space_2, crv_core_2, A_2, market_public_open_space_3, crv_podium_5, node_3, G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
bridge = Bridge(G=cluster_3.S, G_2=cluster_3.S, A=A_4)
S = ClusterOutput(bridge)
geo = Geometry(cluster_3.node_crv_2)
i = ClusterOutput(cluster.i)
crv_streets_2 = ClusterOutput(cluster.crv_streets_3)
L = ClusterOutput(cluster.L)
geo_streets = ClusterOutput(cluster.geo_streets_2)
crv_podium_parcels_deleted = ClusterOutput(cluster_3.crv_podium_parcels_deleted_2)
pl = ClusterOutput(cluster_2.pl)
A_5 = ClusterOutput(cluster_2.A)
S_2 = ClusterOutput(cluster_2.S)
market_hall = ClusterOutput(cluster_2.market_hall_2)
crv_core = ClusterOutput(cluster_3.crv_core_2)
podium_public_open_space = ClusterOutput(cluster_3.podium_public_open_space_2)
A_6 = ClusterOutput(cluster_3.A_2)
market_public_open_space = ClusterOutput(cluster_3.market_public_open_space_3)
crv_podium = ClusterOutput(cluster_3.crv_podium_5)
G = ClusterOutput(cluster_3.G)
node = ClusterOutput(cluster_3.node_3)
podium = ClusterOutput(cluster_3.podium_2)
en = ClusterOutput(cluster_3.en)
R = ClusterOutput(cluster_3.R)
geo_2 = ClusterOutput(cluster_3.geo_18)
geo_3 = ClusterOutput(cluster_3.geo_17)
tower = ClusterOutput(cluster_3.tower_2)
B = ClusterOutput(cluster_3.B)
geo_4 = ClusterOutput(cluster_3.geo_9)
node_crv = ClusterOutput(cluster_3.node_crv_2)

# ==== cluster Cluster_5
int_street_option = ClusterInput()
C = ClusterInput()
explode = Explode(Curve=C, Recursive=True)  # -> flatten(Segments), Vertices
int_street_option_2 = Integer(int_street_option)
crv_streets_3 = ClusterInput()
crv_streets_4 = ClusterInput()
crv_streets_2 = ClusterInput()
crv_streets_1 = ClusterInput()
crv_streets_1_2 = Curve(flatten([explode.Segments, crv_streets_1]))
crv_streets_2_2 = Curve(flatten([explode.Segments, crv_streets_2]))
crv_streets_3_2 = Curve(flatten([explode.Segments, crv_streets_3]))
crv_streets_4_2 = Curve(flatten([explode.Segments, crv_streets_4]))

crv_streets_1_3 = Curve(crv_streets_1_2)
crv_streets_2_3 = Curve(crv_streets_2_2)
crv_streets_3_3 = Curve(crv_streets_3_2)
crv_streets_4_3 = Curve(crv_streets_4_2)

int_street_option_3 = Integer(int_street_option_2)

len = Length(Curve=crv_streets_3_3)
division = Division(A=len, B="20")
max = Maximum(A=division, B="10")
reb = RebuildCurve(Curve=crv_streets_3_3, Degree="1", Count="10", Tangents=False)

B = ClusterInput()
N = ClusterInput()

len_2 = Length(Curve=crv_streets_4_3)
division_2 = Division(A=len_2, B="20")
max_2 = Maximum(A=division_2, B=B)
reb_2 = RebuildCurve(Curve=crv_streets_4_3, Degree="1", Count=N, Tangents=False)

filter = StreamFilter(Gate=int_street_option_3, Stream0=crv_streets_1_3, Stream1=crv_streets_2_3, Stream2=reb, Stream3=reb_2)
crv_filter = Curve(filter)
streets_4_width = Panel("""30
30
30
30
15""")
streets_3_width = Panel("""30
30
30
30
30
15""")
streets_1_width = Panel("""30
30
30
30
30
30
15""")
filter_2 = StreamFilter(
    Gate=int_street_option_3,
    Stream0=streets_1_width,
    Stream1=streets_1_width,
    Stream2=streets_3_width,
    Stream3=streets_4_width)
int_street_width = Integer(filter_2)
crv_filter_2 = Curve(crv_filter)
crv_filter_3 = ClusterOutput(crv_filter_2)
int_street_width_2 = ClusterOutput(int_street_width)

# ==== cluster Bridge
A = ClusterInput()
G = ClusterInput()
G_2 = ClusterInput()

# ---- group: Bridge
division = Division(A=A, B=2)
area = Area(Geometry=G)  # -> Area, Centroid
area_2 = Area(Geometry=G_2)  # -> Area, Centroid
ln = Line(StartPoint=graft(area.Centroid), EndPoint=area_2.Centroid)
len = Length(Curve=ln)
sort = SortList(Keys=len, ValuesA=ln)  # -> Keys, ValuesA
item = ListItem(List=sort.ValuesA, Index=1, Wrap=True)
item_2 = ListItem(List=sort.ValuesA, Index=2, Wrap=True)
geo = Geometry([item, item_2])
neg = Negative(Value=division)
offset = OffsetCurve(Curve=geo, Distance=neg, Plane=PlaneXY(0, 0, 0), Corners=1)
offset_2 = OffsetCurve(Curve=geo, Distance=division, Plane=PlaneXY(0, 0, 0), Corners=1)
end = EndPoints(Curve=offset_2)  # -> Start, End
end_2 = EndPoints(Curve=offset)  # -> Start, End
ln_2 = Line(StartPoint=end.Start, EndPoint=end_2.Start)
ln_3 = Line(StartPoint=end.End, EndPoint=end_2.End)
geo_2 = Geometry([offset_2, ln_2, ln_3, offset])
join = JoinCurves(Curves=geo_2, Preserve=False)
boundary = BoundarySurfaces(Edges=join)

# ----
S = ClusterOutput(boundary)

# ==== cluster Cluster
crv_streets = ClusterInput()
crv_mega_block = ClusterInput()
crv_streets_2 = Curve(simplify(graft(crv_streets)))
# BLOCKS & PARCELS
crv_mega_block_2 = Curve(crv_mega_block)
crv_streets_3 = ClusterOutput(crv_streets_2)
crv_mega_block_3 = ClusterOutput(crv_mega_block_2)
ext = ExtendCurve(Curve=crv_streets_2, Type=0, Start="100", End="100")
int_street_width = ClusterInput()

# ---- group: Create subtraction curves
int_street_width_2 = Integer(simplify(graft(int_street_width)))
neg = Negative(Value=int_street_width_2)
merge = Merge(Data1=int_street_width_2, Data2=neg)
offset = Offset(Curve=ext, Distance=merge, Plane=PlaneXY(0, 0, 0), Corners=1)
trim = TrimTree(Tree=offset, Depth=1)
end = EndPoints(Curve=trim)  # -> Start, End
item = ListItem(List=end.End, Index=0, Wrap=True)  # -> Item, Item1
item_2 = ListItem(List=end.Start, Index=0, Wrap=True)  # -> Item, Item1
ln = Line(StartPoint=item.Item, EndPoint=item.Item1)
ln_2 = Line(StartPoint=item_2.Item, EndPoint=item_2.Item1)
merge_2 = Merge(Data1=trim, Data2=ln_2, Data3=ln)
join = JoinCurves(Curves=merge_2, Preserve=False)  # -> flatten(Curves)

# ---- group: Pt: Intersection
crv_mega_block_4 = Curve(crv_mega_block_2)
crv_streets_4 = Curve(ext)
crossref = CrossReference(ListA=flatten(crv_streets_4), ListB=flatten(crv_streets_4), CrossMode=1)  # -> graft(ListA), graft(ListB)
ccx = CurveCurve(CurveA=flatten(crv_streets_4), CurveB=crv_mega_block_4)  # -> Points, ParamsA, ParamsB
ccx_2 = CurveCurve(CurveA=crossref.ListA, CurveB=crossref.ListB)  # -> Points, ParamsA, ParamsB
cullpt = CullDuplicates(Points=ccx_2.Points, Tolerance=0.1, CullMode=3)  # -> Points, Indices, Valence
incurve = PointInCurve(Point=cullpt.Points, Curve=crv_mega_block_4)  # -> Relationship, Point
dispatch = Dispatch(List=cullpt.Points, DispatchPattern=incurve.Relationship)  # -> ListA, ListB
geo = Geometry(flatten([dispatch.ListA, ccx.Points]))

# ----
pshift = ShiftPaths(Data=offset, Offset=-1)
panel = Panel(pshift)
crv_mega_block_5 = Curve(crv_mega_block_2)

runion = RegionUnion(Curves=join)
crv_mega_block_6 = Curve(crv_mega_block_5)
boundary = BoundarySurfaces(Edges=runion)
srfsplit = SurfaceSplit(Surface=boundary, Curves=crv_mega_block_6)
edges = BrepEdges(Brep=srfsplit)  # -> Naked, Interior, NonManifold
join_2 = JoinCurves(Curves=edges.Naked, Preserve=False)
lng = ListLength(List=join_2)  # -> flatten(Length)
sort = SortList(Keys=lng, ValuesA=srfsplit)  # -> Keys, ValuesA
item_3 = ListItem(List=sort.ValuesA, Index=1, Wrap=True)

explode = Explode(Curve=crv_mega_block_5, Recursive=True)  # -> Segments, Vertices

# ---- group: Create Blocks
srfsplit_2 = SurfaceSplit(Surface=crv_mega_block_5, Curves=join)
area = Area(Geometry=srfsplit_2)  # -> Area, Centroid
incurves = PointInCurves(Point=area.Centroid, Curves=join)  # -> Relationship, Index, Point
dispatch_2 = Dispatch(List=srfsplit_2, DispatchPattern=incurves.Relationship)  # -> ListA, ListB
crv_blocks = Curve(dispatch_2.ListB)

# ----
srfsplit_3 = SurfaceSplit(Surface=crv_mega_block_5, Curves=join)
edges_2 = BrepEdges(Brep=graft(srfsplit_3))  # -> Naked, Interior, NonManifold
join_3 = JoinCurves(Curves=edges_2.Naked, Preserve=False)  # -> flatten(Curves)
geo_2 = Geometry(join_3)
incurve_2 = PointInCurve(Point=graft(geo), Curve=geo_2)  # -> Relationship, Point
dispatch_3 = Dispatch(List=geo_2, DispatchPattern=incurve_2.Relationship)  # -> ListA, ListB
node = Geometry(dispatch_3.ListA)

geo_streets = Geometry(item_3)
item_4 = ListItem(List=explode.Vertices, Index=0, Wrap=True)
geo_streets_2 = ClusterOutput(geo_streets)
i = ClusterOutput(item_4)
node_2 = ClusterOutput(node)

crv_mega_block_7 = Curve(crv_mega_block_2)
area_2 = Area(Geometry=crv_blocks)  # -> Area, Centroid
lng_2 = ListLength(List=crv_blocks)
division = Division(A=lng_2, B=4)
crv_cp = CurveClosestPoint(Point=area_2.Centroid, Curve=crv_mega_block_7)  # -> Point, Parameter, Distance
round = Round(Number=division)  # -> Nearest, Floor, Ceiling
ln_3 = Line(StartPoint=crv_cp.Point, EndPoint=area_2.Centroid)
subtraction = Subtraction(A=round.Ceiling, B=1)
len = Length(Curve=ln_3)
sort_2 = SortList(Keys=len, ValuesA=crv_blocks)  # -> Keys, ValuesA
split = SplitList(List=sort_2.ValuesA, Index=subtraction)  # -> ListA, ListB

ma = MassAddition(Input=area_2.Area)  # -> Result, PartialResults
division_2 = Division(A=ma.Result, B=lng_2)
division_3 = Division(A=division_2, B=Slider(1, range=0..10))
smaller = SmallerThan(FirstNumber=area_2.Area, SecondNumber=division_3)  # -> SmallerThan, OrEqualTo
dispatch_4 = Dispatch(List=crv_blocks, DispatchPattern=smaller.SmallerThan)  # -> ListA, ListB

explode_2 = Explode(Curve=node, Recursive=True)  # -> Segments, Vertices
cullduplines = RemoveDuplicateLines(InputLines=flatten(explode_2.Segments), Tolerance=0.001)  # -> OutputLines, FirstLineIndexes
join_4 = JoinCurves(Curves=cullduplines.OutputLines, Preserve=False)
lng_3 = ListLength(List=join_4)

L = ClusterOutput(lng_3)
crv_markethall = Geometry(dispatch_4.ListA)
crv_podium = Geometry(dispatch_4.ListB)
crv_podium_2 = ClusterOutput(crv_podium)
crv_markethall_2 = ClusterOutput(crv_markethall)

# ==== cluster Cluster_2
int_market_hall_parcel_width = ClusterInput()
crv_markethall = ClusterInput()
int_market_hall_parcel_width_2 = Integer(int_market_hall_parcel_width)
crv_markethall_2 = Geometry(crv_markethall)

Z = UnitZ(Factor=Slider(40, range=0..100))
move = Move(Geometry=crv_markethall_2, Motion=Z)  # -> Geometry, Transform
extr = Extrude(Base=crv_markethall_2, Direction=Z)
cap = CapHoles(Brep=extr)
boundary = BoundarySurfaces(Edges=move.Geometry)
edges = BrepEdges(Brep=cap)  # -> Naked, Interior, NonManifold
geo = Geometry(flatten([boundary, edges.Naked]))

O = ClusterInput()

# ---- group: Create Parcels
disc = Discontinuity(Curve=crv_markethall_2, Level=1)  # -> Points, Parameters
int_parcel_width = Integer(int_market_hall_parcel_width_2)
pline = PolyLine(Vertices=disc.Points, Closed=True)
parcels = Parcels(Polygons=pline, ConnectionDistance=1, StreetOffset=0, PlotWidthThreshold=int_parcel_width, Precision=100)  # -> flatten(Parcels)
xy = XYPlane(Origin=O)
project = Project(Geometry=parcels, Plane=xy)  # -> Geometry, Transform
crv_parcels = Curve(project.Geometry)
area = Area(Geometry=crv_parcels)  # -> Area, Centroid
larger = LargerThan(FirstNumber=area.Area, SecondNumber=0)  # -> LargerThan, OrEqualTo
dispatch = Dispatch(List=crv_parcels, DispatchPattern=larger.OrEqualTo)  # -> ListA, ListB

# ----
pl = ClusterOutput(pline)
A = ClusterOutput(dispatch.ListA)
A_2 = ClusterInput()
division = Division(A=A_2, B=2)

geo_2 = Geometry(dispatch.ListA)
area_2 = Area(Geometry=simplify(geo_2))  # -> Area, Centroid
avr = Average(Input=flatten(area_2.Area))
panel = Panel(avr)
division_2 = Division(A=panel, B=3)
smaller = SmallerThan(FirstNumber=area_2.Area, SecondNumber=division_2)  # -> SmallerThan, OrEqualTo
dispatch_2 = Dispatch(List=geo_2, DispatchPattern=smaller.SmallerThan)  # -> ListA, ListB
podium_block = Geometry(dispatch_2.ListB)
public_open_space = Geometry(dispatch_2.ListA)

R = ClusterOutput(division)
boundary_2 = BoundarySurfaces(Edges=flatten(public_open_space))
A_3 = ClusterInput()
division_3 = Division(A=A_3, B=3)
public_open_space_2 = Geometry(boundary_2)
F = ClusterInput()
Z_2 = UnitZ(Factor=division_3)
crv_markethall_3 = Geometry(crv_markethall_2)
Z_3 = UnitZ(Factor=F)
public_open_space_3 = ClusterOutput(public_open_space_2)
move_2 = Move(Geometry=crv_markethall_3, Motion=Z_3)  # -> Geometry, Transform
boundary_3 = BoundarySurfaces(Edges=move_2.Geometry)
S = ClusterOutput(boundary_3)
edges_2 = BrepEdges(Brep=boundary_3)  # -> Naked, Interior, NonManifold

crv_market = Curve(simplify(graft(podium_block)))
int_offset = Integer(division)
int_offset_2 = Integer(int_offset)

offset = OffsetCurve(Curve=crv_market, Distance=int_offset, Plane=PlaneXY(0, 0, 0), Corners=1)

curvepoint = PointOnCurve(offset, parameter=0.549)
incurve = PointInCurve(Point=curvepoint, Curve=crv_market)  # -> Relationship, Point
dispatch_3 = Dispatch(List=crv_market, DispatchPattern=incurve.Relationship)  # -> ListA, ListB
flip = FlipCurve(Curve=dispatch_3.ListB)  # -> Curve, Flag
merge = Merge(Data1=dispatch_3.ListA, Data2=flip.Curve)

offset_2 = OffsetCurve(Curve=merge, Distance=int_offset, Plane=PlaneXY(0, 0, 0), Corners=1)

geo_3 = Geometry(offset_2)

extr_2 = Extrude(Base=geo_3, Direction=Z_2)
cap_2 = CapHoles(Brep=extr_2)
market_hall = Geometry([boundary_3, cap_2])
market_hall_2 = ClusterOutput(market_hall)

# ==== cluster Cluster_3
node = ClusterInput()
crv_podium = ClusterInput()
node_2 = Geometry(node)
crv_podium_2 = Geometry(crv_podium)
node_3 = ClusterOutput(node_2)
int_offset = Integer(Slider(20, range=0..100))
join = JoinCurves(Curves=flatten(node_2), Preserve=False)
F = ClusterInput()
int_offset_2 = ClusterInput()

Z = UnitZ(Factor=F)
move = Move(Geometry=crv_podium_2, Motion=Z)  # -> Geometry, Transform
extr = Extrude(Base=crv_podium_2, Direction=Z)
boundary = BoundarySurfaces(Edges=move.Geometry)
cap = CapHoles(Brep=extr)

crv_node = Curve(simplify(graft(node_2)))
int_offset_3 = Integer(int_offset_2)
offset_l = OffsetCurveLoose(Curve=crv_node, Distance=int_offset_3)
curvepoint = PointOnCurve(offset_l, parameter=0.543)
incurve = PointInCurve(Point=curvepoint, Curve=crv_node)  # -> Relationship, Point
dispatch = Dispatch(List=crv_node, DispatchPattern=incurve.Relationship)  # -> ListA, ListB
flip = FlipCurve(Curve=dispatch.ListA)  # -> Curve, Flag
merge = Merge(Data1=dispatch.ListB, Data2=flip.Curve)
int_offset_4 = Integer(int_offset_3)
offset_l_2 = OffsetCurveLoose(Curve=merge, Distance=int_offset_4)
geo = Geometry(flatten(offset_l_2))

int_offset_5 = Integer(int_offset)
crv_podium_3 = Curve(simplify(graft(move.Geometry)))
offset = OffsetCurve(Curve=crv_podium_3, Distance=int_offset_5, Plane=PlaneXY(0, 0, 0), Corners=1)  # -> simplify(Curve)
curvepoint_2 = PointOnCurve(offset, parameter=0.543)
incurve_2 = PointInCurve(Point=curvepoint_2, Curve=crv_podium_3)  # -> Relationship, Point
dispatch_2 = Dispatch(List=crv_podium_3, DispatchPattern=incurve_2.Relationship)  # -> ListA, ListB
flip_2 = FlipCurve(Curve=dispatch_2.ListB)  # -> Curve, Flag
merge_2 = Merge(Data1=dispatch_2.ListA, Data2=flip_2.Curve)
int_offset_6 = Integer(int_offset_5)
offset_2 = OffsetCurve(Curve=merge_2, Distance=int_offset_6, Plane=PlaneXY(0, 0, 0), Corners=1)
geo_2 = Geometry(offset_2)

S = ClusterOutput(boundary)
int_podium_height = ClusterInput()
floor_to_floor_height = ClusterInput()
int_far = ClusterInput()
int_podium_height_2 = Integer(int_podium_height)
floor_to_floor_height_2 = Number(floor_to_floor_height)
int_far_2 = Integer(int_far)
floor_to_floor_height_3 = ClusterInput()
number_slider = Slider(200, range=0..1000)
floor_to_floor_height_4 = Number(floor_to_floor_height_3)
number_slider_2 = Slider(0, range=0..100)
multiplication = Multiplication(A=floor_to_floor_height_4, B=Slider(100, range=0..100))
average_sun_vector = Vector(Vector(-0.002278690398, 0.5247548885, -0.3666307175))
pt = ConstructPoint(XCoordinate=number_slider_2, YCoordinate=number_slider_2, ZCoordinate=number_slider_2)
sqrt = SquareRoot(Value=Slider(2, range=0..10))
multiplication_2 = Multiplication(A=sqrt, B=3)
vec2pt = Vector2Pt(PointA=pt, PointB=average_sun_vector, Unitize=False)  # -> Vector, Length
division = Division(A=multiplication, B=multiplication_2)
panel = Panel(division)
devec = DeconstructVector(Vector=vec2pt.Vector)  # -> XComponent, YComponent, ZComponent
ln = Line(StartPoint=pt, EndPoint=average_sun_vector)
X = UnitX(Factor=division)
neg = Negative(Value=division)
division_2 = Division(A=devec.YComponent, B=devec.XComponent)
multiplication_3 = Multiplication(A=panel, B=division_2)
pdecon = Deconstruct(Point=average_sun_vector)  # -> XComponent, YComponent, ZComponent
move_2 = Move(Geometry=geo, Motion=X)  # -> Geometry, Transform
multiplication_4 = Multiplication(A=neg, B=1.5)
Y = UnitY(Factor=multiplication_4)
amp = Amplitude(Vector=X, Amplitude=division_2)
panel_2 = Panel(division)
panel_3 = Panel(devec.YComponent)
move_3 = Move(Geometry=move_2.Geometry, Motion=Y)  # -> Geometry, Transform
Z_2 = UnitZ(Factor=multiplication)
addition = Addition(A=multiplication, B=int_podium_height_2)
multiplication_5 = Multiplication(A=addition, B=Slider(1.5, range=0..10))
extr_2 = Extrude(Base=geo_2, Direction=Z_2)
Z_3 = UnitZ(Factor=addition)
cap_2 = CapHoles(Brep=extr_2)
move_4 = Move(Geometry=move_3.Geometry, Motion=Z_3)  # -> Geometry, Transform
number_slider_3 = Slider(0.5, range=0..1)
area = Area(Geometry=move_4.Geometry)  # -> Area, Centroid
geo_3 = Geometry(simplify(graft(geo)))
scale = Scale(Geometry=move_4.Geometry, Center=area.Centroid, Factor=Slider(8, range=0..10))  # -> simplify(graft(Geometry)), Transform
loft = Loft(
    Curves=[geo_3, scale.Geometry],
    Options={Adjust=False, Closed=False, LoftEnds=0, LoftSimp=0, LoftType=0, Rebuild=10, Refit=0.01})
geo_4 = Geometry(cap)
cap_3 = CapHoles(Brep=loft)
sdiff = SolidDifference(BrepsA=flatten(cap_2), BrepsB=flatten(cap_3))
bbox = BoundingBox(Content=sdiff, Plane=PlaneXY(0, 0, 0))  # -> Box, Box_2
box = EvaluateBox(Box=bbox.Box, UParameter=number_slider_3, VParameter=number_slider_3, WParameter=Slider(0, range=0..100))  # -> Plane, Point, Include
pdecon_2 = Deconstruct(Point=box.Point)  # -> XComponent, YComponent, ZComponent
sort = SortList(Keys=pdecon_2.ZComponent, ValuesA=pdecon_2.ZComponent)  # -> Keys, ValuesA
item = ListItem(List=sort.Keys, Index=0, Wrap=True)
sdiff_2 = SolidDifference(BrepsA=flatten(geo_4), BrepsB=flatten(cap_3))
similar = Similarity(FirstNumber=pdecon_2.ZComponent, SecondNumber=item, Threshold=0.1)  # -> Similarity, AbsoluteDifference
geo_5 = Geometry(sdiff)
dispatch_3 = Dispatch(List=geo_5, DispatchPattern=similar.Similarity)  # -> ListA, ListB
dcon = DeleteConsecutive(Set=pdecon_2.ZComponent, Wrap=item)  # -> Set, Count
geo_6 = Geometry(dispatch_3.ListA)
volume = Volume(Geometry=geo_6)  # -> Volume, Centroid
number_slider_4 = Slider(0.5, range=0..1)
smaller = SmallerThan(FirstNumber=volume.Volume, SecondNumber=Slider(30000, range=0..100000))  # -> SmallerThan, OrEqualTo
dispatch_4 = Dispatch(List=geo_6, DispatchPattern=smaller.SmallerThan)  # -> ListA, ListB
geo_7 = Geometry(dispatch_4.ListB)
bbox_2 = BoundingBox(Content=geo_7, Plane=PlaneXY(0, 0, 0))  # -> Box, Box_2
box_2 = EvaluateBox(Box=bbox_2.Box, UParameter=number_slider_4, VParameter=number_slider_4, WParameter=Slider(0, range=0..100))  # -> Plane, Point, Include
int_far_options = Integer(int_far_2)
scale_nu = ScaleNU(Geometry=geo_7, Plane=box_2.Point, ScaleX=1, ScaleY=1, ScaleZ=1)  # -> Geometry, Transform
O = ClusterInput()
contour = Contour(Shape=geo_7, Point=box_2.Point, Direction=Vector(0, 0, 1), Distance=floor_to_floor_height_4)  # -> simplify(Contours)
pshift = ShiftPaths(Data=contour, Offset=-1)  # -> reverse(Data)
series = Series(Start=0, Step=1, Count=int_far_options)
geo_8 = Geometry(geo_7)
number_slider_5 = Slider(1, range=0..1)
number_slider_6 = Slider(30, range=0..100)
cull_i = CullIndex(List=pshift, Indices=series, Wrap=True)  # -> flatten(List)
crv = Curve(cull_i)
geo_9 = ClusterOutput(geo_8)
Z_4 = UnitZ(Factor=floor_to_floor_height_2)
int_offset_7 = ClusterInput()
geo_10 = Geometry(crv)
geo_11 = Geometry([sdiff_2, geo_8])
extr_3 = Extrude(Base=crv, Direction=Z_4)
cap_4 = CapHoles(Brep=extr_3)
psrfclsd = IsPolysurfaceClosed(Polysurface=cap_4)
dispatch_5 = Dispatch(List=geo_10, DispatchPattern=psrfclsd)  # -> ListA, ListB
rebcrv = RebuildCurve(Curve=crv, Count=number_slider_6, Degree=number_slider_5, EndTangents=False)
cap_5 = CapHoles(Brep=extr_3)  # -> simplify(Brep)
geo_12 = Geometry(dispatch_5.ListB)
rebcrv_2 = RebuildCurve(Curve=geo_12, Count=number_slider_6, Degree=number_slider_5, EndTangents=False)
extr_4 = Extrude(Base=rebcrv_2, Direction=Z_4)
area_2 = Area(Geometry=rebcrv)  # -> Area, Centroid
cap_6 = CapHoles(Brep=extr_4)
dispatch_6 = Dispatch(List=cap_5, DispatchPattern=psrfclsd)  # -> ListA, ListB
sunion = SolidUnion(Breps=[dispatch_6.ListA, cap_6])
A = ClusterInput()

number_slider_7 = Slider(0.5, range=0..1)
geo_13 = Geometry(sdiff_2)
bbox_3 = BoundingBox(Content=geo_13, Plane=PlaneXY(0, 0, 0))  # -> Box, Box_2
box_3 = EvaluateBox(Box=bbox_3.Box, UParameter=number_slider_7, VParameter=number_slider_7, WParameter=Slider(0, range=0..100))  # -> Plane, Point, Include
division_3 = Division(A=A, B=3)
contour_2 = Contour(Shape=geo_13, Point=box_3.Point, Direction=Vector(0, 0, 1), Distance=division_3)

geo_14 = Geometry([rebcrv_2, dispatch_5.ListA])
node_crv = Geometry(geo)
node_crv_2 = ClusterOutput(node_crv)
pshift_2 = ShiftPaths(Data=contour_2, Offset=-1)
cull_i_2 = CullIndex(List=pshift_2, Indices=0, Wrap=True)
geo_15 = Geometry(flatten(cull_i_2))
Z_5 = UnitZ(Factor=1)
amp_2 = Amplitude(Vector=Z_5, Amplitude=division_3)
num_podium_height = ClusterInput()
neg_2 = Negative(Value=amp_2)
extr_5 = Extrude(Base=geo_15, Direction=neg_2)
num_podium_height_2 = Number(num_podium_height)
cap_7 = CapHoles(Brep=extr_5)
sunion_2 = SolidUnion(Breps=cap_7)
crv_markethall = ClusterInput()
crv_markethall_2 = Geometry(crv_markethall)
crv_mega_block = ClusterInput()
market_public_open_space = ClusterInput()

area_3 = Area(Geometry=flatten([geo_15, crv_markethall_2, geo_14]))  # -> Area, Centroid
crv_mega_block_2 = Curve(crv_mega_block)
area_4 = Area(Geometry=crv_mega_block_2)  # -> Area, Centroid
ma = MassAddition(Input=area_3.Area)  # -> Result, PartialResults
division_4 = Division(A=ma.Result, B=area_4.Area)

geo_16 = Geometry(flatten([sunion, sunion_2]))
market_public_open_space_2 = Geometry(market_public_open_space)
geo_17 = ClusterOutput(geo_16)
edges = BrepEdges(Brep=geo_11)  # -> Naked, Interior, NonManifold
podium = Geometry(sdiff_2)
tower = Geometry(sunion)
R = ClusterOutput(division_4)
geo_18 = ClusterOutput(geo_14)
podium_2 = ClusterOutput(podium)
en = ClusterOutput(edges.Naked)
tower_2 = ClusterOutput(tower)
market_public_open_space_3 = ClusterOutput(market_public_open_space_2)

# ---- group: Podium block
int_podium_parcel_width = Integer(Slider(40, range=0..100))
crv_podium_4 = Geometry(crv_podium_2)
number_slider_8 = Slider(5000, range=0..10000)
Z_6 = UnitZ(Factor=num_podium_height_2)

# ----
crv_podium_5 = ClusterOutput(crv_podium_4)

# ---- group: Podium block
disc = Discontinuity(Curve=crv_podium_4, Level=1)  # -> Points, Parameters
int_parcel_width = Integer(int_podium_parcel_width)
pline = PolyLine(Vertices=disc.Points, Closed=True)
parcels = Parcels(Polygons=pline, ConnectionDistance=1, StreetOffset=0, PlotWidthThreshold=int_parcel_width, Precision=100)
xy = XYPlane(Origin=O)
project = Project(Geometry=parcels, Plane=xy)  # -> Geometry, Transform

# ----
G = ClusterOutput(project.Geometry)

geo_19 = Geometry(project.Geometry)
area_5 = Area(Geometry=simplify(geo_19))  # -> Area, Centroid
avr = Average(Input=flatten(area_5.Area))
panel_4 = Panel(avr)
division_5 = Division(A=panel_4, B=3)
smaller_2 = SmallerThan(FirstNumber=area_5.Area, SecondNumber=division_5)  # -> SmallerThan, OrEqualTo
dispatch_7 = Dispatch(List=geo_19, DispatchPattern=smaller_2.SmallerThan)  # -> ListA, ListB
podium_block = Geometry(dispatch_7.ListB)
public_open_space = Geometry(dispatch_7.ListA)

boundary_2 = BoundarySurfaces(Edges=flatten(public_open_space))
podium_public_open_space = Geometry(boundary_2)
area_6 = Area(Geometry=flatten([podium_public_open_space, market_public_open_space_2]))  # -> Area, Centroid
podium_public_open_space_2 = ClusterOutput(podium_public_open_space)
A_2 = ClusterOutput(area_6.Area)

# ---- group: Podium block
int_offset_8 = Integer(int_offset_7)
crv_podium_6 = Curve(simplify(graft(podium_block)))
int_offset_9 = Integer(int_offset_8)

# ----
neg_3 = Negative(Value=int_offset_8)
offset_l_3 = OffsetCurveLoose(Curve=crv_podium_6, Distance=neg_3)

# ---- group: Podium block (continued)
curvepoint_3 = PointOnCurve(offset_l_3, parameter=0.549)
incurve_3 = PointInCurve(Point=curvepoint_3, Curve=crv_podium_6)  # -> Relationship, Point
dispatch_8 = Dispatch(List=crv_podium_6, DispatchPattern=incurve_3.Relationship)  # -> ListA, ListB
flip_3 = FlipCurve(Curve=dispatch_8.ListB)  # -> Curve, Flag
merge_3 = Merge(Data1=dispatch_8.ListA, Data2=flip_3.Curve)

# ----
offset_l_4 = OffsetCurveLoose(Curve=merge_3, Distance=neg_3)

# ---- group: Podium block (continued)
geo_20 = Geometry(simplify(offset_l_4))

# ----
geo_21 = Geometry(geo_20)
geo_22 = Geometry(node_crv)
geo_23 = Geometry(simplify(geo_21))
ccx = CurveCurve(CurveA=geo_23, CurveB=geo_22)  # -> Points, ParamsA, ParamsB
pshift_3 = ShiftPaths(Data=ccx.Points, Offset=-1)
null = NullItem(Item=pshift_3)  # -> NullFlags, InvalidFlags, Description
ma_2 = MassAddition(Input=null.NullFlags)  # -> Result, PartialResults
dispatch_9 = Dispatch(List=geo_23, DispatchPattern=ma_2.Result)  # -> ListA, ListB
crv_podium_parcels_deleted = Geometry(dispatch_9.ListA)
panel_5 = Panel(crv_podium_parcels_deleted)

pshift_4 = ShiftPaths(Data=geo_20, Offset=-1)
area_7 = Area(Geometry=pshift_4)  # -> Area, Centroid
sort_2 = SortList(Keys=area_7.Area, ValuesA=pshift_4)  # -> Keys, reverse(ValuesA)
lng = ListLength(List=pshift_4)
division_6 = Division(A=lng, B=3)
round = Round(Number=division_6)  # -> Nearest, Floor, Ceiling
split = SplitList(List=simplify(sort_2.ValuesA), Index=round.Nearest)  # -> ListA, ListB
geo_24 = Geometry(split.ListA)

# ---- group: Podium block (continued)
extr_6 = Extrude(Base=crv_podium_parcels_deleted, Direction=Z_6)
cap_8 = CapHoles(Brep=extr_6)

# ----
crv_podium_parcels_deleted_2 = ClusterOutput(crv_podium_parcels_deleted)
B = ClusterOutput(cap_8)
crv_core = Geometry(geo_24)
crv_core_2 = ClusterOutput(crv_core)
geo_25 = Geometry(cap_8)
