# Grasshopper definition great out door building types.gh (Grasshopper 1.0.7)
# plug-ins: DeCodingSpaces

street_option = Slider(1, range=0..2)
population_option = Slider(2, range=0..2)
urban_density = Slider(2, range=0..2)
int_street_option = Integer(street_option)
population_density = Panel("""6
10
15""")
item = ListItem(List=population_density, Index=population_option, Wrap=True)
far_cluster = Panel("""8
6
10""")
far_varation = Panel(""".4
.6
1""")
item_2 = ListItem(List=far_varation, Index=population_option, Wrap=True)
item_3 = ListItem(List=far_cluster, Index=population_option, Wrap=True)
panel = Panel(item_3)
panel_2 = Panel(item_2)
num_varation = Number(item_2)
int_clusters = Integer(item_3)
num_far = Number(item)
int_clusters_2 = Integer(int_clusters)

# ---- group: Height Distribution
subtraction = Subtraction(A="1.2", B=num_varation)
addition = Addition(A="1.2", B=num_varation)
int_clusters_3 = Integer(int_clusters)
dom = ConstructDomain(DomainStart=subtraction, DomainEnd=addition)
num_far_2 = Number(num_far)
range = Range(Domain=dom, Steps=expr("x-1", int_clusters_3))
rev = ReverseList(List=range)
multiplication = Multiplication(A=num_far_2, B=rev)
num_far_variation = Number(simplify(graft(multiplication)))
floor_to_floor_height = Panel("12")
multiplication_2 = Multiplication(A=floor_to_floor_height, B=num_far_variation)

# ---- group: High:Podium & Nest / Building Bar Location
offseted_edges = Panel("1")

# ---- group: High:Podium & Nest / Building Thickness next to Public Space
panel_3 = Panel("40")

# ---- group: Defining Clusters
pt_density_attract = Point(Point(988215.8376, 215357.0398, 0))

# ---- group: Parcel Generation
typical_street_width = Panel("60")
pacel_width = Panel("100")
crv_streets_1 = Curve([<curve referenced from the Rhino model> x11])
crv_streets_2 = Curve([<curve referenced from the Rhino model> x21])
crv_streets_3 = Curve([<curve referenced from the Rhino model> x12])
crv_mega_block = Curve(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)
int_street_option_2 = Integer(int_street_option)
int_parcel_width = Integer(pacel_width)
crv_mega_block_2 = Curve(crv_mega_block)

crv_streets_1_2 = Curve(crv_streets_1)
crv_streets_2_2 = Curve(crv_streets_2)
crv_streets_3_2 = Curve(crv_streets_3)

filter = StreamFilter(Gate=int_street_option_2, Stream0=crv_streets_1_2, Stream1=crv_streets_2_2, Stream2=crv_streets_3_2)
crv_streets = Curve(simplify(graft(filter)))
ext = ExtendCurve(Curve=crv_streets, Type=0, Start="45", End="45")

# ---- group: Parcel Generation / Create subtraction curves
int_street_width = Integer(simplify(graft(typical_street_width)))
neg = Negative(Value=int_street_width)
merge = Merge(Data1=int_street_width, Data2=neg)
offset = Offset(Curve=ext, Distance=merge, Plane=PlaneXY(0, 0, 0), Corners=1)
trim = TrimTree(Tree=offset, Depth=1)
end = EndPoints(Curve=trim)  # -> Start, End
item_4 = ListItem(List=end.End, Index=0, Wrap=True)  # -> Item, Item1
item_5 = ListItem(List=end.Start, Index=0, Wrap=True)  # -> Item, Item1
ln = Line(StartPoint=item_4.Item, EndPoint=item_4.Item1)
ln_2 = Line(StartPoint=item_5.Item, EndPoint=item_5.Item1)
merge_2 = Merge(Data1=trim, Data2=ln_2, Data3=ln)
join = JoinCurves(Curves=merge_2, Preserve=False)  # -> flatten(Curves)

# ---- group: Parcel Generation / Create Blocks
srfsplit = SurfaceSplit(Surface=crv_mega_block_2, Curves=join)
area = Area(Geometry=srfsplit)  # -> Area, Centroid
incurves = PointInCurves(Point=area.Centroid, Curves=join)  # -> Relationship, Index, Point
dispatch = Dispatch(List=srfsplit, DispatchPattern=incurves.Relationship)  # -> ListA, ListB
crv_blocks = Curve(dispatch.ListB)

# ---- group: Parcel Generation / Parcel
disc = Discontinuity(Curve=crv_blocks, Level=1)  # -> Points, Parameters
int_parcel_width_2 = Integer(int_parcel_width)
pline = PolyLine(Vertices=disc.Points, Closed=True)
parcels = Parcels(Polygons=pline, ConnectionDistance=1, StreetOffset=0, PlotWidthThreshold=int_parcel_width_2, Precision=100)  # -> flatten(Parcels)

# ---- group: Parcel Generation (continued)
crv_parcel = Curve(parcels)

# ----
crv_parcel_2 = Curve(crv_parcel)
crv_parcel_3 = Curve(crv_parcel_2)

# ---- group: Defining Clusters (continued)
area_2 = Area(Geometry=crv_parcel_3)  # -> Area, Centroid
jitter = Jitter(List=crv_parcel_3, Jitter=1, Seed=2)  # -> Values, Indices
dist = Distance(PointA=area_2.Centroid, PointB=pt_density_attract)
sort = SortList(Keys=dist, ValuesA=crv_parcel_3)  # -> Keys, ValuesA
rev_2 = ReverseList(List=sort.ValuesA)
lng = ListLength(List=crv_parcel_3)
division = Division(A=lng, B=int_clusters_2)
round = Round(Number=division)  # -> Nearest, Floor, Ceiling

# ----
filter_2 = StreamFilter(Gate=urban_density, Stream0=sort.ValuesA, Stream1=jitter.Values, Stream2=rev_2)

# ---- group: Defining Clusters (continued)
partition = PartitionList(List=filter_2, Size=round.Ceiling)  # -> simplify(Chunks)
crv_parcels = Curve(partition)

# ---- group: Extrusion
crv_parcels_2 = Curve(crv_parcels)
Z = UnitZ(Factor=multiplication_2)
extr = Extrude(Base=crv_parcels_2, Direction=Z)
cap = CapHoles(Brep=extr)

# ----
brep_all_buildings = Brep(cap)
find_height = FindHeight(B=brep_all_buildings)
num_buidling_height = Number(find_height)

# ---- group: 3 Population
brep_all_buildings_2 = Brep(flatten(brep_all_buildings))
brep_all_buildings_3 = Brep(flatten(brep_all_buildings))
brep_all_buildings_4 = Brep(flatten(brep_all_buildings))
larger = LargerThan(FirstNumber=flatten(num_buidling_height), SecondNumber="200")  # -> LargerThan, OrEqualTo
smaller = SmallerThan(FirstNumber=flatten(num_buidling_height), SecondNumber="200")  # -> SmallerThan, OrEqualTo
smaller_2 = SmallerThan(FirstNumber=flatten(num_buidling_height), SecondNumber="120")  # -> SmallerThan, OrEqualTo
cull = CullPattern(List=brep_all_buildings_4, CullPattern=smaller.SmallerThan)
find_height_2 = FindHeight(B=cull)
larger_2 = LargerThan(FirstNumber=flatten(find_height_2), SecondNumber="120")  # -> LargerThan, OrEqualTo
cull_2 = CullPattern(List=cull, CullPattern=larger_2.LargerThan)
cull_3 = CullPattern(List=brep_all_buildings_3, CullPattern=larger.LargerThan)
cull_4 = CullPattern(List=brep_all_buildings_2, CullPattern=smaller_2.SmallerThan)

# ----
brep_high = Brep(cull_3)
brep_low = Brep(cull_4)
brep_mid = Brep(cull_2)
brep_mid_2 = Brep(brep_mid)
brep_high_2 = Brep(brep_high)
brep_low_2 = Brep(brep_low)

# ---- group: High:Podium & Nest / Public Volume Height
find_height_3 = FindHeight(B=brep_high_2)
num_buidling_height_2 = Number(find_height_3)
division_2 = Division(A=num_buidling_height_2, B="12")
num_of_floor = Number(graft(division_2))
division_3 = Division(A=num_of_floor, B="3")
multiplication_3 = Multiplication(A=division_3, B="12")

# ---- group: LOW:Circle+Arcade
debrep = DeconstructBrep(Brep=brep_low_2)  # -> Faces, Edges, Vertices
item_6 = ListItem(List=debrep.Faces, Index="1", Wrap=True)
area_3 = Area(Geometry=item_6)  # -> Area, Centroid
larger_3 = LargerThan(FirstNumber=area_3.Area, SecondNumber="28000")  # -> LargerThan, OrEqualTo
dispatch_2 = Dispatch(List=item_6, DispatchPattern=larger_3.LargerThan)  # -> ListA, ListB
srf_circle = Surface(simplify(flatten(dispatch_2.ListA)))
srf_arcade = Surface(dispatch_2.ListB)
edges = BrepEdges(Brep=srf_circle)  # -> Naked, Interior, NonManifold
edges_2 = BrepEdges(Brep=srf_arcade)  # -> Naked, Interior, NonManifold
midpt = CurveMiddle(Curve=edges_2.Naked)
crv_parcel_4 = Curve(edges.Naked)
end_2 = EndPoints(Curve=crv_parcel_4)  # -> Start, End
crv_streets_4 = Curve(flatten(crv_streets))
pull = PullPoint(Point=midpt, Geometry=crv_streets_4, ClosestOnly=True)  # -> ClosestPoint, Distance
sort_2 = SortList(Keys=pull.Distance, ValuesA=edges_2.Naked)  # -> Keys, ValuesA
item_7 = ListItem(List=sort_2.ValuesA, Index=0, Wrap=True)
pull_2 = PullPoint(Point=end_2.Start, Geometry=crv_streets_4, ClosestOnly=True)  # -> ClosestPoint, Distance
street_offset = Panel("8")
crv_side_of_arcade = Curve(item_7)
sort_3 = SortList(Keys=pull_2.Distance, ValuesA=end_2.Start)  # -> Keys, ValuesA
offset_2 = OffsetCurve(Curve=crv_side_of_arcade, Distance=street_offset, Plane=PlaneXY(0, 0, 0), Corners=1)
item_8 = ListItem(List=sort_3.ValuesA, Index=0, Wrap=True)
item_9 = ListItem(List=sort_3.ValuesA, Index="1", Wrap=True)
arcade_width = Panel("40")
dist_2 = Distance(PointA=item_8, PointB=item_9)
pt_circle_center = Point(item_8)
offset_3 = OffsetCurve(Curve=crv_side_of_arcade, Distance=arcade_width, Plane=PlaneXY(0, 0, 0), Corners=1)
division_4 = Division(A=dist_2, B="2")
cir = Circle(Plane=pt_circle_center, Radius=division_4)
ext_2 = ExtendCurve(Curve=crv_side_of_arcade, Type=0, Start="10", End="10")
ext_3 = ExtendCurve(Curve=offset_3, Type=0, Start="10", End="10")
trim_2 = TrimTree(Tree=ext_3, Depth=1)
srf_circle_public_space = Surface(cir)
end_3 = EndPoints(Curve=ext_2)  # -> Start, End
Z_2 = UnitZ(Factor="550")
end_4 = EndPoints(Curve=trim_2)  # -> Start, End
extr_2 = Extrude(Base=srf_circle_public_space, Direction=Z_2)
ln_3 = Line(StartPoint=end_4.Start, EndPoint=end_3.Start)
ln_4 = Line(StartPoint=end_4.End, EndPoint=end_3.End)
merge_3 = Merge(Data1=trim_2, Data2=ext_2, Data3=ln_3, Data4=ln_4)  # -> flatten(Result)
join_2 = JoinCurves(Curves=merge_3, Preserve=False)  # -> graft(Curves)
srf_arcade_public_space = Surface(join_2)
merge_4 = Merge(Data1=srf_circle_public_space, Data2=srf_arcade_public_space)
Z_3 = UnitZ(Factor="24")
extr_3 = Extrude(Base=srf_arcade_public_space, Direction=Z_3)
srf_low_public_space = Surface(merge_4)
merge_5 = Merge(Data1=extr_2, Data2=extr_3)  # -> flatten(Result)
brep_low_3 = Brep(brep_low_2)
sdiff = SolidDifference(BrepsA=brep_low_3, BrepsB=merge_5)
brep_low_c_a = Brep(sdiff)
edges_3 = BrepEdges(Brep=sdiff)  # -> Naked, Interior, NonManifold
preview = CustomPreview(Geometry=sdiff, Material=ColourSwatch(SwatchColor=RGB(255, 255, 255)))
preview_2 = CustomPreview(Geometry=edges_3.Interior, Material=ColourSwatch(SwatchColor=RGB(0, 0, 0)))

# ---- group: High:Podium & Nest
debrep_2 = DeconstructBrep(Brep=brep_high_2)  # -> Faces, Edges, Vertices
item_10 = ListItem(List=debrep_2.Faces, Index="1", Wrap=True)
Z_4 = UnitZ(Factor=multiplication_3)
move = Move(Geometry=item_10, Motion=Z_4)  # -> Geometry, Transform
srf_building_footprint = Surface(move.Geometry)
edges_4 = BrepEdges(Brep=move.Geometry)  # -> Naked, Interior, NonManifold
area_4 = Area(Geometry=move.Geometry)  # -> Area, Centroid
item_11 = ListItem(List=edges_4.Naked, Index=offseted_edges, Wrap=True)
item_12 = ListItem(List=edges_4.Naked, Index=offseted_edges, Wrap=True)
cir_2 = Circle(Plane=area_4.Centroid, Radius="25")
offset_4 = OffsetCurve(Curve=item_11, Distance=panel_3, Plane=PlaneXY(0, 0, 0), Corners=1)
ext_4 = ExtendCurve(Curve=item_12, Type=0, Start="30", End="30")
ext_5 = ExtendCurve(Curve=offset_4, Type=0, Start="30", End="30")
trim_3 = TrimTree(Tree=ext_5, Depth=1)
end_5 = EndPoints(Curve=trim_3)  # -> Start, End
end_6 = EndPoints(Curve=ext_4)  # -> Start, End
item_13 = ListItem(List=end_5.End, Index=0, Wrap=True)  # -> Item, Item1
item_14 = ListItem(List=end_5.Start, Index=0, Wrap=True)  # -> Item, Item1
item_15 = ListItem(List=end_6.Start, Index=0, Wrap=True)  # -> Item, Item1
item_16 = ListItem(List=end_6.End, Index=0, Wrap=True)  # -> Item, Item1
ln_5 = Line(StartPoint=item_13.Item, EndPoint=item_16.Item)
ln_6 = Line(StartPoint=item_14.Item, EndPoint=item_15.Item)
merge_6 = Merge(Data1=trim_3, Data2=ln_6, Data3=ln_5)
join_3 = JoinCurves(Curves=merge_6, Preserve=False)  # -> flatten(Curves)
srfsplit_2 = SurfaceSplit(Surface=move.Geometry, Curves=join_3)
area_5 = Area(Geometry=srfsplit_2)  # -> Area, Centroid
incurves_2 = PointInCurves(Point=area_5.Centroid, Curves=cir_2)  # -> Relationship, Index, Point
dispatch_3 = Dispatch(List=srfsplit_2, DispatchPattern=incurves_2.Relationship)  # -> ListA, ListB
srf_ps_foundations = Surface(dispatch_3.ListA)
area_6 = Area(Geometry=srf_ps_foundations)  # -> Area, Centroid
srf_building_footprint_2 = Surface(srf_building_footprint)
larger_4 = LargerThan(FirstNumber=area_6.Area, SecondNumber="15000")  # -> LargerThan, OrEqualTo
num_public_volume_height = Number(multiplication_3)
cull_5 = CullPattern(List=srf_building_footprint_2, CullPattern=larger_4.OrEqualTo)
dispatch_4 = Dispatch(List=srf_ps_foundations, DispatchPattern=larger_4.OrEqualTo)  # -> ListA, ListB
srf_space_on_podium = Surface(dispatch_4.ListA)
srf_public_space_nesting = Surface(dispatch_4.ListB)
sdiff_2 = SolidDifference(BrepsA=flatten(cull_5), BrepsB=flatten(srf_space_on_podium))  # -> graft(Result)
multiplication_4 = Multiplication(A=num_public_volume_height, B="2.01")
srf_public_space_on_podium = Surface(sdiff_2)
Z_5 = UnitZ(Factor=num_public_volume_height)
Z_6 = UnitZ(Factor=multiplication_4)
area_7 = Area(Geometry=srf_space_on_podium)  # -> Area, Centroid
area_8 = Area(Geometry=srf_public_space_on_podium)  # -> Area, Centroid
area_9 = Area(Geometry=srf_public_space_nesting)  # -> Area, Centroid
extr_4 = Extrude(Base=srf_public_space_on_podium, Direction=Z_6)
extr_5 = Extrude(Base=srf_public_space_nesting, Direction=Z_5)
cap_2 = CapHoles(Brep=extr_4)
cap_3 = CapHoles(Brep=extr_5)
srf_public_space_on_podium_2 = Surface(srf_public_space_on_podium)
srf_public_space_nesting_2 = Surface(srf_public_space_nesting)
scale_nu = ScaleNU(Geometry=cap_2, Plane=area_8.Centroid, ScaleX="1.01", ScaleY="1.01", ScaleZ=1)  # -> flatten(Geometry), Transform
scale_nu_2 = ScaleNU(Geometry=cap_3, Plane=area_9.Centroid, ScaleX="1.01", ScaleY="1.01", ScaleZ=1)  # -> flatten(Geometry), Transform
merge_7 = Merge(Data1=srf_public_space_on_podium_2, Data2=srf_public_space_nesting_2)
merge_8 = Merge(Data1=scale_nu.Geometry, Data2=scale_nu_2.Geometry)
srf_public_space = Surface(merge_7)
brep_high_3 = Brep(brep_high_2)
sdiff_3 = SolidDifference(BrepsA=brep_high_3, BrepsB=merge_8)
edges_5 = BrepEdges(Brep=sdiff_3)  # -> Naked, Interior, NonManifold
preview_3 = CustomPreview(Geometry=edges_5.Interior, Material=ColourSwatch(SwatchColor=RGB(0, 0, 0)))
preview_4 = CustomPreview(Geometry=sdiff_3, Material=ColourSwatch(SwatchColor=RGB(255, 255, 255)))

# ----
brep_mid_3 = Brep(brep_mid_2)
brep_mid_4 = Brep(brep_mid_2)

# ---- group: MID:Roof
debrep_3 = DeconstructBrep(Brep=brep_mid_3)  # -> Faces, Edges, Vertices
item_17 = ListItem(List=debrep_3.Faces, Index=0, Wrap=True)
edges_6 = BrepEdges(Brep=brep_mid_3)  # -> Naked, Interior, NonManifold
area_10 = Area(Geometry=item_17)  # -> Area, Centroid
preview_5 = CustomPreview(Geometry=edges_6.Interior, Material=ColourSwatch(SwatchColor=RGB(0, 0, 0)))
preview_6 = CustomPreview(Geometry=brep_mid_3, Material=ColourSwatch(SwatchColor=RGB(255, 255, 255)))
preview_7 = CustomPreview(Geometry=item_17, Material=ColourSwatch(SwatchColor=RGB(0, 255, 115)))
panel_4 = Panel(area_10.Area)
srf_roof_park = Surface(item_17)

# ----
brep_high_p_n = Brep(sdiff_3)
srf_public_space_2 = Surface(srf_public_space)
srf_roof_park_2 = Surface(srf_roof_park)
brep_high_p_n_2 = Brep(brep_high_p_n)
brep_mid_5 = Brep(brep_mid_3)
srf_low_public_space_2 = Surface(srf_low_public_space)
brep_low_c_a_2 = Brep(brep_low_c_a)
merge_9 = Merge(Data1=srf_public_space_2, Data2=srf_roof_park_2, Data3=srf_low_public_space_2)  # -> flatten(Result)
merge_10 = Merge(Data1=brep_high_p_n_2, Data2=brep_mid_5, Data3=brep_low_c_a_2)  # -> flatten(Result)
srf_all_public_space = Surface(merge_9)
brep_all_buildings_5 = Brep(merge_10)
edges_7 = BrepEdges(Brep=brep_all_buildings_5)  # -> Naked, Interior, NonManifold
preview_8 = CustomPreview(Geometry=edges_7.Interior, Material=ColourSwatch(SwatchColor=RGB(0, 0, 0)))
preview_9 = CustomPreview(Geometry=brep_all_buildings_5, Material=ColourSwatch(SwatchColor=RGB(255, 255, 255)))
preview_10 = CustomPreview(Geometry=srf_all_public_space, Material=ColourSwatch(SwatchColor=RGB(68, 150, 77)))

srf_all_public_space_2 = Surface(srf_all_public_space)
brep_all_buildings_6 = Brep(brep_all_buildings_5)

# ==== cluster FindHeight
B = ClusterInput()
debrep = DeconstructBrep(Brep=B)  # -> Faces, Edges, Vertices
item = ListItem(List=debrep.Faces, Index=0, Wrap=True)
item_2 = ListItem(List=debrep.Faces, Index="1", Wrap=True)
area = Area(Geometry=item)  # -> Area, Centroid
area_2 = Area(Geometry=item_2)  # -> Area, Centroid
dist = Distance(PointA=area.Centroid, PointB=area_2.Centroid)
D = ClusterOutput(dist)
