# Grasshopper definition Github_Procedure_1124.gh (Grasshopper 1.0.7)
# plug-ins: DeCodingSpaces

street_option = Slider(1, range=0..2)
population_option = Slider(2, range=0..2)
int_street_option = Integer(street_option)
population_density = Panel("""6
10
15""")
item = ListItem(List=population_density, Index=population_option, Wrap=True)
far_cluster = Panel("""8
6
10""")
far_varation = Panel(""".4
.6
1""")
item_2 = ListItem(List=far_varation, Index=population_option, Wrap=True)
item_3 = ListItem(List=far_cluster, Index=population_option, Wrap=True)
panel = Panel(item_3)
panel_2 = Panel(item_2)
num_varation = Number(item_2)
int_clusters = Integer(item_3)
num_far = Number(item)
int_clusters_2 = Integer(int_clusters)

# ---- group: Height Distribution
subtraction = Subtraction(A="1.2", B=num_varation)
addition = Addition(A="1.2", B=num_varation)
int_clusters_3 = Integer(int_clusters)
dom = ConstructDomain(DomainStart=subtraction, DomainEnd=addition)
num_far_2 = Number(num_far)
range = Range(Domain=dom, Steps=expr("x-1", int_clusters_3))
rev = ReverseList(List=range)
multiplication = Multiplication(A=num_far_2, B=rev)
num_far_variation = Number(simplify(graft(multiplication)))
floor_to_floor_height = Panel("12")
multiplication_2 = Multiplication(A=floor_to_floor_height, B=num_far_variation)

# ---- group: High:Podium & Nest / Building Bar Location
offseted_edges = Panel("1")

# ---- group: High:Podium & Nest / Building Thickness next to Public Space
panel_3 = Panel("40")

# ---- group: Defining Clusters
pt_density_attract = Point(Point(988215.8376, 215357.0398, 0))

# ---- group: Parcel Generation
typical_street_width = Panel("60")
pacel_width = Panel("100")
crv_streets_1 = Curve([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])
crv_streets_2 = Curve([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])
crv_streets_3 = Curve([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])
crv_mega_block = Curve(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)
int_street_option_2 = Integer(int_street_option)
int_parcel_width = Integer(pacel_width)
crv_mega_block_2 = Curve(crv_mega_block)

crv_streets_1_2 = Curve(crv_streets_1)
crv_streets_2_2 = Curve(crv_streets_2)
crv_streets_3_2 = Curve(crv_streets_3)

filter = StreamFilter(Gate=int_street_option_2, Stream0=crv_streets_1_2, Stream1=crv_streets_2_2, Stream2=crv_streets_3_2)
crv_streets = Curve(simplify(graft(filter)))
ext = ExtendCurve(Curve=crv_streets, Type=0, Start="45", End="45")

# ---- group: Parcel Generation / Create subtraction curves
int_street_width = Integer(simplify(graft(typical_street_width)))
neg = Negative(Value=int_street_width)
merge = Merge(Data1=int_street_width, Data2=neg)
offset = Offset(Curve=ext, Distance=merge, Plane=PlaneXY(0, 0, 0), Corners=1)
trim = TrimTree(Tree=offset, Depth=1)
end = EndPoints(Curve=trim)  # -> Start, End
item_4 = ListItem(List=end.End, Index=0, Wrap=True)  # -> Item, Item1
item_5 = ListItem(List=end.Start, Index=0, Wrap=True)  # -> Item, Item1
ln = Line(StartPoint=item_4.Item, EndPoint=item_4.Item1)
ln_2 = Line(StartPoint=item_5.Item, EndPoint=item_5.Item1)
merge_2 = Merge(Data1=trim, Data2=ln_2, Data3=ln)
join = JoinCurves(Curves=merge_2, Preserve=False)  # -> flatten(Curves)

# ---- group: Parcel Generation / Create Blocks
srfsplit = SurfaceSplit(Surface=crv_mega_block_2, Curves=join)
area = Area(Geometry=srfsplit)  # -> Area, Centroid
incurves = PointInCurves(Point=area.Centroid, Curves=join)  # -> Relationship, Index, Point
dispatch = Dispatch(List=srfsplit, DispatchPattern=incurves.Relationship)  # -> ListA, ListB
crv_blocks = Curve(dispatch.ListB)

# ---- group: Parcel Generation / Parcel
disc = Discontinuity(Curve=crv_blocks, Level=1)  # -> Points, Parameters
int_parcel_width_2 = Integer(int_parcel_width)
pline = PolyLine(Vertices=disc.Points, Closed=True)
parcels = Parcels(Polygons=pline, ConnectionDistance=1, StreetOffset=0, PlotWidthThreshold=int_parcel_width_2, Precision=100)  # -> flatten(Parcels)

# ---- group: Parcel Generation (continued)
crv_parcel = Curve(parcels)

# ----
crv_parcel_2 = Curve(crv_parcel)
crv_parcel_3 = Curve(crv_parcel_2)

# ---- group: Defining Clusters (continued)
area_2 = Area(Geometry=crv_parcel_3)  # -> Area, Centroid
dist = Distance(PointA=area_2.Centroid, PointB=pt_density_attract)
sort = SortList(Keys=dist, ValuesA=crv_parcel_3)  # -> Keys, ValuesA
lng = ListLength(List=sort.ValuesA)
division = Division(A=lng, B=int_clusters_2)
round = Round(Number=division)  # -> Nearest, Floor, Ceiling
partition = PartitionList(List=sort.ValuesA, Size=round.Ceiling)  # -> simplify(Chunks)
crv_parcels = Curve(partition)

# ---- group: Extrusion
crv_parcels_2 = Curve(crv_parcels)
Z = UnitZ(Factor=multiplication_2)
extr = Extrude(Base=crv_parcels_2, Direction=Z)
cap = CapHoles(Brep=extr)

# ----
brep_all_buildings = Brep(cap)
find_height = FindHeight(B=brep_all_buildings)
num_buidling_height = Number(find_height)

# ---- group: 3 Population
brep_all_buildings_2 = Brep(flatten(brep_all_buildings))
larger = LargerThan(FirstNumber=flatten(num_buidling_height), SecondNumber="200")  # -> LargerThan, OrEqualTo
cull = CullPattern(List=brep_all_buildings_2, CullPattern=larger.LargerThan)

# ----
brep_high = Brep(cull)
brep_high_2 = Brep(brep_high)

# ---- group: High:Podium & Nest / Public Volume Height
find_height_2 = FindHeight(B=brep_high_2)
num_buidling_height_2 = Number(find_height_2)
division_2 = Division(A=num_buidling_height_2, B="12")
num_of_floor = Number(graft(division_2))
division_3 = Division(A=num_of_floor, B="3")
multiplication_3 = Multiplication(A=division_3, B="12")

# ---- group: High:Podium & Nest
debrep = DeconstructBrep(Brep=brep_high_2)  # -> Faces, Edges, Vertices
item_6 = ListItem(List=debrep.Faces, Index="1", Wrap=True)
Z_2 = UnitZ(Factor=multiplication_3)
move = Move(Geometry=item_6, Motion=Z_2)  # -> Geometry, Transform
srf_building_footprint = Surface(move.Geometry)
edges = BrepEdges(Brep=move.Geometry)  # -> Naked, Interior, NonManifold
area_3 = Area(Geometry=move.Geometry)  # -> Area, Centroid
item_7 = ListItem(List=edges.Naked, Index=offseted_edges, Wrap=True)
item_8 = ListItem(List=edges.Naked, Index=offseted_edges, Wrap=True)
cir = Circle(Plane=area_3.Centroid, Radius="25")
offset_2 = OffsetCurve(Curve=item_7, Distance=panel_3, Plane=PlaneXY(0, 0, 0), Corners=1)
ext_2 = ExtendCurve(Curve=item_8, Type=0, Start="30", End="30")
ext_3 = ExtendCurve(Curve=offset_2, Type=0, Start="30", End="30")
trim_2 = TrimTree(Tree=ext_3, Depth=1)
end_2 = EndPoints(Curve=trim_2)  # -> Start, End
end_3 = EndPoints(Curve=ext_2)  # -> Start, End
item_9 = ListItem(List=end_2.End, Index=0, Wrap=True)  # -> Item, Item1
item_10 = ListItem(List=end_2.Start, Index=0, Wrap=True)  # -> Item, Item1
item_11 = ListItem(List=end_3.Start, Index=0, Wrap=True)  # -> Item, Item1
item_12 = ListItem(List=end_3.End, Index=0, Wrap=True)  # -> Item, Item1
ln_3 = Line(StartPoint=item_9.Item, EndPoint=item_12.Item)
ln_4 = Line(StartPoint=item_10.Item, EndPoint=item_11.Item)
merge_3 = Merge(Data1=trim_2, Data2=ln_4, Data3=ln_3)
join_2 = JoinCurves(Curves=merge_3, Preserve=False)  # -> flatten(Curves)
srfsplit_2 = SurfaceSplit(Surface=move.Geometry, Curves=join_2)
area_4 = Area(Geometry=srfsplit_2)  # -> Area, Centroid
incurves_2 = PointInCurves(Point=area_4.Centroid, Curves=cir)  # -> Relationship, Index, Point
dispatch_2 = Dispatch(List=srfsplit_2, DispatchPattern=incurves_2.Relationship)  # -> ListA, ListB
srf_ps_foundations = Surface(dispatch_2.ListA)
area_5 = Area(Geometry=srf_ps_foundations)  # -> Area, Centroid
srf_building_footprint_2 = Surface(srf_building_footprint)
larger_2 = LargerThan(FirstNumber=area_5.Area, SecondNumber="15000")  # -> LargerThan, OrEqualTo
num_public_volume_height = Number(multiplication_3)
cull_2 = CullPattern(List=srf_building_footprint_2, CullPattern=larger_2.OrEqualTo)
dispatch_3 = Dispatch(List=srf_ps_foundations, DispatchPattern=larger_2.OrEqualTo)  # -> ListA, ListB
srf_space_on_podium = Surface(dispatch_3.ListA)
srf_public_space_nesting = Surface(dispatch_3.ListB)
sdiff = SolidDifference(BrepsA=flatten(cull_2), BrepsB=flatten(srf_space_on_podium))  # -> graft(Result)
multiplication_4 = Multiplication(A=num_public_volume_height, B="2.01")
srf_public_space_on_podium = Surface(sdiff)
Z_3 = UnitZ(Factor=num_public_volume_height)
Z_4 = UnitZ(Factor=multiplication_4)
area_6 = Area(Geometry=srf_space_on_podium)  # -> Area, Centroid
area_7 = Area(Geometry=srf_public_space_on_podium)  # -> Area, Centroid
area_8 = Area(Geometry=srf_public_space_nesting)  # -> Area, Centroid
extr_2 = Extrude(Base=srf_public_space_on_podium, Direction=Z_4)
extr_3 = Extrude(Base=srf_public_space_nesting, Direction=Z_3)
cap_2 = CapHoles(Brep=extr_2)
cap_3 = CapHoles(Brep=extr_3)
srf_public_space_on_podium_2 = Surface(srf_public_space_on_podium)
srf_public_space_nesting_2 = Surface(srf_public_space_nesting)
scale_nu = ScaleNU(Geometry=cap_2, Plane=area_7.Centroid, ScaleX="1.01", ScaleY="1.01", ScaleZ=1)  # -> flatten(Geometry), Transform
scale_nu_2 = ScaleNU(Geometry=cap_3, Plane=area_8.Centroid, ScaleX="1.01", ScaleY="1.01", ScaleZ=1)  # -> flatten(Geometry), Transform
merge_4 = Merge(Data1=srf_public_space_on_podium_2, Data2=srf_public_space_nesting_2)
merge_5 = Merge(Data1=scale_nu.Geometry, Data2=scale_nu_2.Geometry)
srf_public_space = Surface(merge_4)
brep_high_3 = Brep(brep_high_2)
sdiff_2 = SolidDifference(BrepsA=brep_high_3, BrepsB=merge_5)
edges_2 = BrepEdges(Brep=sdiff_2)  # -> Naked, Interior, NonManifold
preview = CustomPreview(Geometry=edges_2.Interior, Material=ColourSwatch(SwatchColor=RGB(0, 0, 0)))
preview_2 = CustomPreview(Geometry=sdiff_2, Material=ColourSwatch(SwatchColor=RGB(255, 255, 255)))

# ----
brep_high_p_n = Brep(sdiff_2)
srf_public_space_2 = Surface(srf_public_space)
brep_high_p_n_2 = Brep(brep_high_p_n)
merge_6 = Merge(Data1=srf_public_space_2)  # -> flatten(Result)
merge_7 = Merge(Data1=brep_high_p_n_2)  # -> flatten(Result)
srf_all_public_space = Surface(merge_6)
brep_all_buildings_3 = Brep(merge_7)
edges_3 = BrepEdges(Brep=brep_all_buildings_3)  # -> Naked, Interior, NonManifold
preview_3 = CustomPreview(Geometry=edges_3.Interior, Material=ColourSwatch(SwatchColor=RGB(0, 0, 0)))
preview_4 = CustomPreview(Geometry=brep_all_buildings_3, Material=ColourSwatch(SwatchColor=RGB(255, 255, 255)))
preview_5 = CustomPreview(Geometry=srf_all_public_space, Material=ColourSwatch(SwatchColor=RGB(68, 150, 77)))

srf_all_public_space_2 = Surface(srf_all_public_space)
brep_all_buildings_4 = Brep(brep_all_buildings_3)

# ==== cluster FindHeight
B = ClusterInput()
debrep = DeconstructBrep(Brep=B)  # -> Faces, Edges, Vertices
item = ListItem(List=debrep.Faces, Index=0, Wrap=True)
item_2 = ListItem(List=debrep.Faces, Index="1", Wrap=True)
area = Area(Geometry=item)  # -> Area, Centroid
area_2 = Area(Geometry=item_2)  # -> Area, Centroid
dist = Distance(PointA=area.Centroid, PointB=area_2.Centroid)
D = ClusterOutput(dist)
